# Dynamo graph CREATE APARTMENT VIEWS.dyn (Dynamo 3.3.0.6316)
# packages: archi-lab.net 2023.213.1722, archi-lab.net 2025.300.1225, Crumple 2024.4.3, Genius Loci 2023.2.21

# group: Get rooms
element_classes = ElementTypes("Room")
all_elements_of_class = ElementsOfType(element_class=element_classes)
code_block = CodeBlock { "Podlaží"; }
getParameterValueByName = Element.GetParameterValueByName(element=all_elements_of_class, parameterName=code_block)
boolean = BoolSelector(true)
revit_currentview = Custom[© Revit.CurrentView](refresh=boolean)  # package Crumple; Given the current document, return the active view.
view_level = Custom[View Level](view=revit_currentview)  # package Genius Loci; Returns the level to which a view is associated.
name = Level.Name(level=view_level)
eq = getParameterValueByName == name
filterByBoolMask = List.FilterByBoolMask(list=all_elements_of_class, mask=eq)
code_block_2 = CodeBlock { "Oddělení"; }
getParameterValueByName_2 = Element.GetParameterValueByName(element=filterByBoolMask.in, parameterName=code_block_2)
groupByKey = List.GroupByKey(list=filterByBoolMask.in, keys=getParameterValueByName_2)
code_block_3 = CodeBlock { "Oddělení"; }
getParameterValueByName_3 = Element.GetParameterValueByName(element=groupByKey.groups, parameterName=code_block_3)
code_block_4 = CodeBlock { "NP"; }
split = String.Split(string=name, separator0=code_block_4)
code_block_5 = CodeBlock { "0"; }
add = split + code_block_5
flatten = List.Flatten(list=add)
contains = String.Contains(string=getParameterValueByName_3, searchFor=flatten, lacing=Longest)
anyTrue = List.AnyTrue(list=contains@L2)
filterByBoolMask_2 = List.FilterByBoolMask(list=groupByKey.groups, mask=anyTrue)
watch = Watch(filterByBoolMask_2.in)

# group: Room boundaries
finishBoundary = Room.FinishBoundary(room=filterByBoolMask_2.in)
byJoinedCurves = PolyCurve.ByJoinedCurves(curves=finishBoundary)
polycurve_greatestarea = Custom[© Polycurve.GreatestArea](polycurves=byJoinedCurves@@L2)  # package Crumple; From a list of polycurves, return the one with the largest area only. Can be useful for determining the outer-most boundary in a room with internalised holes.
code_block_6 = CodeBlock { 1500; }
offsetMany = Curve.OffsetMany(curve=polycurve_greatestarea.greatest, signedDistance=code_block_6)
byPatch = Surface.ByPatch(closedCurve=offsetMany)
byUnion = Surface.ByUnion(surfaces=byPatch)
perimeterCurves = Surface.PerimeterCurves(surface=byUnion)
byJoinedCurves_2 = PolyCurve.ByJoinedCurves(curves=perimeterCurves)
code_block_7 = CodeBlock { -500; }
offsetMany_2 = Curve.OffsetMany(curve=byJoinedCurves_2, signedDistance=code_block_7)
byPatch_2 = Surface.ByPatch(closedCurve=offsetMany_2)

# group: Create view
šablona_pohledu = ViewTemplatesUi("#Půdorys studie")  # graph input
name_2 = ElementType.Name(elementType=šablona_pohledu)
count = List.Count(list=filterByBoolMask_2.in)
cycle = List.Cycle(list=revit_currentview, amount=count)
view_duplicate_options = ViewDuplicateOptions("AsDependent")
duplicateView = View.DuplicateView(view=cycle, viewDuplicateOption=view_duplicate_options, lacing=Longest)
code_block_8 = CodeBlock { "Oddělení"; }
getParameterValueByName_4 = Element.GetParameterValueByName(element=filterByBoolMask_2.in, parameterName=code_block_8)
firstItem = List.FirstItem(list=getParameterValueByName_4@L2)
setName = archilab.Revit.Views.Views.SetName(view=duplicateView, name=firstItem)
boolean_2 = BoolSelector(true)
setCropBoxVisible = View.SetCropBoxVisible(view=setName, isVisible=boolean_2)
setCropBoxActive = View.SetCropBoxActive(view=setCropBoxVisible, isActive=boolean_2)
views_setcropbox = Custom[© Views.SetCropBox](views=setCropBoxActive, polyCurves=offsetMany_2)  # package Crumple; Given a view and one polycurve, sets the boundary of that views crop to the curves of that polycurve. Will not accept multiple polycurves or a list of curves.
boolean_3 = BoolSelector(true)
annotationCrop = archilab.Revit.Views.Views.AnnotationCrop(view=views_setcropbox.views, crop=boolean_3)
code_block_9 = CodeBlock { "Zobrazit ořezovou oblast"; }
boolean_4 = BoolSelector(true)
setParameterByName = Element.SetParameterByName(element=annotationCrop, parameterName=code_block_9, value=boolean_4)
