# Dynamo graph CREATE SHEETS AND PLACE VIEWS.dyn (Dynamo 3.3.0.6316)
# packages: Clockwork for Dynamo 2.x 2.4.0, Rhythm 2024.10.1, Data-Shapes 2025.3.119

categories = Categories("OST_Views")
all_elements_of_category = ElementsOfCategory(Category=categories)
primaryView = Custom[View.PrimaryView](view=all_elements_of_category)  # package Clockwork for Dynamo 2.x; Returns the primary view of a given view (i.e. the master view of a dependent view)
isNull = Object.IsNull(object=primaryView)
filterByBoolMask = List.FilterByBoolMask(list=all_elements_of_category, mask=isNull)
code_block = CodeBlock { "Název pohledu"; }
getParameterValueByName = Element.GetParameterValueByName(element=filterByBoolMask.out, parameterName=code_block)
string = StringInput("ÚT")  # graph input
contains = String.Contains(string=getParameterValueByName, searchFor=string)
filterByBoolMask_2 = List.FilterByBoolMask(list=getParameterValueByName, mask=contains)
code_block_2 = CodeBlock { -6; }
code_block_3 = CodeBlock { 6; }
remove = String.Remove(string=filterByBoolMask_2.in, startIndex=code_block_2, count=code_block_3)
code_block_4 = CodeBlock { 3; }
length = String.Length(string=filterByBoolMask_2.in)
code_block_5 = CodeBlock(x=length) { x-3; }
remove_2 = String.Remove(string=filterByBoolMask_2.in, startIndex=code_block_4, count=code_block_5)
code_block_6 = CodeBlock(x=remove_2, y=string) { x+ " "+y; }
titleblock_types = TitleblockTypes("#Razítko studie, levé:Běžná")
byNameNumberTitleBlock = Sheet.ByNameNumberTitleBlock(sheetName=remove, sheetNumber=code_block_6, titleBlockFamilyType=titleblock_types)
sheet_Titleblock = Custom[Sheet_Titleblock](Sheet=byNameNumberTitleBlock)  # package Data-Shapes; Gets the titleblock used in a Sheet
code_block_7 = CodeBlock { "Nakreslil"; }
string_2 = StringInput("ÚSTŘEDNÍ TOPENÍ")  # graph input
setParameterByName = Element.SetParameterByName(element=sheet_Titleblock.TitleBlock_FamilyInstance, parameterName=code_block_7, value=string_2)
code_block_8 = CodeBlock { "Název pohledu"; }
getParameterValueByName_2 = Element.GetParameterValueByName(element=all_elements_of_category, parameterName=code_block_8)
code_block_9 = CodeBlock(x=string) { ".Legenda "+x; }
eq = getParameterValueByName_2 == code_block_9
filterByBoolMask_3 = List.FilterByBoolMask(list=all_elements_of_category, mask=eq)
code_block_10 = CodeBlock { 319.925; 248.931; }
byCoordinates = Point.ByCoordinates(x=code_block_10.out0, y=code_block_10.out1)
bySheetViewLocation = Viewport.BySheetViewLocation(sheet=byNameNumberTitleBlock, view=filterByBoolMask_3.in, location=byCoordinates, lacing=Longest)
filterByBoolMask_4 = List.FilterByBoolMask(list=filterByBoolMask.out, mask=contains)
code_block_11 = CodeBlock { 145.53; 154.192; }
byCoordinates_2 = Point.ByCoordinates(x=code_block_11.out0, y=code_block_11.out1)
bySheetViewLocation_2 = Viewport.BySheetViewLocation(sheet=byNameNumberTitleBlock, view=filterByBoolMask_4.in, location=byCoordinates_2)
