# Dynamo graph Check detail lines.dyn (Dynamo 3.3.0.6316)

code_block = CodeBlock()
# ---------- code_block.designscript (1 lines) ----------
[81617,81676,82432,83331,87080,87081,87082,92617,110910,110911,110916,112194,112195,112200,211534,211650,211653,211656,212543,212544,
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
# ----------------------------------------
element_by_id = ElementById(Id=code_block)
geometry = Element.Geometry(element=element_by_id)
code_block_2 = CodeBlock()
# ---------- code_block_2.designscript (1 lines) ----------
[2097605,2097606,2097607,2097608,2097609,2097610,2097611,2097613,2097614,2097615,2097616,2097618,2097619,2097620,2097621,2097623,2097624,2097625,2097626,2097628,
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
# ----------------------------------------
element_by_id_2 = ElementById(Id=code_block_2)
geometry_2 = Element.Geometry(element=element_by_id_2)
code_block_3 = CodeBlock()
# ---------- code_block_3.designscript (1 lines) ----------
[4499712,4499714,4499715,4499716,4499717,4499718,4499719,4499720,4499721,4499722,4499723,4499724,4499725,4499726,4499727,4499728,4499729,4499730,4499731,4499732,
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
# ----------------------------------------
element_by_id_3 = ElementById(Id=code_block_3)
geometry_3 = Element.Geometry(element=element_by_id_3)
