# Dynamo graph BATCH DUPLCIATE SCHEDULES.dyn (Dynamo 3.3.0.6316)
# packages: Genius Loci 2024.5.29, archi-lab.net 2025.300.1225

code_block = CodeBlock { "Výkaz místností"; }
view_byname = Custom[View ByName](ViewName=code_block)  # package Genius Loci; Collect views by given name in the active or given document. Based on a Christian Gartland's script.
fields = ScheduleView.Fields(scheduleView=view_byname)
code_block_2 = CodeBlock { 0; }
getItemAtIndex = List.GetItemAtIndex(list=fields, index=code_block_2)
schedule_filter_type = ScheduleFilterType("GreaterThan")
code_block_3 = CodeBlock { "3"; }
byFieldTypeAndValue = Revit.Schedules.ScheduleFilter.ByFieldTypeAndValue(field=getItemAtIndex, filterType=schedule_filter_type, value=code_block_3)
addFilters = ScheduleView.AddFilters(scheduleView=view_byname, scheduleFilters=byFieldTypeAndValue)
duplicate_options = DuplicateOptionsUi("Duplicate")
duplicate = archilab.Revit.Views.Views.Duplicate(options=duplicate_options)  # unwired: view
duplicateView = View.DuplicateView(view=view_byname)
