# Dynamo graph CENTER ROOM TAGS.dyn (Dynamo 2.16.2.5624)
# packages: Rhythm 2023.2.2, Modelical 2023.6.30, WombatDynamo 2.3.4

categories = Categories("OST_Rooms")
all_elements_of_category = ElementsOfCategory(Category=categories)
centerLocation = Custom[Room.CenterLocation](rooms=all_elements_of_category)  # package Modelical; This node moves the room location of the selected rooms to the closest possible point to geometrical center.
list_create = List.Create(item0=centerLocation.centeredRooms, item1=centerLocation.movedRooms, item2=centerLocation.errorRooms)
boolean = BoolSelector(true)
getActiveView = WombatDynamo.View.GetActiveView(update=boolean)
ʳʰʸᵗʰᵐ_rooms_roomtagsinview = Rhythm.Revit.Elements.Rooms.RoomTagsInView(room=list_create, view=getActiveView)
ʳʰʸᵗʰᵐ_roomtag = Rhythm.Revit.Elements.RoomTag.CenterOnRoomLocation(roomTag=ʳʰʸᵗʰᵐ_rooms_roomtagsinview)
