# Dynamo graph CHANGE WINDOW FAMILY.dyn (Dynamo 2.16.1.2727)
# packages: archi-lab.net 2023.213.1722, Rhythm 2023.2.2

categories = Categories("OST_Windows")
byCategory = archilab.Revit.Selection.Select.ByCategory(category=categories)
getFamily = FamilyInstance.GetFamily(familyInstance=byCategory)
uniqueItems = List.UniqueItems(list=getFamily)
code_block = CodeBlock { 1; }
getItemAtIndex = List.GetItemAtIndex(list=uniqueItems, index=code_block)
types = Family.Types(family=getItemAtIndex)
all_elements_of_family_type = ElementsOfFamilyType(Family_Type=types)
flatten = List.Flatten(list=all_elements_of_family_type)
family_types = FamilyTypes("#Okno, pomocné:#Okno, pomocné")
id = Element.Id(element=family_types)
change_family_type = Custom[Change Family Type](element=flatten, typeId=id)  # package archi-lab.net; Changes family type of a family by passing in an Element and type id of the type we want to change it to.
code_block_2 = CodeBlock { "Šířka"; "Výška"; }
ʳʰʸᵗʰᵐ_elements = Rhythm.Revit.Elements.Elements.GetParameterValueByNameTypeOrInstance(element=flatten, parameterName=code_block_2.out0)
setParameterByName = Element.SetParameterByName(element=change_family_type, parameterName=code_block_2.out0, value=ʳʰʸᵗʰᵐ_elements)
ʳʰʸᵗʰᵐ_elements_2 = Rhythm.Revit.Elements.Elements.GetParameterValueByNameTypeOrInstance(element=flatten, parameterName=code_block_2.out1)
setParameterByName_2 = Element.SetParameterByName(element=change_family_type, parameterName=code_block_2.out1, value=ʳʰʸᵗʰᵐ_elements_2)
