# Dynamo graph CREATE APARTMENT VIEWS.dyn (Dynamo 2.16.2.5624)
# packages: archi-lab.net 2023.213.1722, Rhythm 2023.2.2, WombatDynamo 2.3.4, Genius Loci 2023.2.21, Modelical 2023.6.30

# group: Get rooms
element_classes = ElementTypes("Room")
all_elements_of_class = ElementsOfType(element_class=element_classes)
code_block = CodeBlock { "Oddělení"; }
getParameterValueByName = Element.GetParameterValueByName(element=all_elements_of_class, parameterName=code_block)
code_block_2 = CodeBlock { "Test"; }
eq = getParameterValueByName == code_block_2
filterByBoolMask = List.FilterByBoolMask(list=all_elements_of_class, mask=eq)

# group: Room boundaries
spatial_element_boundary = SpatialElementBoundaryLocationUI("Center")  # "Spatial Element Boundary Locations"
boundaries = archilab.Revit.Elements.Room.Boundaries(room=filterByBoolMask.in, boundaryLocation=spatial_element_boundary)
byJoinedCurves = PolyCurve.ByJoinedCurves(curves=boundaries.Curves)
byPatch = Surface.ByPatch(closedCurve=byJoinedCurves)
flatten = List.Flatten(list=byPatch)
byUnion = Surface.ByUnion(surfaces=flatten)
perimeterCurves = Surface.PerimeterCurves(surface=byUnion)

# group: Boundaries offset
byJoinedCurves_2 = PolyCurve.ByJoinedCurves(curves=perimeterCurves)
code_block_3 = CodeBlock { 100; }
offsetMany = Curve.OffsetMany(curve=byJoinedCurves_2, signedDistance=code_block_3)
curves = PolyCurve.Curves(polyCurve=offsetMany)
code_block_4 = CodeBlock { 100000; }
offsetMany_2 = Curve.OffsetMany(curve=byJoinedCurves_2, signedDistance=code_block_4)
curves_2 = PolyCurve.Curves(polyCurve=offsetMany_2)
list_create = List.Create(item0=curves, item1=curves_2)

# group: Create view
code_block_5 = CodeBlock { "Chosen level"; }
byLevelAndType = archilab.Revit.Views.FloorPlanViews.ByLevelAndType(level=code_block_5)
code_block_6 = CodeBlock { "XYZ"; }
applyViewTemplate = Custom[View.ApplyViewTemplate](views=byLevelAndType, tempName=code_block_6)  # package Modelical; This node applies a view template (selected by name) to the selected view.
code_block_7 = CodeBlock { "Name"; }
setName = archilab.Revit.Views.Views.SetName(view=applyViewTemplate.views, name=code_block_7)
boolean = BoolSelector(true)
setCropBoxVisible = View.SetCropBoxVisible(view=setName, isVisible=boolean)
setCropBoxActive = View.SetCropBoxActive(view=setCropBoxVisible, isActive=boolean)
setCropBox = archilab.Revit.Views.Views.SetCropBox(view=setCropBoxActive, boundingBox=list_create)

# group: Plane for intersection
code_block_8 = CodeBlock { "Podlaží"; }
getParameterValueByName_2 = Element.GetParameterValueByName(element=filterByBoolMask.in, parameterName=code_block_8)
byName = WombatDynamo.Level.ByName(name=getParameterValueByName_2)
uniqueItems = List.UniqueItems(list=byName)
level_plane = Custom[Level Plane](level=uniqueItems)  # package Genius Loci; Constructs a Plane from a level.
code_block_9 = CodeBlock { 0; }
offset = Plane.Offset(plane=level_plane, dist=code_block_9)

# group: Bounding elements intersection
geometry = Element.Geometry(element=boundaries.Elements)
flatten_2 = List.Flatten(list=geometry)
clear_list = Custom[Clear List](input=flatten_2)  # package archi-lab.net; This node will remove all Null and Empty Lists from any list.
byUnion_2 = Solid.ByUnion(solids=clear_list)
intersect = Geometry.Intersect(geometry=offset, other=byUnion_2)

byUnion_3 = Surface.ByUnion(surfaces=intersect)
list_create_2 = List.Create(item0=byUnion_3, item1=byUnion)
flatten_3 = List.Flatten(list=list_create_2)
byUnion_4 = Surface.ByUnion(surfaces=flatten_3)
perimeterCurves_2 = Surface.PerimeterCurves(surface=byUnion_4)
group_curves = Custom[Group Curves](curves=perimeterCurves_2)  # package archi-lab.net; This node will take any input of flat list of curves and group them into sublists containing "joinable" curves that is continous curves. They might form closed curves or open curves. Use PolyCurve.ByJoinedCurves to convert output groups of curves into single PolyCurves
code_block_10 = CodeBlock { 0; }
getItemAtIndex = List.GetItemAtIndex(list=group_curves, index=code_block_10)
byJoinedCurves_3 = PolyCurve.ByJoinedCurves(curves=getItemAtIndex)
curves_3 = PolyCurve.Curves(polyCurve=byJoinedCurves_3)
code_block_11 = CodeBlock { 800; }
offsetMany_3 = Curve.OffsetMany(curve=byJoinedCurves_3, signedDistance=code_block_11)
curves_4 = PolyCurve.Curves(polyCurve=offsetMany_3)
list_create_3 = List.Create(item0=curves_3, item1=curves_4)

# group: Filled region
code_block_12 = CodeBlock { "Vyplněná oblast 1"; }
byName_2 = FilledRegionType.ByName(name=code_block_12)
ʳʰʸᵗʰᵐ_filledregions = Rhythm.Revit.Elements.FilledRegions.ByMultipleLoops(filledRegionType=byName_2, view=setCropBox, curvesToUse=list_create)  # frozen
ʳʰʸᵗʰᵐ_filledregions_2 = Rhythm.Revit.Elements.FilledRegions.ByMultipleLoops(filledRegionType=byName_2, curvesToUse=list_create_3)  # frozen; unwired: view
