# Dynamo graph CREATE ROOM VIEWS.dyn (Dynamo 3.2.2.5494)
# packages: Modelical 2023.6.30, archi-lab.net 2023.213.1722, archi-lab.net 2025.300.1225, Crumple 2024.4.3

# group: Get rooms
element_classes = ElementTypes("Room")
all_elements_of_class = ElementsOfType(element_class=element_classes)
code_block = CodeBlock { "Oddělení"; }
getParameterValueByName = Element.GetParameterValueByName(element=all_elements_of_class, parameterName=code_block)
oddělení = StringInput("Blok A")  # graph input
eq = getParameterValueByName == oddělení
filterByBoolMask = List.FilterByBoolMask(list=all_elements_of_class, mask=eq)
code_block_2 = CodeBlock { "Podlaží"; }
getParameterValueByName_2 = Element.GetParameterValueByName(element=filterByBoolMask.in, parameterName=code_block_2)
podlaží = StringInput("1NP")  # graph input
eq_2 = getParameterValueByName_2 == podlaží
filterByBoolMask_2 = List.FilterByBoolMask(list=filterByBoolMask.in, mask=eq_2)

# group: Room boundaries
centerBoundary = Room.CenterBoundary(room=filterByBoolMask_2.in)
byJoinedCurves = PolyCurve.ByJoinedCurves(curves=centerBoundary)
polycurve_greatestarea = Custom[© Polycurve.GreatestArea](polycurves=byJoinedCurves@L2)  # package Crumple; From a list of polycurves, return the one with the largest area only. Can be useful for determining the outer-most boundary in a room with internalised holes.
byPatch = Surface.ByPatch(closedCurve=polycurve_greatestarea.greatest)
flatten = List.Flatten(list=byPatch)
perimeterCurves = Surface.PerimeterCurves(surface=flatten)
byJoinedCurves_2 = PolyCurve.ByJoinedCurves(curves=perimeterCurves)
odsazení_ořezání_od_hranice = DoubleInput(500)  # "Odsazení ořezání od hranice místnosti"; graph input
offsetMany = Curve.OffsetMany(curve=byJoinedCurves_2, signedDistance=odsazení_ořezání_od_hranice)
boundingBox = Geometry.BoundingBox(geometry=offsetMany)

# group: Create view
výchozí_pohled_pro_duplikování = Views("1.NP – studie")  # graph input
count = List.Count(list=filterByBoolMask_2.in)
cycle = List.Cycle(list=výchozí_pohled_pro_duplikování, amount=count)
view_duplicate_options = ViewDuplicateOptions("AsDependent")
duplicateView = View.DuplicateView(view=cycle, viewDuplicateOption=view_duplicate_options, lacing=Longest)
šablona_pohledu = ViewTemplatesUi("#Půdorys studie")  # graph input
name = ElementType.Name(elementType=šablona_pohledu)
applyViewTemplate = Custom[View.ApplyViewTemplate](views=duplicateView, tempName=name)  # package Modelical; This node applies a view template (selected by name) to the selected view.
number = Room.Number(room=filterByBoolMask_2.in)
name_2 = Room.Name(room=filterByBoolMask_2.in)
code_block_3 = CodeBlock(x=number, y=name_2) { x + " - " + y; }
setName = archilab.Revit.Views.Views.SetName(view=duplicateView, name=code_block_3)
boolean = BoolSelector(true)
setCropBoxVisible = View.SetCropBoxVisible(view=setName, isVisible=boolean)
setCropBoxActive = View.SetCropBoxActive(view=setCropBoxVisible, isActive=boolean)
setCropBox = archilab.Revit.Views.Views.SetCropBox(view=setCropBoxActive, boundingBox=boundingBox)

count_2 = List.Count(list=setCropBox)
code_block_4 = CodeBlock(x=count_2) { "Vytvořeno " + x + " pohledů na místnosti"; }
watch = Watch(code_block_4)  # graph output
