# Dynamo graph CREATE TILES.dyn (Dynamo 2.16.2.5624)
# packages: spring nodes 210.1.1

code_block = CodeBlock { 5000; 0; -5000; }
byCoordinates = Point.ByCoordinates(x=code_block.out0, y=code_block.out0, z=code_block.out1)
byCoordinates_2 = Point.ByCoordinates(x=code_block.out0, y=code_block.out2, z=code_block.out1)
byStartPointEndPoint = Line.ByStartPointEndPoint(startPoint=byCoordinates, endPoint=byCoordinates_2)
byCoordinates_3 = Point.ByCoordinates(x=code_block.out2, y=code_block.out0, z=code_block.out1)
byStartPointEndPoint_2 = Line.ByStartPointEndPoint(startPoint=byCoordinates_3, endPoint=byCoordinates)
byCoordinates_4 = Point.ByCoordinates(x=code_block.out2, y=code_block.out2, z=code_block.out1)
byStartPointEndPoint_3 = Line.ByStartPointEndPoint(startPoint=byCoordinates_4, endPoint=byCoordinates_2)
byStartPointEndPoint_4 = Line.ByStartPointEndPoint(startPoint=byCoordinates_4, endPoint=byCoordinates_3)
list_create = List.Create(item0=byStartPointEndPoint, item1=byStartPointEndPoint_2, item2=byStartPointEndPoint_3, item3=byStartPointEndPoint_4)
byJoinedCurves = PolyCurve.ByJoinedCurves(curves=list_create)
code_block_2 = CodeBlock { 500; }
code_block_3 = CodeBlock { 0; }
byCoordinates_5 = Point.ByCoordinates(x=code_block_3, y=code_block_3, z=code_block_3)
ꟿ_curve_offset = Custom[ꟿ Curve.Offset+](curve=byJoinedCurves, distance=code_block_2, point=byCoordinates_5)  # package spring nodes; Offsets a curve towards the specified point
curves = PolyCurve.Curves(polyCurve=ꟿ_curve_offset)
code_block_4 = CodeBlock { 1000; }
levels = Levels("1NP")
wall_types = WallTypes("Stěna 1")
byCurveAndHeight = Wall.ByCurveAndHeight(curve=curves, height=code_block_4, level=levels, wallType=wall_types)
geometry = Element.Geometry(element=byCurveAndHeight)
