# Dynamo graph CUT DOORS INTO FLOORS,by geometry.dyn (Dynamo 2.16.1.2727)
# packages: Modelical 2023.6.30, Genius Loci 2023.2.21

select_model_element = DSModelElementSelection()  # 1 picked in the model
finishBoundary = Room.FinishBoundary(room=select_model_element)
centerLocation = Custom[Room.CenterLocation](rooms=select_model_element)  # package Modelical; This node moves the room location of the selected rooms to the closest possible point to geometrical center.
select_model_elements = DSModelElementsSelection()  # 4 picked in the model
inserts = Custom[Wall.Inserts](walls=select_model_elements)  # package Modelical; This node gets all the inserts in a wall.
solids = Element.Solids(element=inserts.walls)
byUnion = Solid.ByUnion(solids=solids)
byGeometry = BoundingBox.ByGeometry(geom=byUnion)
minPoint = BoundingBox.MinPoint(boundingBox=byGeometry)
maxPoint = BoundingBox.MaxPoint(boundingBox=byGeometry)
byCorners = Cuboid.ByCorners(lowPoint=minPoint, highPoint=maxPoint)
code_block = CodeBlock { "Dolní vazba"; }
getParameterValueByName = Element.GetParameterValueByName(element=select_model_elements, parameterName=code_block)
level_plane = Custom[Level Plane](level=getParameterValueByName)  # package Genius Loci; Constructs a Plane from a level.
intersect = Geometry.Intersect(geometry=byCorners, other=level_plane)
flatten = List.Flatten(list=intersect)
byUnion_2 = Surface.ByUnion(surfaces=flatten)
code_block_2 = CodeBlock { 500; }
thicken = Surface.Thicken(surface=byUnion_2, thickness=code_block_2)
intersect_2 = Geometry.Intersect(geometry=solids, other=level_plane)
flatten_2 = List.Flatten(list=intersect_2)
thicken_2 = Surface.Thicken(surface=flatten_2, thickness=code_block_2)
byUnion_3 = Solid.ByUnion(solids=thicken_2)
difference = Solid.Difference(solid=thicken, other=byUnion_3)
code_block_3 = CodeBlock { 0; }
getItemAtIndex = List.GetItemAtIndex(list=getParameterValueByName, index=code_block_3)
level_plane_2 = Custom[Level Plane](level=getItemAtIndex)
intersect_3 = Geometry.Intersect(geometry=difference, other=level_plane_2)
thicken_3 = Surface.Thicken(surface=intersect_3)
