# Dynamo graph CUT DOORS INTO FLOORS.dyn (Dynamo 2.16.1.2727)
# packages: Clockwork for Dynamo 2.x 2.4.0, spring nodes 210.1.1, Genius Loci 2023.2.21, Data-Shapes 2022.2.106

code_block = CodeBlock { "Rozšíření podlahy pod dveřmi"; "Spustit"; "Zrušit"; }
code_block_2 = CodeBlock { "Výběr dveří"; "Výběr podlahy"; "Vybrat"; }
categories = Categories("OST_Doors")
selectmodelelements_data = Custom[SelectModelElements Data](InputName=code_block_2.out0, ButtonText=code_block_2.out2, CategoryFilter=categories)  # package Data-Shapes; Creates a Revit element selection input for UI.MultipleInputForm++ . Check out www.data-shapes.net for more infos!
categories_2 = Categories("OST_Floors")
boolean = BoolSelector(true)
selectmodelelements_data_2 = Custom[SelectModelElements Data](InputName=code_block_2.out1, ButtonText=code_block_2.out2, CategoryFilter=categories_2, SelectSingleElement=boolean)
list_create = List.Create(item0=selectmodelelements_data, item1=selectmodelelements_data_2)
boolean_2 = BoolSelector(true)
multipleinputform = Custom[MultipleInputForm ++](Description_optional=code_block.out0, ButtonText_optional=code_block.out1, Inputs=list_create, Toggle=boolean_2, CancelButtonText_optional=code_block.out2)  # package Data-Shapes; Create a form with multiple inputs. see www.data-shapes.net for tutorials and infos!
code_block_3 = CodeBlock { 1; }
getItemAtIndex = List.GetItemAtIndex(list=multipleinputform.User_Inputs, index=code_block_3)
ꟿ_collect_elementsketch = Custom[ꟿ Collect.ElementSketch](element=getItemAtIndex)  # package spring nodes; Get the actual sketch lines of a sketch based element (floor, ceiling, modified wall, etc.) . You can optionally fetch the matching model curves, however this might prove comptationally heavy on larger data sets. Does not work with elements from linked files.
byJoinedCurves = PolyCurve.ByJoinedCurves(curves=ꟿ_collect_elementsketch.curves)
byPatch = Surface.ByPatch(closedCurve=byJoinedCurves)
code_block_4 = CodeBlock { 0; }
getItemAtIndex_2 = List.GetItemAtIndex(list=multipleinputform.User_Inputs, index=code_block_4)
location = Custom[Element.Location+](element=getItemAtIndex_2)  # package Clockwork for Dynamo 2.x; Returns the location of an element as point, curve or curve loop, along with some booleans to help filtering the results. Unlike the OOTB Element.GetLocation node, it also retunrs sketch lines of sketch-based elements like floor slabs as well as the element's rotation property.
closestPointTo = Geometry.ClosestPointTo(geometry=byPatch, other=location.points, lacing=Longest)
byStartPointEndPoint = Line.ByStartPointEndPoint(startPoint=closestPointTo, endPoint=location.points)
code_block_5 = CodeBlock { 0.5; }
normalAtParameter = Curve.NormalAtParameter(curve=byStartPointEndPoint, param=code_block_5)
ZAxis = Vector.ZAxis()
code_block_6 = CodeBlock { 90; }
rotate = Vector.Rotate(vector=normalAtParameter, axis=ZAxis, degrees=code_block_6)
getHost = FamilyInstance.GetHost(familyInstance=getItemAtIndex_2)
elementType = Custom[Element.ElementType+](element=getHost)  # package Clockwork for Dynamo 2.x; Gets the family type of a given element (if applicable). Unlike the OOTB node, it also works for elements in linked models.
code_block_7 = CodeBlock { "Šířka"; "Hrubá šířka"; }
getParameterValueByName = Element.GetParameterValueByName(element=elementType, parameterName=code_block_7.out0)
code_block_8 = CodeBlock(w=getParameterValueByName) { w * -0.5; w; }
translate = Geometry.Translate(geometry=closestPointTo, direction=rotate, distance=code_block_8.w)
byStartPointEndPoint_2 = Line.ByStartPointEndPoint(startPoint=translate, endPoint=closestPointTo)
code_block_9 = CodeBlock { 0.5; }
normalAtParameter_2 = Curve.NormalAtParameter(curve=byStartPointEndPoint, param=code_block_9)
getParameterValueByName_2 = Element.GetParameterValueByName(element=getItemAtIndex_2, parameterName=code_block_7.out1)
code_block_10 = CodeBlock(w=getParameterValueByName_2) { w * -0.5; w; }
translate_2 = Geometry.Translate(geometry=byStartPointEndPoint_2, direction=normalAtParameter_2, distance=code_block_10.out0)
extrude = Curve.Extrude(curve=translate_2, direction=normalAtParameter_2, distance=code_block_10.w)
list_create_2 = List.Create(item0=extrude, item1=byPatch)
flatten = List.Flatten(list=list_create_2)
byUnion = Surface.ByUnion(surfaces=flatten)
perimeterCurves = Surface.PerimeterCurves(surface=byUnion)
elementType_2 = Custom[Element.ElementType+](element=getItemAtIndex)
element_level = Custom[Element Level](element=getItemAtIndex)  # package Genius Loci; Gets an element's level. Based on a Clockwork's node
byOutlineTypeAndLevel = Floor.ByOutlineTypeAndLevel(outlineCurves=perimeterCurves, floorType=elementType_2, level=element_level)
isNull = Object.IsNull(object=byOutlineTypeAndLevel)
filterByBoolMask = List.FilterByBoolMask(list=getItemAtIndex, mask=isNull)
delete_elements = Custom[Delete Elements](element=filterByBoolMask.out)  # package Genius Loci; Delete the input list of elements from the given Revit document. The node returns the number of successfully deleted elements and their Ids as a string. Based on a Springs node
