# Dynamo graph DAYLIGHT FACTOR.dyn (Dynamo 2.16.2.5624)
# packages: Crumple 2022.5.27, DynaMEP 2.0.1, Genius Loci 2023.2.21, WombatDynamo 2.3.4

active = RevitModel.Views.Active()
views_setsunsettings = Custom[© Views.SetSunSettings](views=active)  # package Crumple; Given a list of views, apply a datetime and shadow intensity setting to their sun settings (still). You will need to update the shadows on/off setting manually or via a view template.; unwired: datetimes
current = SunSettings()  # "SunSettings.Current"
sunDirection = SunSettings.SunDirection(sunSettings=current)
azimuth = SunSettings.Azimuth(sunSettings=current)
select_model_element = DSModelElementSelection()  # 1 picked in the model
geometry = Element.Geometry(element=select_model_element)
code_block = CodeBlock { "Podlaží"; }
getParameterValueByName = Element.GetParameterValueByName(element=select_model_element, parameterName=code_block)
byName = WombatDynamo.Level.ByName(name=getParameterValueByName)
level_plane = Custom[Level Plane](level=byName)  # package Genius Loci; Constructs a Plane from a level.
code_block_2 = CodeBlock { 850; }
offset = Plane.Offset(plane=level_plane, dist=code_block_2)
intersect = Geometry.Intersect(geometry=geometry, other=offset)
byGeometry = BoundingBox.ByGeometry(geom=intersect)
minPoint = BoundingBox.MinPoint(boundingBox=byGeometry)
X = Point.X(point=minPoint)
maxPoint = BoundingBox.MaxPoint(boundingBox=byGeometry)
X_2 = Point.X(point=maxPoint)
sub = X - X_2
abs = Math.Abs(number=sub)
Y = Point.Y(point=minPoint)
Y_2 = Point.Y(point=maxPoint)
sub_2 = Y - Y_2
abs_2 = Math.Abs(number=sub_2)
max = Math.Max(value1=abs, value2=abs_2)
code_block_3 = CodeBlock { 1000; }
div = max / code_block_3
code_block_4 = CodeBlock(d=div) { p = 0.5 * DSCore.Math.Pow(5, DSCore.Math.Log10(d)); }
code_block_5 = CodeBlock(b=abs, c=code_block_4) { a = (b/1000)/c; }
div_2 = abs / code_block_5
range = Range(start=X, end=X_2, step=div_2)
flatten = List.Flatten(list=range)
code_block_6 = CodeBlock(b=abs_2, c=code_block_4) { a = (b/1000)/c; }
div_3 = abs_2 / code_block_6
range_2 = Range(start=Y, end=Y_2, step=div_3)
flatten_2 = List.Flatten(list=range_2)
Z = Point.Z(point=minPoint)
byCoordinates = Point.ByCoordinates(x=flatten, y=flatten_2, z=Z, lacing=CrossProduct)
flatten_3 = List.Flatten(list=byCoordinates)
code_block_7 = CodeBlock { 100; }
byCenterPointRadius = Sphere.ByCenterPointRadius(centerPoint=flatten_3, radius=code_block_7)
perimeterCurves = Surface.PerimeterCurves(surface=intersect)
byJoinedCurves = PolyCurve.ByJoinedCurves(curves=perimeterCurves)
code_block_8 = CodeBlock { 500; }
smartOffset = WombatDynamo.Curve.SmartOffset(curve=byJoinedCurves, offsetDist=code_block_8)
byPatch = Surface.ByPatch(closedCurve=smartOffset)
flatten_4 = List.Flatten(list=byPatch)
doesIntersect = Geometry.DoesIntersect(geometry=flatten_4, other=byCenterPointRadius, lacing=Longest)
filterByBoolMask = List.FilterByBoolMask(list=byCenterPointRadius, mask=doesIntersect)
flatten_5 = List.Flatten(list=filterByBoolMask.in)
