# Dynamo graph DIRECTSHAPE FROM TOPO.dyn (Dynamo 2.19.3.6394)

select_model_element = DSModelElementSelection()  # 1 picked in the model
geometry = Element.Geometry(element=select_model_element)
categories = Categories("OST_Topography")
code_block = CodeBlock { "test"; }
byName = Material.ByName(name=code_block)
code_block_2 = CodeBlock { "Výkop"; }
byGeometry = DirectShape.ByGeometry(geometry=geometry, category=categories, material=byName, name=code_block_2)  # frozen
