# Dynamo graph DOOR HANDLES.dyn (Dynamo 2.16.2.5624)
# packages: archi-lab.net 2023.213.1722

# group: Door collector
categories = Categories("OST_Doors")
all_elements_of_category = ElementsOfCategory(Category=categories)
familyType = Custom[FamilyInstance.FamilyType](familyInstance=all_elements_of_category)  # package archi-lab.net; This node will return a Family Type of a given Family Instance. If no Family Type can be assigned to a Family then it will return Null.
code_block = CodeBlock { "Štítek"; }
getParameterValueByName = Element.GetParameterValueByName(element=familyType, parameterName=code_block)
code_block_2 = CodeBlock { "#Dveře"; }
eq = getParameterValueByName == code_block_2
filterByBoolMask = List.FilterByBoolMask(list=all_elements_of_category, mask=eq)

# group: Jednokřídlé dveře
familyType_2 = Custom[FamilyInstance.FamilyType](familyInstance=filterByBoolMask.in)
family = FamilyType.Family(familyType=familyType_2)
name = Family.Name(family=family)
code_block_3 = CodeBlock { "#Jednokřídlé dveře"; }
eq_2 = name == code_block_3
filterByBoolMask_2 = List.FilterByBoolMask(list=filterByBoolMask.in, mask=eq_2)
code_block_4 = CodeBlock { ["Klika vnější","Madlo vnější"]; }
getParameterValueByName_2 = Element.GetParameterValueByName(element=filterByBoolMask_2.in@L1, parameterName=code_block_4)
code_block_5 = CodeBlock { ["Klika vnitřní","Madlo vnitřní","Paniková hrazda"]; }
getParameterValueByName_3 = Element.GetParameterValueByName(element=filterByBoolMask_2.in@L1, parameterName=code_block_5)
getParameterValueByName_4 = Element.GetParameterValueByName(element=filterByBoolMask_2.in@L1, parameterName=code_block_4)

# group: Vnitřní kování
code_block_6 = CodeBlock { "Štítek"; }
getParameterValueByName_5 = Element.GetParameterValueByName(parameterName=code_block_6)  # unwired: element
code_block_7 = CodeBlock { 0; 1; 2; }
getItemAtIndex = List.GetItemAtIndex(list=getParameterValueByName_5@L2, index=code_block_7.out0)
getItemAtIndex_2 = List.GetItemAtIndex(list=getParameterValueByName_5@L2, index=code_block_7.out1)
add = getItemAtIndex + getItemAtIndex_2
getItemAtIndex_3 = List.GetItemAtIndex(list=getParameterValueByName_5@L2, index=code_block_7.out2)
add_2 = add + getItemAtIndex_3
code_block_8 = CodeBlock { "#"; }
code_block_9 = CodeBlock { ""; }
replace = String.Replace(string=add_2, searchFor=code_block_8, replaceWith=code_block_9)
code_block_10 = CodeBlock { "/"; }
add_3 = replace + code_block_10

# group: Vnější kování hl. křídla
getParameterValueByName_6 = Element.GetParameterValueByName()  # unwired: element, parameterName
code_block_11 = CodeBlock { 0; 1; }
getItemAtIndex_4 = List.GetItemAtIndex(list=getParameterValueByName_6@L2, index=code_block_11.out0)
getItemAtIndex_5 = List.GetItemAtIndex(list=getParameterValueByName_6@L2, index=code_block_11.out1)
add_4 = getItemAtIndex_4 + getItemAtIndex_5
code_block_12 = CodeBlock { "#"; }
code_block_13 = CodeBlock { ""; }
replace_2 = String.Replace(string=add_4, searchFor=code_block_12, replaceWith=code_block_13)

# group: Vnitřní kování hl. křídla
code_block_14 = CodeBlock { "Štítek"; }
getParameterValueByName_7 = Element.GetParameterValueByName(parameterName=code_block_14)  # unwired: element
code_block_15 = CodeBlock { 0; 1; 2; }
getItemAtIndex_6 = List.GetItemAtIndex(list=getParameterValueByName_7@L2, index=code_block_15.out0)
getItemAtIndex_7 = List.GetItemAtIndex(list=getParameterValueByName_7@L2, index=code_block_15.out1)
add_5 = getItemAtIndex_6 + getItemAtIndex_7
getItemAtIndex_8 = List.GetItemAtIndex(list=getParameterValueByName_7@L2, index=code_block_15.out2)
add_6 = add_5 + getItemAtIndex_8
code_block_16 = CodeBlock { "#"; }
code_block_17 = CodeBlock { ""; }
replace_3 = String.Replace(string=add_6, searchFor=code_block_16, replaceWith=code_block_17)
code_block_18 = CodeBlock { "/"; }
add_7 = replace_3 + code_block_18

# group: Dvoukřídlé dveře
familyType_3 = Custom[FamilyInstance.FamilyType](familyInstance=filterByBoolMask.in)
family_2 = FamilyType.Family(familyType=familyType_3)
name_2 = Family.Name(family=family_2)
code_block_19 = CodeBlock { "#Dvoukřídlé dveře"; }
eq_3 = name_2 == code_block_19
filterByBoolMask_3 = List.FilterByBoolMask(list=filterByBoolMask.in, mask=eq_3)
code_block_20 = CodeBlock { ["Klika vnější hl. křídla","Madlo vnější hl. křídla"]; }
getParameterValueByName_8 = Element.GetParameterValueByName(element=filterByBoolMask_3.in@L1, parameterName=code_block_20)
code_block_21 = CodeBlock { ["Klika vnitřní hl. křídla","Madlo vnitřní hl. křídla","Paniková hrazda hl. křídla"]; }
getParameterValueByName_9 = Element.GetParameterValueByName(element=filterByBoolMask_3.in@L1, parameterName=code_block_21)
getParameterValueByName_10 = Element.GetParameterValueByName(element=filterByBoolMask_3.in@L1, parameterName=code_block_20)
code_block_22 = CodeBlock { ["Klika vnitřní pasivního křídla","Madlo vnitřní pasivního křídla","Paniková hrazda pasivního křídla"]; }
getParameterValueByName_11 = Element.GetParameterValueByName(element=filterByBoolMask_3.in@L1, parameterName=code_block_22)
code_block_23 = CodeBlock { ["Klika vnější pasivního křídla","Madlo vnější pasivního křídla"]; }
getParameterValueByName_12 = Element.GetParameterValueByName(element=filterByBoolMask_3.in@L1, parameterName=code_block_23)

# group: Vnitřní kování pasivního křídla
code_block_24 = CodeBlock { "Štítek"; }
getParameterValueByName_13 = Element.GetParameterValueByName(parameterName=code_block_24)  # unwired: element
code_block_25 = CodeBlock { 0; 1; 2; }
getItemAtIndex_9 = List.GetItemAtIndex(list=getParameterValueByName_13@L2, index=code_block_25.out0)
getItemAtIndex_10 = List.GetItemAtIndex(list=getParameterValueByName_13@L2, index=code_block_25.out1)
add_8 = getItemAtIndex_9 + getItemAtIndex_10
getItemAtIndex_11 = List.GetItemAtIndex(list=getParameterValueByName_13@L2, index=code_block_25.out2)
add_9 = add_8 + getItemAtIndex_11
code_block_26 = CodeBlock { "#"; }
code_block_27 = CodeBlock { ""; }
replace_4 = String.Replace(string=add_9, searchFor=code_block_26, replaceWith=code_block_27)
code_block_28 = CodeBlock { "/"; }
add_10 = replace_4 + code_block_28

# group: Vnější kování pasivního křídla
getParameterValueByName_14 = Element.GetParameterValueByName()  # unwired: element, parameterName
code_block_29 = CodeBlock { 0; 1; }
getItemAtIndex_12 = List.GetItemAtIndex(list=getParameterValueByName_14@L2, index=code_block_29.out0)
getItemAtIndex_13 = List.GetItemAtIndex(list=getParameterValueByName_14@L2, index=code_block_29.out1)
add_11 = getItemAtIndex_12 + getItemAtIndex_13
code_block_30 = CodeBlock { "#"; }
code_block_31 = CodeBlock { ""; }
replace_5 = String.Replace(string=add_11, searchFor=code_block_30, replaceWith=code_block_31)

code_block_32 = CodeBlock { "Komentáře"; }

# group: Vnitřní kování hl. křídla
code_block_33 = CodeBlock { "Štítek"; }
getParameterValueByName_15 = Element.GetParameterValueByName(element=getParameterValueByName_9, parameterName=code_block_33)
code_block_34 = CodeBlock { 0; 1; 2; }
getItemAtIndex_14 = List.GetItemAtIndex(list=getParameterValueByName_15@L2, index=code_block_34.out0)
getItemAtIndex_15 = List.GetItemAtIndex(list=getParameterValueByName_15@L2, index=code_block_34.out1)
code_block_35 = CodeBlock { ""; }
eq_4 = getItemAtIndex_15 == code_block_35
eq_5 = getItemAtIndex_14 == code_block_35
code_block_36 = CodeBlock { ", "; }
if_ = RefactoredIf(test=eq_5, true=code_block_35, false=code_block_36)
add_12 = if_ + getItemAtIndex_15
if_2 = RefactoredIf(test=eq_4@L1, true=getItemAtIndex_15@L1, false=add_12@L1)
add_13 = getItemAtIndex_14 + if_2
eq_6 = getItemAtIndex_15 == code_block_35
getItemAtIndex_16 = List.GetItemAtIndex(list=getParameterValueByName_15@L2, index=code_block_34.out2)
eq_7 = getItemAtIndex_15 == code_block_35
code_block_37 = CodeBlock { ", "; }
if_3 = RefactoredIf(test=eq_7, true=code_block_35, false=code_block_37)
add_14 = if_3 + getItemAtIndex_16
if_4 = RefactoredIf(test=eq_6@L1, true=getItemAtIndex_16@L1, false=add_14@L1)
add_15 = add_13 + if_4
code_block_38 = CodeBlock { "#"; }
code_block_39 = CodeBlock { ""; }
replace_6 = String.Replace(string=add_15, searchFor=code_block_38, replaceWith=code_block_39)
code_block_40 = CodeBlock { " / "; }
add_16 = replace_6 + code_block_40

# group: Vnější kování hl. křídla
getParameterValueByName_16 = Element.GetParameterValueByName(element=getParameterValueByName_10, parameterName=code_block_33)
code_block_41 = CodeBlock { 0; 1; }
getItemAtIndex_17 = List.GetItemAtIndex(list=getParameterValueByName_16@L2, index=code_block_41.out0)
getItemAtIndex_18 = List.GetItemAtIndex(list=getParameterValueByName_16@L2, index=code_block_41.out1)
code_block_42 = CodeBlock { ""; }
eq_8 = getItemAtIndex_18 == code_block_42
eq_9 = getItemAtIndex_17 == code_block_42
code_block_43 = CodeBlock { ", "; }
if_5 = RefactoredIf(test=eq_9, true=getItemAtIndex_17, false=code_block_43)
add_17 = if_5 + getItemAtIndex_18
if_6 = RefactoredIf(test=eq_8@L1, true=getItemAtIndex_18@L1, false=add_17@L1)
add_18 = getItemAtIndex_17 + if_6
code_block_44 = CodeBlock { "#"; }
code_block_45 = CodeBlock { ""; }
replace_7 = String.Replace(string=add_18, searchFor=code_block_44, replaceWith=code_block_45)

add_19 = add_16 + replace_7
code_block_46 = CodeBlock { " + "; }
add_20 = add_19 + code_block_46

# group: Vnitřní kování pasivního křídla
code_block_47 = CodeBlock { "Štítek"; }
getParameterValueByName_17 = Element.GetParameterValueByName(element=getParameterValueByName_11, parameterName=code_block_47)
code_block_48 = CodeBlock { 0; 1; 2; }
getItemAtIndex_19 = List.GetItemAtIndex(list=getParameterValueByName_17@L2, index=code_block_48.out0)
getItemAtIndex_20 = List.GetItemAtIndex(list=getParameterValueByName_17@L2, index=code_block_48.out1)
code_block_49 = CodeBlock { ""; }
eq_10 = getItemAtIndex_20 == code_block_49
eq_11 = getItemAtIndex_19 == code_block_49
code_block_50 = CodeBlock { ", "; }
if_7 = RefactoredIf(test=eq_11, true=code_block_49, false=code_block_50)
add_21 = if_7 + getItemAtIndex_20
if_8 = RefactoredIf(test=eq_10@L1, true=getItemAtIndex_20@L1, false=add_21@L1)
add_22 = getItemAtIndex_19 + if_8
eq_12 = getItemAtIndex_20 == code_block_49
getItemAtIndex_21 = List.GetItemAtIndex(list=getParameterValueByName_17@L2, index=code_block_48.out2)
eq_13 = getItemAtIndex_20 == code_block_49
code_block_51 = CodeBlock { ", "; }
if_9 = RefactoredIf(test=eq_13, true=code_block_49, false=code_block_51)
add_23 = if_9 + getItemAtIndex_21
if_10 = RefactoredIf(test=eq_12@L1, true=getItemAtIndex_21@L1, false=add_23@L1)
add_24 = add_22 + if_10
code_block_52 = CodeBlock { "#"; }
code_block_53 = CodeBlock { ""; }
replace_8 = String.Replace(string=add_24, searchFor=code_block_52, replaceWith=code_block_53)
code_block_54 = CodeBlock { " / "; }
add_25 = replace_8 + code_block_54

# group: Vnější kování pasivního křídla
getParameterValueByName_18 = Element.GetParameterValueByName(element=getParameterValueByName_12, parameterName=code_block_47)
code_block_55 = CodeBlock { 0; 1; }
getItemAtIndex_22 = List.GetItemAtIndex(list=getParameterValueByName_18@L2, index=code_block_55.out0)
getItemAtIndex_23 = List.GetItemAtIndex(list=getParameterValueByName_18@L2, index=code_block_55.out1)
code_block_56 = CodeBlock { ""; }
eq_14 = getItemAtIndex_23 == code_block_56
eq_15 = getItemAtIndex_22 == code_block_56
code_block_57 = CodeBlock { ", "; }
if_11 = RefactoredIf(test=eq_15, true=getItemAtIndex_22, false=code_block_57)
add_26 = if_11 + getItemAtIndex_23
if_12 = RefactoredIf(test=eq_14@L1, true=getItemAtIndex_23@L1, false=add_26@L1)
add_27 = getItemAtIndex_22 + if_12
code_block_58 = CodeBlock { "#"; }
code_block_59 = CodeBlock { ""; }
replace_9 = String.Replace(string=add_27, searchFor=code_block_58, replaceWith=code_block_59)

add_28 = add_25 + replace_9
add_29 = add_20 + add_28
setParameterByName = Element.SetParameterByName(element=filterByBoolMask_3.in, parameterName=code_block_32, value=add_29)

# group: Vnitřní kování
code_block_60 = CodeBlock { "Štítek"; }
getParameterValueByName_19 = Element.GetParameterValueByName(element=getParameterValueByName_3, parameterName=code_block_60)
code_block_61 = CodeBlock { 0; 1; 2; }
getItemAtIndex_24 = List.GetItemAtIndex(list=getParameterValueByName_19@L2, index=code_block_61.out0)
getItemAtIndex_25 = List.GetItemAtIndex(list=getParameterValueByName_19@L2, index=code_block_61.out1)
code_block_62 = CodeBlock { ""; }
eq_16 = getItemAtIndex_25 == code_block_62
eq_17 = getItemAtIndex_24 == code_block_62
code_block_63 = CodeBlock { ", "; }
if_13 = RefactoredIf(test=eq_17, true=code_block_62, false=code_block_63)
add_30 = if_13 + getItemAtIndex_25
if_14 = RefactoredIf(test=eq_16@L1, true=getItemAtIndex_25@L1, false=add_30@L1)
add_31 = getItemAtIndex_24 + if_14
eq_18 = getItemAtIndex_25 == code_block_62
getItemAtIndex_26 = List.GetItemAtIndex(list=getParameterValueByName_19@L2, index=code_block_61.out2)
eq_19 = getItemAtIndex_25 == code_block_62
code_block_64 = CodeBlock { ", "; }
if_15 = RefactoredIf(test=eq_19, true=code_block_62, false=code_block_64)
add_32 = if_15 + getItemAtIndex_26
if_16 = RefactoredIf(test=eq_18@L1, true=getItemAtIndex_26@L1, false=add_32@L1)
add_33 = add_31 + if_16
code_block_65 = CodeBlock { "#"; }
code_block_66 = CodeBlock { ""; }
replace_10 = String.Replace(string=add_33, searchFor=code_block_65, replaceWith=code_block_66)
code_block_67 = CodeBlock { " / "; }
add_34 = replace_10 + code_block_67

# group: Vnější kování
getParameterValueByName_20 = Element.GetParameterValueByName(element=getParameterValueByName_4, parameterName=code_block_60)
code_block_68 = CodeBlock { 0; 1; }
getItemAtIndex_27 = List.GetItemAtIndex(list=getParameterValueByName_20@L2, index=code_block_68.out0)
getItemAtIndex_28 = List.GetItemAtIndex(list=getParameterValueByName_20@L2, index=code_block_68.out1)
code_block_69 = CodeBlock { ""; }
eq_20 = getItemAtIndex_28 == code_block_69
eq_21 = getItemAtIndex_27 == code_block_69
code_block_70 = CodeBlock { ", "; }
if_17 = RefactoredIf(test=eq_21, true=getItemAtIndex_27, false=code_block_70)
add_35 = if_17 + getItemAtIndex_28
if_18 = RefactoredIf(test=eq_20@L1, true=getItemAtIndex_28@L1, false=add_35@L1)
add_36 = getItemAtIndex_27 + if_18
code_block_71 = CodeBlock { "#"; }
code_block_72 = CodeBlock { ""; }
replace_11 = String.Replace(string=add_36, searchFor=code_block_71, replaceWith=code_block_72)

add_37 = add_34 + replace_11
setParameterByName_2 = Element.SetParameterByName(element=filterByBoolMask.in, parameterName=code_block_32, value=add_37)
