# Dynamo graph FLOOR FINISHES BY ROOMS.dyn (Dynamo 2.16.1.2727)
# packages: archi-lab.net 2023.213.1722, Clockwork for Dynamo 2.x 2.4.0, Rhythm 2023.2.2, Data-Shapes 2022.2.106, Crumple 2022.5.27

# group: 1. Výběr všech místností v projektu
categories = Categories("OST_Rooms")
all_elements_of_category = ElementsOfCategory(Category=categories)

# group: 2. Filtr neumístěných místností
location = Room.Location(room=all_elements_of_category)
isNull = Object.IsNull(object=location)
filterByBoolMask = List.FilterByBoolMask(list=all_elements_of_category, mask=isNull)

# group: 3. Filtr místností s vyplněným parametrem povrchová úprava podlahy
room_finish_parameter_name = StringInput("Povrchová úprava podkladu")  # graph input
getParameterValueByName = Element.GetParameterValueByName(element=filterByBoolMask.out, parameterName=room_finish_parameter_name)
isNullOrEmpty = archilab.Core.Strings.IsNullOrEmpty(str=getParameterValueByName)
filterByBoolMask_2 = List.FilterByBoolMask(list=filterByBoolMask.out, mask=isNullOrEmpty)
filterByBoolMask_3 = List.FilterByBoolMask(list=getParameterValueByName, mask=isNullOrEmpty)

# group: 4. Výběr všech typů podlah v projektu
element_classes = ElementTypes("FloorType")
all_elements_of_class = ElementsOfType(element_class=element_classes)

# group: 5. Výběr parametru podlah označení typu
floor_finish_parameter_name = StringInput("Označení typu")  # graph input
getParameterValueByName_2 = Element.GetParameterValueByName(element=all_elements_of_class, parameterName=floor_finish_parameter_name)

# group: 6. Kontrola shody parametru místnosti a podlahy
contains = List.Contains(list=getParameterValueByName_2@L2, item=filterByBoolMask_3.out, lacing=Longest)
filterByBoolMask_4 = List.FilterByBoolMask(list=filterByBoolMask_3.out, mask=contains)

# group: 8. Výběr podlaží všech místností
filterByBoolMask_5 = List.FilterByBoolMask(list=filterByBoolMask_2.out, mask=contains)
code_block = CodeBlock { "Podlaží"; }
getParameterValueByName_3 = Element.GetParameterValueByName(element=filterByBoolMask_5.in, parameterName=code_block)
levels_getbyname = Custom[© Levels.GetByName](name=getParameterValueByName_3)  # package Crumple; Given a list of names, returns the matching levels (if they exist).

# group: 9. Hranice podlahy podle místnosti
finishBoundary = Room.FinishBoundary(room=filterByBoolMask_5.in)

# group: 7. Přiřazení místnosti k povrchové úpravě podlahy
indexOf = List.IndexOf(list=getParameterValueByName_2, element=filterByBoolMask_4.in)
getItemAtIndex = List.GetItemAtIndex(list=all_elements_of_class, index=indexOf)

string_from_object = FromObject(object=levels_getbyname)
code_block_2 = CodeBlock { "Generátor podlah"; }
code_block_3 = CodeBlock { "Zrušit"; "Spustit"; }
code_block_4 = CodeBlock { "Výběr podlaží"; }
element_classes_2 = ElementTypes("Level")
all_elements_of_class_2 = ElementsOfType(element_class=element_classes_2)
treeview_input = Custom[TreeView input](InputName=code_block_4, Data=all_elements_of_class_2)  # package Data-Shapes; Create a TreeView input for UI.MultipleInputForm ++ . Check out www.data-shapes.net for more infos and tips!
boolean = BoolSelector(true)
multipleinputform = Custom[MultipleInputForm ++](Description_optional=code_block_2, ButtonText_optional=code_block_3.out1, Inputs=treeview_input, Toggle=boolean, CancelButtonText_optional=code_block_3.out0)  # package Data-Shapes; Create a form with multiple inputs. see www.data-shapes.net for tutorials and infos!
flatten = List.Flatten(list=multipleinputform.User_Inputs)
string_from_object_2 = FromObject(object=flatten)
eq = string_from_object == string_from_object_2  # lacing=Longest
filterByBoolMask_6 = List.FilterByBoolMask(list=getItemAtIndex, mask=eq)
filterByBoolMask_7 = List.FilterByBoolMask(list=levels_getbyname, mask=eq)

# group: 10. Vytvoření podlahy
ʳʰʸᵗʰᵐ_floor_bycurveloops = Rhythm.Revit.Elements.Floor.ByCurveLoops(curves=finishBoundary, floorType=filterByBoolMask_6.in, level=filterByBoolMask_7.in)

activeViewFromCurrentDocument = Custom[Document.ActiveViewFromCurrentDocument]()  # package Clockwork for Dynamo 2.x; Gets the active view of the current document
isolate_in_view = Custom[Isolate in View](element=ʳʰʸᵗʰᵐ_floor_bycurveloops, view=activeViewFromCurrentDocument)  # package archi-lab.net; This node will take input of elements and a view to isolate selected elements in a view.
