# Dynamo graph FLOOR FROM TOPO.dyn (Dynamo 2.16.2.5624)
# packages: spring nodes 210.1.1

select_model_element = DSModelElementSelection()  # 1 picked in the model
geometry = Element.Geometry(element=select_model_element)
code_block = CodeBlock { 0; }
getItemAtIndex = List.GetItemAtIndex(list=geometry, index=code_block)
floor_types = FloorTypes("Podlaha 1")
levels = Levels("1NP")
byOutlineTypeAndLevel = Floor.ByOutlineTypeAndLevel(outlineCurves=getItemAtIndex, floorType=floor_types, level=levels)
code_block_2 = CodeBlock { 1; }
getItemAtIndex_2 = List.GetItemAtIndex(list=geometry, index=code_block_2)
ꟿ_mesh_topolysurface = Custom[ꟿ Mesh.ToPolySurface](mesh=getItemAtIndex_2)  # package spring nodes; Converts a Dynamo mesh to a polysurface. By default the node is single threaded, but if you specify a higher number of threads in the `NUMTHREAD` input, the node will run multi-threaded to speed up the conversion. *WARNING* Using multi-threaded code with Dynamo's geometry kernel may crash Revit in some cases.
explode = Geometry.Explode(geometry=ꟿ_mesh_topolysurface)
perimeterCurves = Surface.PerimeterCurves(surface=explode)
flatten = List.Flatten(list=perimeterCurves)
uniqueItems = List.UniqueItems(list=flatten)
startPoint = Curve.StartPoint(curve=uniqueItems)
endPoint = Curve.EndPoint(curve=uniqueItems)
list_create = List.Create(item0=startPoint, item1=endPoint)
flatten_2 = List.Flatten(list=list_create)
pruneDuplicates = Point.PruneDuplicates(points=flatten_2)
addPoint = Floor.AddPoint(floor=byOutlineTypeAndLevel, point=pruneDuplicates)
