# Dynamo graph GET IMPORTED CAD ID.dyn (Dynamo 2.16.2.5624)
# packages: archi-lab.net 2023.213.1722

getAll = archilab.Revit.Elements.Categories.GetAll()
string_from_object = FromObject(object=getAll.Model)
code_block = CodeBlock { "dwg"; }
contains = String.Contains(string=string_from_object, searchFor=code_block)
filterByBoolMask = List.FilterByBoolMask(list=getAll.Model, mask=contains)
all_elements_of_category = ElementsOfCategory(Category=filterByBoolMask.in)
id = Element.Id(element=all_elements_of_category)
