# Dynamo graph GROSS AREA.dyn (Dynamo 2.16.2.5624)

select_model_elements_by = DSModelElementsByCategorySelection("OST_Rooms")  # "Select Model Elements By Category"; 4 picked in the model
geometry = Element.Geometry(element=select_model_elements_by)
centroid = Solid.Centroid(solid=geometry)
ZAxis = Vector.ZAxis()
byOriginNormal = Plane.ByOriginNormal(origin=centroid, normal=ZAxis)
intersect = Geometry.Intersect(geometry=geometry, other=byOriginNormal)
perimeterCurves = Surface.PerimeterCurves(surface=intersect)
byJoinedCurves = PolyCurve.ByJoinedCurves(curves=perimeterCurves)
number_slider = DoubleSlider(125, range=0..500 step 0.1)
offsetMany = Curve.OffsetMany(curve=byJoinedCurves, signedDistance=number_slider)
byPatch = Surface.ByPatch(closedCurve=offsetMany)
flatten = List.Flatten(list=byPatch)
byUnion = Surface.ByUnion(surfaces=flatten)
perimeterCurves_2 = Surface.PerimeterCurves(surface=byUnion)
byJoinedCurves_2 = PolyCurve.ByJoinedCurves(curves=perimeterCurves_2)
code_block = CodeBlock { 0; }
sub = code_block - number_slider
offsetMany_2 = Curve.OffsetMany(curve=byJoinedCurves_2, signedDistance=sub)
byPatch_2 = Surface.ByPatch(closedCurve=offsetMany_2)
area = Surface.Area(surface=byPatch_2)
convert_by_units = DynamoUnitConvert(area, MeasurementType="autodesk.unit.quantity:area-1.0.2", FromConversion="autodesk.unit.unit:squareMillimeters-1.0.1", ToConversion="autodesk.unit.unit:squareMeters-1.0.1")
