# Dynamo graph IMPORT PBR.dyn (Dynamo 2.16.2.5624)
# packages: bimorphNodes 4.2.4, Data-Shapes 2022.2.106, WombatDynamo 2.3.4, Clockwork for Dynamo 2.x 2.4.0, Genius Loci 2023.2.21

# group: Inputs
code_block = CodeBlock { "Hasící přístroje podle dwg"; "Spustit"; "Zrušit"; }
code_block_2 = CodeBlock { "Výběr připojeného dwg"; "Vybrat"; }
boolean = BoolSelector(true)
selectmodelelements_data = Custom[SelectModelElements Data](InputName=code_block_2.out0, ButtonText=code_block_2.out1, SelectSingleElement=boolean)  # package Data-Shapes; Creates a Revit element selection input for UI.MultipleInputForm++ . Check out www.data-shapes.net for more infos!
code_block_3 = CodeBlock { "Výběr podlaží"; }
categories = Categories("OST_Levels")
all_elements_of_category = ElementsOfCategory(Category=categories)
name = Level.Name(level=all_elements_of_category)
treeview_input = Custom[TreeView input](InputName=code_block_3, Data=name)  # package Data-Shapes; Create a TreeView input for UI.MultipleInputForm ++ . Check out www.data-shapes.net for more infos and tips!
list_create = List.Create(item0=selectmodelelements_data, item1=treeview_input)
boolean_2 = BoolSelector(true)
code_block_4 = CodeBlock { 200; 100; }
multipleinputform = Custom[MultipleInputForm ++](Description_optional=code_block.out0, ButtonText_optional=code_block.out1, Inputs=list_create, Toggle=boolean_2, CancelButtonText_optional=code_block.out2, Width_optional=code_block_4.out1, LabelWidth_optional=code_block_4.out0)  # package Data-Shapes; Create a form with multiple inputs. see www.data-shapes.net for tutorials and infos!
code_block_5 = CodeBlock { 0; 1; }
linked_dwg = List.GetItemAtIndex(list=multipleinputform.User_Inputs, index=code_block_5.out0)
level_name = List.GetItemAtIndex(list=multipleinputform.User_Inputs, index=code_block_5.out1)
byName = WombatDynamo.Level.ByName(name=level_name)

# group: Find blocks
code_block_6 = CodeBlock { "_PO_znacky"; }
fromLayers = CADTextData.FromLayers(importInstance=linked_dwg, layerNames=code_block_6)
textValue = CADTextData.TextValue(cADTextData=fromLayers.CADTextData)
code_block_7 = CodeBlock { ["5A","8A","13A","21A","27A","34A","21B","34B","55B","70B","89B","113B","144B","183B"]; }
eq = textValue@L1 == code_block_7  # lacing=CrossProduct
anyTrue = List.AnyTrue(list=eq@L2)
filterByBoolMask = List.FilterByBoolMask(list=fromLayers.CADTextData@L2, mask=anyTrue)
flatten = List.Flatten(list=filterByBoolMask.in)

# group: Check family names
textValue_2 = CADTextData.TextValue(cADTextData=flatten)
code_block_8 = CodeBlock { " volný"; }
add = textValue_2 + code_block_8
code_block_9 = CodeBlock { "#Hasící přístroj, ruční"; }
byName_2 = Family.ByName(name=code_block_9)
types = Family.Types(family=byName_2)
uniqueItems = List.UniqueItems(list=add)
name_2 = Family.Name(family=types)
eq_2 = uniqueItems == name_2  # lacing=CrossProduct
anyTrue_2 = List.AnyTrue(list=eq_2@L2)

# group: Create family types
firstItem = List.FirstItem(list=types)
filterByBoolMask_2 = List.FilterByBoolMask(list=uniqueItems, mask=anyTrue_2)
duplicate = ElementType.Duplicate(elementType=firstItem, name=filterByBoolMask_2.out)
code_block_10 = CodeBlock { "Nástěnný"; false; }
setParameterByName = Element.SetParameterByName(element=duplicate, parameterName=code_block_10.out0, value=code_block_10.out1)

# group: Data from CAD text
originPoint = CADTextData.OriginPoint(cADTextData=flatten)
XAxis = Vector.XAxis()
reverse = Vector.Reverse(vector=XAxis)
ZAxis = Vector.ZAxis()
rotation = CADTextData.Rotation(cADTextData=flatten)
rotate = Vector.Rotate(vector=reverse, axis=ZAxis, degrees=rotation)
code_block_11 = CodeBlock { 350; 300; }
translate = Geometry.Translate(geometry=originPoint, direction=rotate, distance=code_block_11.out0)
YAxis = Vector.YAxis()
reverse_2 = Vector.Reverse(vector=YAxis)
ZAxis_2 = Vector.ZAxis()
rotate_2 = Vector.Rotate(vector=reverse_2, axis=ZAxis_2, degrees=rotation)
translate_2 = Geometry.Translate(geometry=translate, direction=rotate_2, distance=code_block_11.out1)

ZAxis_3 = Vector.ZAxis()
reverse_3 = Vector.Reverse(vector=ZAxis_3)
Z = Point.Z(point=translate_2)
translate_3 = Geometry.Translate(geometry=translate_2, direction=reverse_3, distance=Z)

# group: Create family instance
byHostAndPoint = FamilyInstance.ByHostAndPoint()  # unwired: familyType, host, point
passthrough = Custom[Passthrough](passThrough=add, waitFor=setParameterByName)  # package Clockwork for Dynamo 2.x; Forces a sequential order of execution. The node wired into the output of the Passthrough node will be executed *after* the node wired into the waitFor input (e.g. important for some Revit operations). The value of the passThrough input will be passed on to the node wired into the output port of the Passthrough node.
byName_3 = FamilyType.ByName(name=passthrough)
byHostAndPoint_2 = FamilyInstance.ByHostAndPoint(familyType=byName_3, host=byName, point=translate_3)
rotation_2 = CADTextData.Rotation(cADTextData=flatten)
element_setrotation = Custom[Element SetRotation](element=byHostAndPoint_2, degree=rotation_2)  # package Genius Loci; Set the angle of the element around its local Z-axis. (Same as the Rotate command in Revit)
