# Dynamo graph ISOLATE NONBOUNDING WALLS.dyn (Dynamo 4.1.1.5050)

current = Document.Current()
activeView = Document.ActiveView(document=current)
categories = Categories("OST_Walls")
all_elements_of_category_in_view = ElementsOfCategoryInView(Category=categories, View=activeView)
code_block = CodeBlock { "Ohraničení místnosti"; }
getParameterValueByName = Element.GetParameterValueByName(element=all_elements_of_category_in_view, parameterName=code_block)
code_block_2 = CodeBlock { 0; }
eq = getParameterValueByName == code_block_2
filterByBoolMask = List.FilterByBoolMask(list=all_elements_of_category_in_view, mask=eq)
isolateElementsTemporary = View.IsolateElementsTemporary(view=activeView, elements=filterByBoolMask.in)
