# Dynamo graph ISOLATE OVERRIDEN ELEMENTS.dyn (Dynamo 2.16.2.5624)
# packages: Genius Loci 2023.2.21, archi-lab.net 2023.213.1722, Crumple 2022.5.27

all_elements_in_active_view = ElementsInView()
get_elements_overrides = Custom[Get Elements Overrides](element=all_elements_in_active_view)  # package Genius Loci; Get the overrides applied to the elements in the given View. Note : Prior to Revit 2019, the materials have only one surface pattern and one cut pattern.
isNull = Object.IsNull(object=get_elements_overrides.ProjectionLinePattern)
filterByBoolMask = List.FilterByBoolMask(list=all_elements_in_active_view, mask=isNull)
isNull_2 = Object.IsNull(object=get_elements_overrides.ProjectionLineColor)
filterByBoolMask_2 = List.FilterByBoolMask(list=all_elements_in_active_view, mask=isNull_2)
code_block = CodeBlock { 0; }
gt = get_elements_overrides.ProjectionLineWeight > code_block
filterByBoolMask_3 = List.FilterByBoolMask(list=all_elements_in_active_view, mask=gt)
isNull_3 = Object.IsNull(object=get_elements_overrides.SurfaceForegroundPattern)
filterByBoolMask_4 = List.FilterByBoolMask(list=all_elements_in_active_view, mask=isNull_3)
isNull_4 = Object.IsNull(object=get_elements_overrides.SurfaceForegroundPatternColor)
filterByBoolMask_5 = List.FilterByBoolMask(list=all_elements_in_active_view, mask=isNull_4)
isNull_5 = Object.IsNull(object=get_elements_overrides.SurfaceBackgroundPattern)
filterByBoolMask_6 = List.FilterByBoolMask(list=all_elements_in_active_view, mask=isNull_5)
isNull_6 = Object.IsNull(object=get_elements_overrides.SurfaceBackgroundPatternColor)
filterByBoolMask_7 = List.FilterByBoolMask(list=all_elements_in_active_view, mask=isNull_6)
isNull_7 = Object.IsNull(object=get_elements_overrides.CutLinePattern)
filterByBoolMask_8 = List.FilterByBoolMask(list=all_elements_in_active_view, mask=isNull_7)
isNull_8 = Object.IsNull(object=get_elements_overrides.CutLineColor)
filterByBoolMask_9 = List.FilterByBoolMask(list=all_elements_in_active_view, mask=isNull_8)
code_block_2 = CodeBlock { 0; }
gt_2 = get_elements_overrides.CutLineWeight > code_block_2
filterByBoolMask_10 = List.FilterByBoolMask(list=all_elements_in_active_view, mask=gt_2)
isNull_9 = Object.IsNull(object=get_elements_overrides.CutForegroundPattern)
filterByBoolMask_11 = List.FilterByBoolMask(list=all_elements_in_active_view, mask=isNull_9)
isNull_10 = Object.IsNull(object=get_elements_overrides.CutForegroundPatternColor)
filterByBoolMask_12 = List.FilterByBoolMask(list=all_elements_in_active_view, mask=isNull_10)
isNull_11 = Object.IsNull(object=get_elements_overrides.CutBackgroundPattern)
filterByBoolMask_13 = List.FilterByBoolMask(list=all_elements_in_active_view, mask=isNull_11)
isNull_12 = Object.IsNull(object=get_elements_overrides.CutBackgroundPatternColor)
filterByBoolMask_14 = List.FilterByBoolMask(list=all_elements_in_active_view, mask=isNull_12)
code_block_3 = CodeBlock { 0; }
gt_3 = get_elements_overrides.Transparency > code_block_3
filterByBoolMask_15 = List.FilterByBoolMask(list=all_elements_in_active_view, mask=gt_3)
code_block_4 = CodeBlock { true; }
eq = get_elements_overrides.Halftone == code_block_4
filterByBoolMask_16 = List.FilterByBoolMask(list=all_elements_in_active_view, mask=eq)
code_block_5 = CodeBlock { true; }
eq_2 = get_elements_overrides.Visible == code_block_5
filterByBoolMask_17 = List.FilterByBoolMask(list=all_elements_in_active_view, mask=eq_2)
list_create = List.Create(item0=filterByBoolMask.out, item1=filterByBoolMask_2.out, item2=filterByBoolMask_3.in, item3=filterByBoolMask_4.out, item4=filterByBoolMask_5.out, item5=filterByBoolMask_6.out, item6=filterByBoolMask_7.out, item7=filterByBoolMask_8.out, item8=filterByBoolMask_9.out, item9=filterByBoolMask_10.in, item10=filterByBoolMask_11.out, item11=filterByBoolMask_12.out, item12=filterByBoolMask_13.out, item13=filterByBoolMask_14.out, item14=filterByBoolMask_15.in, item15=filterByBoolMask_16.in, item16=filterByBoolMask_17.out)
flatten = List.Flatten(list=list_create)
uniqueItems = List.UniqueItems(list=flatten)
revit_currentview = Custom[© Revit.CurrentView]()  # package Crumple; Given the current document, return the active view.
isolate_in_view = Custom[Isolate in View](element=uniqueItems, view=revit_currentview)  # package archi-lab.net; This node will take input of elements and a view to isolate selected elements in a view.
