# Dynamo graph JOIN ELEMENTS.dyn (Dynamo 2.16.2.5624)
# packages: Macro4BIM 2023.1.1

list_create = List.Create()  # unwired: item0, item1
all_elements_in_active_view = ElementsInView()
cartesianProduct = List.CartesianProduct(combineFunction=list_create, list0=all_elements_in_active_view, list1=all_elements_in_active_view)
code_block = CodeBlock { 1; 2; }
flatten = List.Flatten(list=cartesianProduct, amount=code_block.out0)
geometry = Element.Geometry(element=all_elements_in_active_view)
flatten_2 = List.Flatten(list=geometry)
cartesianProduct_2 = List.CartesianProduct(combineFunction=list_create, list0=flatten_2, list1=flatten_2)
code_block_2 = CodeBlock { 1; }
flatten_3 = List.Flatten(list=cartesianProduct_2, amount=code_block_2)
code_block_3 = CodeBlock { 0; 1; }
getItemAtIndex = List.GetItemAtIndex(list=flatten_3@L2, index=code_block_3.out0)
getItemAtIndex_2 = List.GetItemAtIndex(list=flatten_3@L2, index=code_block_3.out1)
doesIntersect = Geometry.DoesIntersect(geometry=getItemAtIndex, other=getItemAtIndex_2)
flatten_4 = List.Flatten(list=doesIntersect, amount=code_block.out1)
filterByBoolMask = List.FilterByBoolMask(list=flatten, mask=flatten_4@L2)
watch = Watch(filterByBoolMask.out)
code_block_4 = CodeBlock { 1; }
flatten_5 = List.Flatten(list=watch, amount=code_block_4)
𝑀⁴𝐵_element_join = Custom[𝑀⁴𝐵 Element.Join](elements=flatten_5)  # package Macro4BIM
