# Dynamo graph MASS FROM ROOMS.dyn (Dynamo 2.16.1.2727)
# packages: Crumple 2022.5.27, Clockwork for Dynamo 2.x 2.4.0, Data-Shapes 2022.2.106, spring nodes 210.1.1, archi-lab.net 2023.213.1722

code_block = CodeBlock { "Objemy požárních úseků"; "Vytvořit objem"; "Zrušit"; }
code_block_2 = CodeBlock { "Vyber místnosti"; }
categories = Categories("OST_Rooms")
all_elements_of_category = ElementsOfCategory(Category=categories)
number = Room.Number(room=all_elements_of_category)
code_block_3 = CodeBlock { " "; }
add = number + code_block_3  # lacing=Longest
name = Room.Name(room=all_elements_of_category)
add_2 = add + name
listview_data = Custom[Listview Data](InputName=code_block_2, Keys=add_2, Values=all_elements_of_category)  # package Data-Shapes; Create data for ListView input in UI.MultiInputForm ++ . Check out www.data-shapes.net for more infos.
code_block_4 = CodeBlock { "Název úseku"; }
textbox_data = Custom[TextBox Data](InputName=code_block_4)  # package Data-Shapes; Create Data for TextBox input in UI.MultipleInputForm ++ . Check out www.data-shapes.net for more informations
list_create = List.Create(item0=listview_data, item1=textbox_data)
boolean = BoolSelector(true)
multipleinputform = Custom[MultipleInputForm ++](Description_optional=code_block.out0, ButtonText_optional=code_block.out1, Inputs=list_create, Toggle=boolean, CancelButtonText_optional=code_block.out2)  # package Data-Shapes; Create a form with multiple inputs. see www.data-shapes.net for tutorials and infos!
code_block_5 = CodeBlock { 0; 1; }
getItemAtIndex = List.GetItemAtIndex(list=multipleinputform.User_Inputs, index=code_block_5.out0)
rooms_boundaries = Custom[© Rooms.Boundaries](room=getItemAtIndex)  # package Crumple; For a room or list of rooms, return all boundary (and internal) curves. The curves will be based on the currently nominated project room boundary settings.
group_curves = Custom[Group Curves](curves=rooms_boundaries@L2)  # package archi-lab.net; This node will take any input of flat list of curves and group them into sublists containing "joinable" curves that is continous curves. They might form closed curves or open curves. Use PolyCurve.ByJoinedCurves to convert output groups of curves into single PolyCurves
byJoinedCurves = PolyCurve.ByJoinedCurves(curves=group_curves)
byPatch = Surface.ByPatch(closedCurve=byJoinedCurves)
code_block_6 = CodeBlock { "Neohraničená výška"; }
getParameterValueByName = Element.GetParameterValueByName(element=getItemAtIndex, parameterName=code_block_6)
boolean_2 = BoolSelector(false)
thicken = Surface.Thicken(surface=byPatch@L2, thickness=getParameterValueByName, both_sides=boolean_2)
count = List.Count(list=thicken@L2)
code_block_7 = CodeBlock { 1; }
gt = count > code_block_7
filterByBoolMask = List.FilterByBoolMask(list=thicken, mask=gt)
volume = Solid.Volume(solid=filterByBoolMask.in@L2)
boolean_3 = BoolSelector(true)
sortListByAnother = archilab.Lists.Lists.SortListByAnother(list=filterByBoolMask.in@L2, sortBy=volume@L2, reversed=boolean_3)
code_block_8 = CodeBlock { 0; 1; }
getItemAtIndex_2 = List.GetItemAtIndex(list=sortListByAnother.list@L2, index=code_block_8.out0)
getItemAtIndex_3 = List.GetItemAtIndex(list=sortListByAnother.list@L2, index=code_block_8.out1)
difference = Solid.Difference(solid=getItemAtIndex_2@L1, other=getItemAtIndex_3@L1)
list_create_2 = List.Create(item0=difference, item1=filterByBoolMask.out)
flatten = List.Flatten(list=list_create_2)
byUnion = Custom[Solid.ByUnion+](solids=flatten)  # package Clockwork for Dynamo 2.x; The OOTB node Solid.ByUnion occasionally fails when trying to merge solids with almost adjacent faces. This node will return the minimum amount of joined solids possible in such cases instead of returning null.
file_path = Filename("..\..\..\ProgramData\Autodesk\RVT 2023\Family Templates\Czech\Koncepční objemy\Objem.rft")
getItemAtIndex_4 = List.GetItemAtIndex(list=multipleinputform.User_Inputs, index=code_block_5.out1)
categories_2 = Categories("OST_Mass")
ꟿ_familyinstance_bygeometry = Custom[ꟿ FamilyInstance.ByGeometry](geometry=byUnion, familyTemplatePath=file_path, familyName=getItemAtIndex_4, category=categories_2)  # package spring nodes; You must provide a valid family template path that will be used for all input geometry objects. The project units(and not the templates) will be used to determine the size of the output geometry. The provided category will be used only if the family template supports it. If not, the default template category will be used instead. Likewise, the family material(provided as a string) will be set only if a material with that name exists in the template. If not, the default material will be used instead ("By Category"). For void cuts, the material settings will be ignored. The Subcategory name is an optional input. If you'd like to skip assigning a Subcategory to any new instance, simply use null. The node expects a unique family name for each geometry object. The rest of the input lists will be processed as if the node lacing is set to longest.
boolean_4 = BoolSelector(true)
volume_2 = Solid.Volume(solid=difference)
