# Dynamo graph MASS FROM SPACES.dyn (Dynamo 2.16.1.2727)

code_block = CodeBlock { "Prostory"; }
byName = Category.ByName(name=code_block)
all_elements_of_category = ElementsOfCategory(Category=byName)
geometry = Element.Geometry(element=all_elements_of_category)
