# Dynamo graph MASS ROOM VIEWS.dyn (Dynamo 2.16.2.5624)
# packages: Genius Loci 2023.2.21, spring nodes 210.1.1, Clockwork for Dynamo 2.x 2.4.0, MEPover 2022.10.30

# group: Filter rooms
categories = Categories("OST_Rooms")
all_elements_of_category = ElementsOfCategory(Category=categories)
area = Room.Area(room=all_elements_of_category)
code_block = CodeBlock { 0; }
gt = area > code_block
filterByBoolMask = List.FilterByBoolMask(list=all_elements_of_category, mask=gt)
code_block_2 = CodeBlock { "Podlaží"; }
getParameterValueByName = Element.GetParameterValueByName(element=filterByBoolMask.in, parameterName=code_block_2)
code_block_3 = CodeBlock { "1.NP"; }
eq = getParameterValueByName == code_block_3
filterByBoolMask_2 = List.FilterByBoolMask(list=filterByBoolMask.in, mask=eq)
level_byname = Custom[Level ByName](name=code_block_3)  # package Genius Loci; Collects Levels by name in the active or given document.

# group: Create views
views = Views("1.NP - KCB")
number = Room.Number(room=filterByBoolMask_2.in)
duplicateWithDetailing = Custom[View.DuplicateWithDetailing](view=views, name=number)  # package Clockwork for Dynamo 2.x; Duplicates a given view with detailing

# group: Crop geometry
geometry = Element.Geometry(element=filterByBoolMask_2.in)
level_plane = Custom[Level Plane](level=level_byname)  # package Genius Loci; Constructs a Plane from a level.
intersect = Geometry.Intersect(geometry=geometry, other=level_plane)
ꟿ_surface_outerperimetercurves = Custom[ꟿ Surface.OuterPerimeterCurves](surf=intersect)  # package spring nodes; Get only the outer perimeter of a surface, dropping the inner openings.
byJoinedCurves = PolyCurve.ByJoinedCurves(curves=ꟿ_surface_outerperimetercurves)
code_block_4 = CodeBlock { 150; }
code_block_5 = CodeBlock { a = Autodesk.Point.ByCoordinates(100000,100000,100000); }
ꟿ_curve_offset = Custom[ꟿ Curve.Offset+](curve=byJoinedCurves, distance=code_block_4, point=code_block_5)  # package spring nodes; Offsets a curve towards the specified point

# group: Set cropbox
cropBoxActive = View.CropBoxActive(view=duplicateWithDetailing)
flatten = List.Flatten(list=duplicateWithDetailing)
passthrough = Custom[Passthrough](passThrough=ꟿ_curve_offset, waitFor=duplicateWithDetailing)  # package Clockwork for Dynamo 2.x; Forces a sequential order of execution. The node wired into the output of the Passthrough node will be executed *after* the node wired into the waitFor input (e.g. important for some Revit operations). The value of the passThrough input will be passed on to the node wired into the output port of the Passthrough node.
flatten_2 = List.Flatten(list=passthrough)
setCropBoxCurves = Custom[View.SetCropBoxCurves](views=flatten, curves=flatten_2)  # package MEPover; Input views and lists of curves to set the view crop regions
