# Dynamo graph PBR FROM CAD.dyn (Dynamo 2.16.2.5624)
# packages: bimorphNodes 4.2.4, DynamoMEP 1.0.3, Crumple 2022.5.27, Genius Loci 2023.2.21, WombatDynamo 2.3.4

select_model_element = DSModelElementSelection()  # 1 picked in the model
code_block = CodeBlock { "_PO_hranice-PU"; }
curvesFromCADLayers = CAD.CurvesFromCADLayers(importInstance=select_model_element, layerNames=code_block)
code_block_2 = CodeBlock { "1NP"; }
level_byname = Custom[Level ByName](name=code_block_2)  # package Genius Loci; Collects Levels by name in the active or given document.
byLevel = WombatDynamo.AreaPlanView.ByLevel(level=level_byname)
byCurveAndView = DynamoMEP.AreaBoundary.ByCurveAndView(curve=curvesFromCADLayers.Curve, view=byLevel)
code_block_3 = CodeBlock { "_PO_popis"; }
fromLayers = CADTextData.FromLayers(importInstance=select_model_element, layerNames=code_block_3)
height = CADTextData.Height(cADTextData=fromLayers.CADTextData)
code_block_4 = CodeBlock { 400; }
gt = height > code_block_4
filterByBoolMask = List.FilterByBoolMask(list=fromLayers.CADTextData, mask=gt)
originPoint = CADTextData.OriginPoint(cADTextData=filterByBoolMask.in)
areas_create = Custom[© Areas.Create](view=byLevel, points=originPoint)  # package Crumple; Given a view and a list of points, will create new areas at them. Note that you will need to provide a single view and list of points, or apply @levels to your inputs to have them work.
