# Dynamo graph PIPES BY COORDINATES.dyn (Dynamo 2.16.2.5624)
# packages: Crumple 2022.5.27, MEPover 2022.10.30

file_path = Filename("C:\Users\dvoracek\Downloads\souřadnice.xlsx")
code_block = CodeBlock { "List1"; }
excel_import = Custom[© Excel.Import](filePath=file_path, sheetName=code_block)  # package Crumple; Imports a 2D matrix of data from an existing Excel file path from a given worksheet name. If a worksheet does not exist by that name it will take the data from the first worksheet instead. Credit to Cyril Poupin for most of the Python code (details in node body).
code_block_2 = CodeBlock { 0; 1; 2; }
getItemAtIndex = List.GetItemAtIndex(list=excel_import.dataRows@L2, index=code_block_2.out0)
getItemAtIndex_2 = List.GetItemAtIndex(list=excel_import.dataRows@L2, index=code_block_2.out1)
getItemAtIndex_3 = List.GetItemAtIndex(list=excel_import.dataRows@L2, index=code_block_2.out2)
byCoordinates = Point.ByCoordinates(x=getItemAtIndex, y=getItemAtIndex_2, z=getItemAtIndex_3)
code_block_3 = CodeBlock { -1; }
dropItems = List.DropItems(list=byCoordinates, amount=code_block_3)
code_block_4 = CodeBlock { 1; }
dropItems_2 = List.DropItems(list=byCoordinates, amount=code_block_4)
byStartPointEndPoint = Line.ByStartPointEndPoint(startPoint=dropItems, endPoint=dropItems_2)
flatten = List.Flatten(list=byStartPointEndPoint)
element_classes = ElementTypes("PipeType")
all_elements_of_class = ElementsOfType(element_class=element_classes)
element_classes_2 = ElementTypes("PipingSystem")
all_elements_of_class_2 = ElementsOfType(element_class=element_classes_2)
levels = Levels("1NP")
code_block_5 = CodeBlock { "150"; }
byLines = Custom[Pipe.ByLines](Lines=flatten, PipeType=all_elements_of_class, SystemType=all_elements_of_class_2, level=levels, Diameter=code_block_5)  # package MEPover; Creates a pipe by Line, PipeType, SystemType, Level and Diameter
