# Dynamo graph PLACE BLINDS BOX.dyn (Dynamo 2.16.2.5624)
# packages: archi-lab.net 2023.213.1722, Clockwork for Dynamo 2.x 2.4.0, Genius Loci 2023.2.21, Rhythm 2023.2.2

# group: Background
select_model_element = DSModelElementSelection()  # 1 picked in the model; graph input
getChildElements = Element.GetChildElements(element=select_model_element)
string_from_object = FromObject(object=getChildElements)
code_block = CodeBlock { "200x300"; }
eq = string_from_object == code_block
filterByBoolMask = List.FilterByBoolMask(list=getChildElements, mask=eq)

# group: Annotation
element_host = Custom[Element Host](element=select_model_element)  # package Genius Loci; Gets the host of the element. Unlike the OOTB node FamilyInstance.GetHost, it also works for elements hosted by a linked document, wall sweeps, foundations, railings and builing pads. Based on a Clockwork's node
faces = Element.Faces(element=element_host)
ʳʰʸᵗʰᵐ_hostobject = Rhythm.Revit.Elements.HostObject.ExteriorSurface(hostObject=element_host)
intersect = Geometry.Intersect(geometry=faces, other=ʳʰʸᵗʰᵐ_hostobject@L1)
string_from_object_2 = FromObject(object=intersect)
code_block_2 = CodeBlock { "Surface"; }
eq_2 = string_from_object_2 == code_block_2
filterByBoolMask_2 = List.FilterByBoolMask(list=faces@L1, mask=eq_2@L2)

list_clean = Custom[List Clean](list=filterByBoolMask_2.in)  # package Genius Loci; Removes all Null, Empty and Blank from a list or nested list of lists.
location = Custom[Element.Location+](element=filterByBoolMask.in)  # package Clockwork for Dynamo 2.x; Returns the location of an element as point, curve or curve loop, along with some booleans to help filtering the results. Unlike the OOTB Element.GetLocation node, it also retunrs sketch lines of sketch-based elements like floor slabs as well as the element's rotation property.

# group: Output
type = archilab.Revit.Elements.Elements.Type(element=filterByBoolMask.in)
normalAtPoint = Surface.NormalAtPoint(surface=ʳʰʸᵗʰᵐ_hostobject, point=location.points)
ZAxis = Vector.ZAxis()
code_block_3 = CodeBlock { 90; }
rotate = Vector.Rotate(vector=normalAtPoint, axis=ZAxis, degrees=code_block_3)
byFace = FamilyInstance.ByFace(familyType=type, face=list_clean, location=location.points, referenceDirection=rotate)

passthrough = Custom[Passthrough](passThrough=select_model_element, waitFor=byFace)  # package Clockwork for Dynamo 2.x; Forces a sequential order of execution. The node wired into the output of the Passthrough node will be executed *after* the node wired into the waitFor input (e.g. important for some Revit operations). The value of the passThrough input will be passed on to the node wired into the output port of the Passthrough node.
code_block_4 = CodeBlock { "Typ žaluziového boxu"; }
code_block_5 = CodeBlock { "#Bez boxu"; }
byName = Family.ByName(name=code_block_5)
types = Family.Types(family=byName)
setParameterByName = Element.SetParameterByName(element=passthrough, parameterName=code_block_4, value=types)
code_block_6 = CodeBlock { "Délka žaluzií"; }
type_2 = archilab.Revit.Elements.Elements.Type(element=select_model_element)
code_block_7 = CodeBlock { "Šířka"; }
getParameterValueByName = Element.GetParameterValueByName(element=type_2, parameterName=code_block_7)
setParameterByName_2 = Element.SetParameterByName(element=byFace, parameterName=code_block_6, value=getParameterValueByName)
