# Dynamo graph PNG TO EXCEL.dyn "ROOMBOOK" (Dynamo 2.16.2.5624)
# packages: BumbleBee 2021.25.3

file_path = Filename("C:\OneDrive\OneDrive - PFM-Group a.s\Testing\Nový List Microsoft Excelu.xlsx")
boolean = BoolSelector(true)
code_block = CodeBlock { ["1"]; ["C3"]; }
file_path_2 = Filename("..\..\..\Testing\Images\1.png")
list_create = List.Create(item0=file_path_2)
bb_data = Custom[BB Data](sheetName=code_block.out0, origin=code_block.out1, data=list_create)  # package BumbleBee; This node is a building block for different modes of writing to Excel files. You can combines this node into a list to write to multiple sheets or use just one to write to a single sheet.
code_block_2 = CodeBlock { "Obrázek2.jpg"; }
boolean_2 = BoolSelector(true)
image_style = Custom[Image Style](imageName=code_block_2, linkToFile=boolean_2)  # package BumbleBee; This node generates an image style for images being embedded in a document.
embed_image = Custom[Embed Image](filePath=file_path, RunIt=boolean, BBData=bb_data, imageStyle=image_style)  # package BumbleBee; This node will embed an image into an Excel document.
file_path_3 = Filename("C:\OneDrive\OneDrive - PFM-Group a.s\Testing\Nový List Microsoft Excelu.xlsx")
boolean_3 = BoolSelector(true)
categories = Categories("OST_Rooms")
all_elements_of_category = ElementsOfCategory(Category=categories)
number = Room.Number(room=all_elements_of_category)
bb_data_2 = Custom[BB Data](sheetName=number)  # unwired: origin, data
boolean_4 = BoolSelector(true)
image_style_2 = Custom[Image Style](imageName=number, linkToFile=boolean_4, saveWithDoc=boolean_4)
embed_image_2 = Custom[Embed Image](filePath=file_path_3, RunIt=boolean_3, BBData=bb_data_2, imageStyle=image_style_2)  # frozen
