# Dynamo graph PNGs TO EXCEL.dyn (Dynamo 2.16.2.5624)
# packages: BumbleBee 2021.25.3

file_path = Filename("C:\OneDrive\OneDrive - PFM-Group a.s\Testing\Nový List Microsoft Excelu.xlsx")
list_create = List.Create(item0=file_path)
boolean = BoolSelector(true)
categories = Categories("OST_Rooms")
all_elements_of_category = ElementsOfCategory(Category=categories)
area = Room.Area(room=all_elements_of_category)
code_block = CodeBlock { 0; }
gt = area > code_block
filterByBoolMask = List.FilterByBoolMask(list=all_elements_of_category, mask=gt)
number = Room.Number(room=filterByBoolMask.in)
code_block_2 = CodeBlock { ["C3"]; }
directory_path = Directory("C:\OneDrive\OneDrive - PFM-Group a.s\Testing\Images")
string = StringInput("\")
code_block_3 = CodeBlock { ".png"; }
code_block_4 = CodeBlock(a=directory_path, b=string, c=number, d=code_block_3) { a + b + c + d; }
bb_data = Custom[BB Data](sheetName=number@L1, origin=code_block_2@L1, data=code_block_4@L1, lacing=Longest)  # package BumbleBee; This node is a building block for different modes of writing to Excel files. You can combines this node into a list to write to multiple sheets or use just one to write to a single sheet.
add = number + code_block_3
boolean_2 = BoolSelector(true)
image_style = Custom[Image Style](imageName=add, linkToFile=boolean_2, saveWithDoc=boolean_2, lacing=Longest)  # package BumbleBee; This node generates an image style for images being embedded in a document.
embed_image = Custom[Embed Image](filePath=list_create@L1, RunIt=boolean, BBData=bb_data@L1, imageStyle=image_style@L1, lacing=Longest)  # package BumbleBee; This node will embed an image into an Excel document.
