# Dynamo graph Popis dverí A99 1.dyn (Dynamo 3.2.2.5494)

current = Document.Current()
activeView = Document.ActiveView(document=current)

# group: Imput
select_model_elements_by = DSModelElementsByCategorySelection("OST_Doors")  # "Select Model Elements By Category"; 6 picked in the model; graph input

# group: Is Flipped?
facingOrientation = FamilyInstance.FacingOrientation(familyInstance=select_model_elements_by)
Y = Vector.Y(vector=facingOrientation)
code_block = CodeBlock { 0; }
gt = Y > code_block
filterByBoolMask = List.FilterByBoolMask(list=select_model_elements_by, mask=gt)
list_create = List.Create(item0=filterByBoolMask.in, item1=filterByBoolMask.out)

# group: Orientation of doors
facingOrientation_2 = FamilyInstance.FacingOrientation(familyInstance=list_create)
X = Vector.X(vector=facingOrientation_2)
round = Math.Round(number=X)
not_ = Not(x=round)
filterByBoolMask_2 = List.FilterByBoolMask(list=list_create, mask=not_)
list_create_2 = List.Create(item0=filterByBoolMask_2.in, item1=filterByBoolMask_2.out)
code_block_2 = CodeBlock { 1; }
flatten = List.Flatten(list=list_create_2, amount=code_block_2)

# group: Imput
orientace_dle_vektoru_dveri_1 = BoolSelector(false)
orientace_dle_vektoru_dveri_2 = BoolSelector(true)  # graph input

list_create_3 = List.Create(item0=orientace_dle_vektoru_dveri_1, item1=orientace_dle_vektoru_dveri_1, item2=orientace_dle_vektoru_dveri_2, item3=orientace_dle_vektoru_dveri_2)
odkaz = BoolSelector(false)  # graph input
string = StringInput("Center")

# group: Odsadenie
odsazení_popisky = DoubleSlider(300, range=0..1000 step 100)  # graph input

# group: Odsadenie
code_block_3 = CodeBlock { 0; 400; }
byCoordinates = Vector.ByCoordinates(x=code_block_3.out0, y=odsazení_popisky)
code_block_4 = CodeBlock { 0; -400; }
code_block_5 = CodeBlock { -1; }
mul = odsazení_popisky * code_block_5
byCoordinates_2 = Vector.ByCoordinates(x=code_block_4.out0, y=mul)
code_block_6 = CodeBlock { -400; 0; }
byCoordinates_3 = Vector.ByCoordinates(x=mul, y=code_block_6.out1)
code_block_7 = CodeBlock { 400; 0; }
byCoordinates_4 = Vector.ByCoordinates(x=odsazení_popisky, y=code_block_7.out1)
list_create_4 = List.Create(item0=byCoordinates, item1=byCoordinates_2, item2=byCoordinates_3, item3=byCoordinates_4)

boolean = BoolSelector(true)
byElement = Tag.ByElement(view=activeView, element=flatten, horizontal=list_create_3, addLeader=odkaz, horizontalAlignment=string, verticalAlignment=string, offset=list_create_4, isOffset=boolean)
leaderend_condition = LeaderEndCondition("Attached")
setLeaderEndCondition = Tag.SetLeaderEndCondition(tag=byElement, leaderEndCondition=leaderend_condition)
code_block_8 = CodeBlock { "Typ"; }

# group: Typ popisky
typ_popisky = FamilyTypes("#Popiska dveří,1.8mm, modrá:Šířka, výška")  # graph input

setParameterByName = Element.SetParameterByName(element=setLeaderEndCondition, parameterName=code_block_8, value=typ_popisky)
