# Dynamo graph RANDOM FACADE.dyn (Dynamo 3.2.1.5366)
# packages: WombatDynamo 2.3.5

select_model_elements_by = DSModelElementsByCategorySelection("OST_CurtainWallPanels")  # "Select Model Elements By Category"; 410 picked in the model
family_types = FamilyTypes("Systémový panel:#Tahokov, 10mm")
family_types_2 = FamilyTypes("Systémový panel:#Tahokov, 20mm")
family_types_3 = FamilyTypes("Systémový panel:#Tahokov, 30mm")
list_create = List.Create(item0=family_types, item1=family_types_2, item2=family_types_3)
count = List.Count(list=select_model_elements_by)
python_script = Python(IN[0]=count)  # CPython3
# ---------- python_script.python (15 lines) ----------
import random


# Define the probabilities for 0, 1, and 2
probabilities = [0.7, 0.25, 0.05]

# Define the possible outcomes
outcomes = [0, 1, 2]

# Generate the list of 10 random numbers with the specified probabilities
random_numbers = random.choices(outcomes, probabilities, k=IN[0])



OUT = random_numbers
# ----------------------------------------
getItemAtIndex = List.GetItemAtIndex(list=list_create, index=python_script)
setType = WombatDynamo.FamilyInstance.SetType(familyInstance=select_model_elements_by, familyType=getItemAtIndex)
boundaries = CurtainPanel.Boundaries(curtainPanel=select_model_elements_by)  # frozen
points = PolyCurve.Points(polyCurve=boundaries)
byPoints = Polygon.ByPoints(points=points)
center = Polygon.Center(polygon=byPoints)
Z = Point.Z(point=center)
flatten = List.Flatten(list=Z)
code_block = CodeBlock { 2150; 19350; }  # frozen
code_block_2 = CodeBlock(max=code_block.out1, min=code_block.out0) { a = max - min; a3 = a/3; lvl1 = min + a3; lvl2 = lvl1 + a3; }
le = flatten <= code_block_2.lvl1
filterByBoolMask = List.FilterByBoolMask(list=select_model_elements_by, mask=le)
watch = Watch(filterByBoolMask.in)
ge = flatten >= code_block_2.lvl1
filterByBoolMask_2 = List.FilterByBoolMask(list=select_model_elements_by, mask=ge)
ge_2 = flatten >= code_block_2.lvl2
filterByBoolMask_3 = List.FilterByBoolMask(list=filterByBoolMask_2.out, mask=ge_2)
watch_2 = Watch(filterByBoolMask_3.in)
list_create_2 = List.Create(item0=filterByBoolMask_2.in, item1=filterByBoolMask_3.in)
flatten_2 = List.Flatten(list=list_create_2)
id = Element.Id(element=flatten_2)
uniqueItems = List.UniqueItems(list=id)
select_model_elements_by_2 = DSModelElementsByCategorySelection("OST_CurtainWallPanels")  # "Select Model Elements By Category"; 368 picked in the model
family_types_4 = FamilyTypes("Systémový panel:#Tahokov, 10mm")
family_types_5 = FamilyTypes("Systémový panel:#Tahokov, 20mm")
family_types_6 = FamilyTypes("Systémový panel:#Tahokov, 30mm")
list_create_3 = List.Create(item0=family_types_4, item1=family_types_5, item2=family_types_6)
count_2 = List.Count(list=select_model_elements_by_2)
python_script_2 = Python(IN[0]=count_2)  # CPython3
# ---------- python_script_2.python (15 lines) ----------
import random


# Define the probabilities for 0, 1, and 2
probabilities = [0.15, 0.7, 0.15]

# Define the possible outcomes
outcomes = [0, 1, 2]

# Generate the list of 10 random numbers with the specified probabilities
random_numbers = random.choices(outcomes, probabilities, k=IN[0])



OUT = random_numbers
# ----------------------------------------
getItemAtIndex_2 = List.GetItemAtIndex(list=list_create_3, index=python_script_2)
setType_2 = WombatDynamo.FamilyInstance.SetType(familyInstance=select_model_elements_by_2, familyType=getItemAtIndex_2)
select_model_elements_by_3 = DSModelElementsByCategorySelection("OST_CurtainWallPanels")  # "Select Model Elements By Category"; 323 picked in the model
family_types_7 = FamilyTypes("Systémový panel:#Tahokov, 10mm")
family_types_8 = FamilyTypes("Systémový panel:#Tahokov, 20mm")
family_types_9 = FamilyTypes("Systémový panel:#Tahokov, 30mm")
list_create_4 = List.Create(item0=family_types_7, item1=family_types_8, item2=family_types_9)
count_3 = List.Count(list=select_model_elements_by_3)
python_script_3 = Python(IN[0]=count_3)  # CPython3
# ---------- python_script_3.python (15 lines) ----------
import random


# Define the probabilities for 0, 1, and 2
probabilities = [0.05, 0.25, 0.7]

# Define the possible outcomes
outcomes = [0, 1, 2]

# Generate the list of 10 random numbers with the specified probabilities
random_numbers = random.choices(outcomes, probabilities, k=IN[0])



OUT = random_numbers
# ----------------------------------------
getItemAtIndex_3 = List.GetItemAtIndex(list=list_create_4, index=python_script_3)
setType_3 = WombatDynamo.FamilyInstance.SetType(familyInstance=select_model_elements_by_3, familyType=getItemAtIndex_3)
