# Dynamo graph RENAME ROOMS.dyn (Dynamo 2.16.2.5624)

# group: Filtr místností podle stavebního objektu
categories = Categories("OST_Rooms")
all_elements_of_category = ElementsOfCategory(Category=categories)
code_block = CodeBlock { "Stavební objekt"; }
getParameterValueByName = Element.GetParameterValueByName(element=all_elements_of_category, parameterName=code_block)
code_block_2 = CodeBlock { "B"; }
contains = String.Contains(string=getParameterValueByName, searchFor=code_block_2)
filterByBoolMask = List.FilterByBoolMask(list=all_elements_of_category, mask=contains)

# group: Odfiltrovanie miestností bez plochy
code_block_3 = CodeBlock { "Plocha"; }
getParameterValueByName_2 = Element.GetParameterValueByName(element=filterByBoolMask.in, parameterName=code_block_3)
code_block_4 = CodeBlock { 0; }
gt = getParameterValueByName_2 > code_block_4
code_block_5 = CodeBlock { null; }
eq = gt == code_block_5
boolean = BoolSelector(false)
if_ = RefactoredIf(test=eq@L1, true=boolean, false=gt@L1)
filterByBoolMask_2 = List.FilterByBoolMask(list=filterByBoolMask.in, mask=if_)

# group: Zadanie čítaných parametrov
code_block_6 = CodeBlock { "Stavební objekt"; "Podlaží"; "Oddělení"; "Číslo místnosti"; }

getParameterValueByName_3 = Element.GetParameterValueByName(element=filterByBoolMask_2.in, parameterName=code_block_6.out0)
getParameterValueByName_4 = Element.GetParameterValueByName(element=filterByBoolMask_2.in, parameterName=code_block_6.out1)
getParameterValueByName_5 = Element.GetParameterValueByName(element=filterByBoolMask_2.in, parameterName=code_block_6.out2)
getParameterValueByName_6 = Element.GetParameterValueByName(element=filterByBoolMask_2.in, parameterName=code_block_6.out3)

# group: Nevplnené prepísať na varovný text
code_block_7 = CodeBlock { ""; }
eq_2 = getParameterValueByName_3 == code_block_7
string = StringInput("!#!")
if_2 = RefactoredIf(test=eq_2@L1, true=string, false=getParameterValueByName_3@L1)
eq_3 = getParameterValueByName_4 == code_block_7
if_3 = RefactoredIf(test=eq_3@L1, true=string, false=getParameterValueByName_4@L1)
eq_4 = getParameterValueByName_5 == code_block_7
if_4 = RefactoredIf(test=eq_4@L1, true=string, false=getParameterValueByName_5@L1)
eq_5 = getParameterValueByName_6 == code_block_7
if_5 = RefactoredIf(test=eq_5@L1, true=string, false=getParameterValueByName_6@L1)

# group: Úprava a spojenie textu
code_block_8 = CodeBlock { "."; }
add = if_2 + code_block_8
code_block_9 = CodeBlock { "0"; }
code_block_10 = CodeBlock { 0; 1; }
substring = String.Substring(string=if_3, startIndex=code_block_10.out0, length=code_block_10.out1)
add_2 = code_block_9 + substring
code_block_11 = CodeBlock { "."; }
add_3 = add_2 + code_block_11
add_4 = add + add_3
add_5 = add_4 + if_4
add_6 = code_block_11 + if_5
add_7 = add_5 + add_6

# group: Zadanie textu parametru
code_block_12 = CodeBlock { "Číslo"; }
setParameterByName = Element.SetParameterByName(element=filterByBoolMask_2.in, parameterName=code_block_12, value=add_7)

# group: Vyplnění podlaží
code_block_13 = CodeBlock { "Obsazení"; }
setParameterByName_2 = Element.SetParameterByName(element=filterByBoolMask_2.in, parameterName=code_block_13, value=add_2)
