# Dynamo graph ROOM AREA.dyn (Dynamo 3.3.0.6316)
# packages: Genius Loci 2024.5.29, Rhythm 2024.10.1, archi-lab.net 2025.300.1225, Crumple 2024.4.3, Clockwork for Dynamo 2.x 2.4.0, spring nodes 210.1.1, WombatDynamo 2.3.5

# group: Get rooms
categories = Categories("OST_Rooms")
all_elements_of_category = ElementsOfCategory(Category=categories)
area = Room.Area(room=all_elements_of_category)
code_block = CodeBlock { 0; }
gt = area > code_block
filterByBoolMask = List.FilterByBoolMask(list=all_elements_of_category, mask=gt)
ʳʰʸᵗʰᵐ_rooms_level = Rhythm.Revit.Elements.Rooms.Level(room=filterByBoolMask.in)
string_from_object = FromObject(object=ʳʰʸᵗʰᵐ_rooms_level)
current = Document.Current()
activeView = Document.ActiveView(document=current)
view_level = Custom[View Level](view=activeView)  # package Genius Loci; Returns the level to which a view is associated.
string_from_object_2 = FromObject(object=view_level)
eq = string_from_object == string_from_object_2
filterByBoolMask_2 = List.FilterByBoolMask(list=filterByBoolMask.in, mask=eq)

# group: Get doors
categories_2 = Categories("OST_Doors")
all_elements_of_category_2 = ElementsOfCategory(Category=categories_2)
type = archilab.Revit.Elements.Elements.Type(element=all_elements_of_category_2)
code_block_2 = CodeBlock { "Štítek"; }
getParameterValueByName = Element.GetParameterValueByName(element=type, parameterName=code_block_2)
code_block_3 = CodeBlock { "Dveře"; }
contains = String.Contains(string=getParameterValueByName, searchFor=code_block_3)
filterByBoolMask_3 = List.FilterByBoolMask(list=all_elements_of_category_2, mask=contains)
code_block_4 = CodeBlock { "Podlaží"; }
getParameterValueByName_2 = Element.GetParameterValueByName(element=filterByBoolMask_3.in, parameterName=code_block_4)
string_from_object_3 = FromObject(object=getParameterValueByName_2)
eq_2 = string_from_object_3 == string_from_object_2
filterByBoolMask_4 = List.FilterByBoolMask(list=filterByBoolMask_3.in, mask=eq_2)
element_host = Custom[Element Host](element=filterByBoolMask_4.in)  # package Genius Loci; Gets the host of the element. Unlike the OOTB node FamilyInstance.GetHost, it also works for elements hosted by a linked document, wall sweeps, foundations, railings and builing pads. Based on a Clockwork's node
ꟿ_wall_iscurtainwall = Custom[ꟿ Wall.IsCurtainWall](wall=element_host)  # package spring nodes; Returns true if the wall is a curtain wall.
filterByBoolMask_5 = List.FilterByBoolMask(list=filterByBoolMask_4.in, mask=ꟿ_wall_iscurtainwall)

# group: Generate door surface
getLocation = Element.GetLocation(element=filterByBoolMask_5.out)
YAxis = Vector.YAxis()
ZAxis = Vector.ZAxis()
element_getrotation = Custom[Element GetRotation](element=filterByBoolMask_5.out)  # package Genius Loci; Calculates the rotation angle between the given element and the X axis. Works for point/ line/ sketch based elements and link instances.
rotate = Vector.Rotate(vector=YAxis, axis=ZAxis, degrees=element_getrotation)
code_block_5 = CodeBlock { "Šířka stěny"; }
getParameterValueByName_3 = Element.GetParameterValueByName(element=filterByBoolMask_5.out, parameterName=code_block_5)
code_block_6 = CodeBlock(x=getParameterValueByName_3) { x/2; -x/2; }
translate = Geometry.Translate(geometry=getLocation, direction=rotate, distance=code_block_6.out0)
XAxis = Vector.XAxis()
rotate_2 = Vector.Rotate(vector=XAxis, axis=ZAxis, degrees=element_getrotation)
code_block_7 = CodeBlock { "Hrubá šířka"; }
getParameterValueByName_4 = Element.GetParameterValueByName(element=filterByBoolMask_5.out, parameterName=code_block_7)
code_block_8 = CodeBlock(x=getParameterValueByName_4) { x/2; -x/2; }
translate_2 = Geometry.Translate(geometry=translate, direction=rotate_2, distance=code_block_8.out1)
translate_3 = Geometry.Translate(geometry=translate, direction=rotate_2, distance=code_block_8.out0)
translate_4 = Geometry.Translate(geometry=getLocation, direction=rotate, distance=code_block_6.out1)
translate_5 = Geometry.Translate(geometry=translate_4, direction=rotate_2, distance=code_block_8.out0)
translate_6 = Geometry.Translate(geometry=translate_4, direction=rotate_2, distance=code_block_8.out1)
list_create = List.Create(item0=translate_2, item1=translate_3, item2=translate_5, item3=translate_6)
transpose = List.Transpose(lists=list_create)
byPerimeterPoints = Surface.ByPerimeterPoints(points=transpose)

# group: Sort door surfaces
watch = Watch(filterByBoolMask_5.out)
doors_tofrom = Custom[© Doors.ToFrom](doors=watch)  # package Crumple; Given a door, attempts to return its to and from room properties as well as how many rooms it relates to.
filterByBoolMask_6 = List.FilterByBoolMask(list=watch, mask=doors_tofrom.hasFrom)
doors_tofrom_2 = Custom[© Doors.ToFrom]()  # unwired: doors
groupByFunction = List.GroupByFunction(list=filterByBoolMask_6.in, groupFunction=doors_tofrom_2.fromRoom)
doors_tofrom_3 = Custom[© Doors.ToFrom](doors=groupByFunction@L2)
code_block_9 = CodeBlock { 0; }
getItemAtIndex = List.GetItemAtIndex(list=doors_tofrom_3.fromRoom@L2, index=code_block_9)
filterByBoolMask_7 = List.FilterByBoolMask(list=byPerimeterPoints, mask=doors_tofrom.hasFrom)
indexOf = List.IndexOf(list=filterByBoolMask_6.in, element=groupByFunction)
getItemAtIndex_2 = List.GetItemAtIndex(list=filterByBoolMask_7.in, index=indexOf)
getLocation_2 = Element.GetLocation(element=watch)

# group: Get simple room surfaces
contains_2 = List.Contains(list=filterByBoolMask_2.in@L1, item=getItemAtIndex, lacing=CrossProduct)
anyTrue = List.AnyTrue(list=contains_2@L2)
filterByBoolMask_8 = List.FilterByBoolMask(list=filterByBoolMask_2.in, mask=anyTrue)
geometry = Element.Geometry(element=filterByBoolMask_8.out)
ʳʰʸᵗʰᵐ_rooms_level_2 = Rhythm.Revit.Elements.Rooms.Level(room=filterByBoolMask_8.out)
level_plane = Custom[Level Plane](level=ʳʰʸᵗʰᵐ_rooms_level_2)  # package Genius Loci; Constructs a Plane from a level.
code_block_10 = CodeBlock { "Dolní odsazení"; }
getParameterValueByName_5 = Element.GetParameterValueByName(element=filterByBoolMask_8.out, parameterName=code_block_10)
translate_7 = Geometry.Translate(geometry=level_plane, zTranslation=getParameterValueByName_5)
intersect = Geometry.Intersect(geometry=geometry, other=translate_7)
perimeterCurves = Surface.PerimeterCurves(surface=intersect)

# group: Room surfaces
geometry_2 = Element.Geometry(element=getItemAtIndex)
ʳʰʸᵗʰᵐ_rooms_level_3 = Rhythm.Revit.Elements.Rooms.Level(room=getItemAtIndex)
plane = Custom[Level.Plane](level=ʳʰʸᵗʰᵐ_rooms_level_3)  # package Clockwork for Dynamo 2.x; Retrieves the plane of a given level
code_block_11 = CodeBlock { "Dolní odsazení"; }
getParameterValueByName_6 = Element.GetParameterValueByName(element=getItemAtIndex, parameterName=code_block_11)
translate_8 = Geometry.Translate(geometry=plane, zTranslation=getParameterValueByName_6)
intersect_2 = Geometry.Intersect(geometry=geometry_2, other=translate_8)
byUnion = Surface.ByUnion(surfaces=getItemAtIndex_2)

# group: Join surfaces
flatten = List.Flatten(list=intersect_2)
list_create_2 = List.Create(item0=flatten, item1=byUnion)
transpose_2 = List.Transpose(lists=list_create_2)
isNull = Object.IsNull(object=transpose_2)
anyTrue_2 = List.AnyTrue(list=isNull@L2)
filterByBoolMask_9 = List.FilterByBoolMask(list=getItemAtIndex, mask=anyTrue_2)
filterByBoolMask_10 = List.FilterByBoolMask(list=transpose_2, mask=anyTrue_2)
byUnion_2 = Surface.ByUnion(surfaces=filterByBoolMask_10.out)
isNull_2 = Object.IsNull(object=byUnion_2)
filterByBoolMask_11 = List.FilterByBoolMask(list=filterByBoolMask_9.out, mask=isNull_2)
filterByBoolMask_12 = List.FilterByBoolMask(list=byUnion_2, mask=isNull_2)

# group: Repair surfaces
perimeterCurves_2 = Surface.PerimeterCurves(surface=filterByBoolMask_12.out)
byJoinedCurves = PolyCurve.ByJoinedCurves(curves=perimeterCurves_2)
isNull_3 = Object.IsNull(object=byJoinedCurves)
filterByBoolMask_13 = List.FilterByBoolMask(list=filterByBoolMask_11.out, mask=isNull_3)
filterByBoolMask_14 = List.FilterByBoolMask(list=byJoinedCurves, mask=isNull_3)
code_block_12 = CodeBlock { 10; }
offsetMany = Curve.OffsetMany(curve=filterByBoolMask_14.out, signedDistance=code_block_12)
code_block_13 = CodeBlock { -10; }
offsetMany_2 = Curve.OffsetMany(curve=offsetMany, signedDistance=code_block_13)
curves = PolyCurve.Curves(polyCurve=offsetMany_2)

# group: Generate areas and separators
current_2 = Document.Current()
activeView_2 = Document.ActiveView(document=current_2)
location = Room.Location(room=filterByBoolMask_8.out)
byAreaPlanAndPoint = WombatDynamo.Area.ByAreaPlanAndPoint(areaPlan=activeView_2, point=location)
location_2 = Room.Location(room=filterByBoolMask_13.out)
byAreaPlanAndPoint_2 = WombatDynamo.Area.ByAreaPlanAndPoint(areaPlan=activeView_2, point=location_2)
flatten_2 = List.Flatten(list=perimeterCurves)
sketchPlane = View.SketchPlane(view=activeView_2)
fromCurve = Custom[AreaSeparator.FromCurve](curve=flatten_2, sketchPlane=sketchPlane, areaPlanView=activeView_2)  # package Clockwork for Dynamo 2.x; Creates area separation lines from geometry curves.
flatten_3 = List.Flatten(list=curves)
fromCurve_2 = Custom[AreaSeparator.FromCurve](curve=flatten_3, sketchPlane=sketchPlane, areaPlanView=activeView_2)

# group: Set area parameters
code_block_14 = CodeBlock { "Název"; }
name = Room.Name(room=filterByBoolMask_8.out)
setParameterByName = Element.SetParameterByName(element=byAreaPlanAndPoint, parameterName=code_block_14, value=name)
code_block_15 = CodeBlock { "Číslo"; }
number = Room.Number(room=filterByBoolMask_8.out)
setParameterByName_2 = Element.SetParameterByName(element=byAreaPlanAndPoint, parameterName=code_block_15, value=number)
code_block_16 = CodeBlock { "Číslo"; }
number_2 = Room.Number(room=filterByBoolMask_13.out)
setParameterByName_3 = Element.SetParameterByName(element=byAreaPlanAndPoint_2, parameterName=code_block_16, value=number_2)
code_block_17 = CodeBlock { "Název"; }
name_2 = Room.Name(room=filterByBoolMask_13.out)
setParameterByName_4 = Element.SetParameterByName(element=byAreaPlanAndPoint_2, parameterName=code_block_17, value=name_2)
