# Dynamo graph ROOM VIEWS.dyn (Dynamo 2.16.2.5624)
# packages: Genius Loci 2023.2.21, WombatDynamo 2.3.4, MEPover 2022.10.30

boolean = BoolSelector(true)
getActiveView = WombatDynamo.View.GetActiveView(update=boolean)
list_create = List.Create(item0=getActiveView)
select_model_element = DSModelElementSelection()  # 1 picked in the model
geometry = Element.Geometry(element=select_model_element)
levels = Levels("1.NP")
level_plane = Custom[Level Plane](level=levels)  # package Genius Loci; Constructs a Plane from a level.
intersect = Geometry.Intersect(geometry=geometry, other=level_plane)
outerPerimeterCurves = AnalyticalAutomation.Geometry.Surface.OuterPerimeterCurves(surface=intersect)
code_block = CodeBlock { -100; }
smartOffset = WombatDynamo.Curve.SmartOffset(curve=outerPerimeterCurves, offsetDist=code_block)
curves = PolyCurve.Curves(polyCurve=smartOffset)
flatten = List.Flatten(list=curves)
setCropBoxCurves = Custom[View.SetCropBoxCurves](views=list_create, curves=flatten)  # package MEPover; Input views and lists of curves to set the view crop regions
