# Dynamo graph ROOMS TO CEILINGS.dyn (Dynamo 3.2.1.5366)
# packages: Rhythm 2023.5.5, Crumple 2024.4.3

místnosti = DSModelElementsByCategorySelection("OST_Rooms")  # 1 picked in the model; graph input
finishBoundary = Room.FinishBoundary(room=místnosti)
typ_podhledu = CeilingTypes()  # nothing selected; graph input
ʳʰʸᵗʰᵐ_rooms_level = Rhythm.Revit.Elements.Rooms.Level(room=místnosti)
byOutlineTypeAndLevel = Ceiling.ByOutlineTypeAndLevel(outlineCurves=finishBoundary, ceilingType=typ_podhledu, level=ʳʰʸᵗʰᵐ_rooms_level)  # frozen
code_block = CodeBlock { "Výškové odsazení od podlaží"; }
odsazení_od_podlaží = DoubleInput(3000)  # graph input
setParameterByName = Element.SetParameterByName(element=byOutlineTypeAndLevel, parameterName=code_block, value=odsazení_od_podlaží)
ceilings_create = Custom[© Ceilings.Create](curvelists=finishBoundary, ceilingtypes=typ_podhledu, levels=ʳʰʸᵗʰᵐ_rooms_level)  # package Crumple; A new method unique to Revit 2022 that enables ceilings via the sketch API to support internal loops. Will not work in previous versions, and works best when the curves are in the form of list of lists of curves in continuous order.
watch = Watch(ceilings_create.ceilings)
