# Dynamo graph ROOMS TO MASS BETTER.dyn (Dynamo 2.16.2.5624)
# packages: archi-lab.net 2023.213.1722, spring nodes 210.1.1

select_model_element = DSModelElementSelection()  # 1 picked in the model
select_model_element_2 = DSModelElementSelection()  # 1 picked in the model
list_create = List.Create(item0=select_model_element, item1=select_model_element_2)
flatten = List.Flatten(list=list_create)
faces = archilab.Revit.Elements.Room.Faces(room=flatten)
code_block = CodeBlock { "Neohraničená výška"; }
getParameterValueByName = Element.GetParameterValueByName(element=flatten, parameterName=code_block)
thicken = Surface.Thicken(surface=faces.Bottom, thickness=getParameterValueByName)
flatten_2 = List.Flatten(list=thicken)
byUnion = Solid.ByUnion(solids=flatten_2)
file_path = Filename("..\..\..\ProgramData\Autodesk\RVT 2023\Family Templates\Czech\Koncepční objemy\Objem.rft")
categories = Categories("OST_Mass")
ꟿ_familyinstance_bygeometry = Custom[ꟿ FamilyInstance.ByGeometry](geometry=byUnion, familyTemplatePath=file_path, category=categories)  # package spring nodes; You must provide a valid family template path that will be used for all input geometry objects. The project units(and not the templates) will be used to determine the size of the output geometry. The provided category will be used only if the family template supports it. If not, the default template category will be used instead. Likewise, the family material(provided as a string) will be set only if a material with that name exists in the template. If not, the default material will be used instead ("By Category"). For void cuts, the material settings will be ignored. The Subcategory name is an optional input. If you'd like to skip assigning a Subcategory to any new instance, simply use null. The node expects a unique family name for each geometry object. The rest of the input lists will be processed as if the node lacing is set to longest.; unwired: familyName
