# Dynamo graph ROOMS TO MASS COLORED.dyn (Dynamo 3.2.2.5494)
# packages: Genius Loci 2023.2.21, archi-lab.net 2023.213.1722, Clockwork for Dynamo 2.x 2.4.0

# group: Filter rooms
categories = Categories("OST_Rooms")
all_elements_of_category = ElementsOfCategory(Category=categories)
area = Room.Area(room=all_elements_of_category)
code_block = CodeBlock { 0; }
gt = area > code_block
filterByBoolMask = List.FilterByBoolMask(list=all_elements_of_category, mask=gt)
code_block_2 = CodeBlock { "Oddělení"; }

code_block_3 = CodeBlock { "Fáze"; "Nová konstrukce"; }
getParameterValueByName = Element.GetParameterValueByName(element=filterByBoolMask.in, parameterName=code_block_3.out0)
id = Element.Id(element=getParameterValueByName)
select_phase = RevitPhases("Nová konstrukce")
id_2 = Element.Id(element=select_phase)
eq = id == id_2
filterByBoolMask_2 = List.FilterByBoolMask(list=filterByBoolMask.in, mask=eq)

# group: Get colorfill scheme
element_classes = ElementTypes("ColorFillScheme")
all_elements_of_class = ElementsOfType(element_class=element_classes)
name = Family.Name(family=all_elements_of_class)
code_block_4 = CodeBlock { "Vzorové schéma"; }
eq_2 = name == code_block_4
filterByBoolMask_3 = List.FilterByBoolMask(list=all_elements_of_class, mask=eq_2)
get_colorfill_scheme_properties = Custom[Get ColorFill Scheme Properties](colorFillScheme=filterByBoolMask_3.in)  # package Genius Loci; Works only in Revit 2022 and later. Gets the category, values, colors and fill patterns of the given Color Scheme.

# group: Map colors
getParameterValueByName_2 = Element.GetParameterValueByName(element=filterByBoolMask_2.in, parameterName=code_block_2)
indexOf = List.IndexOf(list=get_colorfill_scheme_properties.Values@L2, element=getParameterValueByName_2)
getItemAtIndex = List.GetItemAtIndex(list=get_colorfill_scheme_properties.Colors@L2, index=indexOf@L2)

# group: Preview geometry
geometry = Element.Geometry(element=filterByBoolMask_2.in)
byGeometryColor = Modifiers.GeometryColor.ByGeometryColor(geometry=geometry, color=getItemAtIndex@L2)

# group: Create materials
material_create = Custom[Material Create](Name=get_colorfill_scheme_properties.Values@L1)  # package Genius Loci; Create new materials or overwrite properties of existing materials. (All graphics inputs are optional)
flatten = List.Flatten(list=get_colorfill_scheme_properties.Colors)
setColor = archilab.Revit.Elements.Materials.SetColor(material=material_create, color=flatten)
passthrough = Custom[Passthrough](passThrough=material_create, waitFor=setColor)  # package Clockwork for Dynamo 2.x; Forces a sequential order of execution. The node wired into the output of the Passthrough node will be executed *after* the node wired into the waitFor input (e.g. important for some Revit operations). The value of the passThrough input will be passed on to the node wired into the output port of the Passthrough node.
getItemAtIndex_2 = List.GetItemAtIndex(list=passthrough@L2, index=indexOf@L2)

# group: Create DirectShape
categories_2 = Categories("OST_Site")
number = Room.Number(room=filterByBoolMask_2.in)
byGeometry = DirectShape.ByGeometry(geometry=geometry@L1, category=categories_2, material=getItemAtIndex_2@L1, name=number@L1)

code_block_5 = CodeBlock { "Označení"; }
setParameterByName = Element.SetParameterByName(element=byGeometry, parameterName=code_block_5, value=number)
