# Dynamo graph Split curtain wall.dyn (Dynamo 2.16.4.10216)
# packages: Rhythm 2024.10.1, archi-lab.net 2025.300.1225

select_model_element = DSModelElementSelection()  # 1 picked in the model
code_block = CodeBlock { "Nepřipojená výška"; }
getParameterValueByName = Element.GetParameterValueByName(element=select_model_element, parameterName=code_block)
code_block_2 = CodeBlock { 1; }
round = Math.Round(number=getParameterValueByName, digits=code_block_2)
code_block_3 = CodeBlock(x=round) { x/7; x-(x/7); }
range = Range(start=code_block_3.out0, end=code_block_3.out1, step=code_block_3.out0)
ʳʰʸᵗʰᵐ_curtaingrid_bywallelement = Rhythm.Revit.Elements.CurtainGrid.ByWallElement(curtainWall=select_model_element)
location = archilab.Revit.Elements.Elements.Location(element=select_model_element)
startPoint = Curve.StartPoint(curve=location.Line)
translate = Geometry.Translate(geometry=location.Line, zTranslation=getParameterValueByName)
startPoint_2 = Curve.StartPoint(curve=translate)
byStartPointEndPoint = Line.ByStartPointEndPoint(startPoint=startPoint, endPoint=startPoint_2)
code_block_4 = CodeBlock()
# ---------- code_block_4.designscript (2 lines) ----------
[1150,
3053,4203,5955,7105,8855];
# ----------------------------------------
code_block_5 = CodeBlock(x=code_block_4) { x+25; x-25; }
list_create = List.Create(item0=code_block_5.out0, item1=code_block_5.out1)
flatten = List.Flatten(list=list_create)
pointAtSegmentLength = Curve.PointAtSegmentLength(curve=byStartPointEndPoint, segmentLength=flatten)
code_block_6 = CodeBlock { true; }
ʳʰʸᵗʰᵐ_curtaingrid = Rhythm.Revit.Elements.CurtainGrid.AddGridLineByPoint(curtainGrid=ʳʰʸᵗʰᵐ_curtaingrid_bywallelement.curtainGrid, locationPoint=pointAtSegmentLength, isUGridline=code_block_6)
count = List.Count(list=ʳʰʸᵗʰᵐ_curtaingrid_bywallelement.vGrids)
