# Dynamo graph TOPO FROM CONTOUR LINES.dyn (Dynamo 2.16.2.5624)
# packages: bimorphNodes 4.2.4

select_model_element = DSModelElementSelection()  # 1 picked in the model
code_block = CodeBlock()
# ---------- code_block.designscript (2 lines) ----------
["Zakladni_vrstevnice",
"Zesilena_vrstevice"];
# ----------------------------------------
curvesFromCADLayers = CAD.CurvesFromCADLayers(importInstance=select_model_element, layerNames=code_block)
flatten = List.Flatten(list=curvesFromCADLayers.Curve)
startPoint = Curve.StartPoint(curve=flatten)
endPoint = Curve.EndPoint(curve=flatten)
list_create = List.Create(item0=startPoint, item1=endPoint)
flatten_2 = List.Flatten(list=list_create)
pruneDuplicates = Point.PruneDuplicates(points=flatten_2)
byPoints = Topography.ByPoints(points=pruneDuplicates)
