# Dynamo graph TOPO FROM LINKED TOPOGRAPHY.dyn (Dynamo 3.3.0.6316)

select_model_element = DSModelElementSelection()  # 1 picked in the model
points = Toposolid.Points(toposolid=select_model_element)
code_block = CodeBlock { "Terénní útvar 1"; }
byName = ToposolidType.ByName(name=code_block)
levels = Levels("1.NP")
byPointsTypeAndLevel = Toposolid.ByPointsTypeAndLevel(points=points, toposolidType=byName, level=levels)
