# Dynamo graph TRANSFER AREA TO ROOMS.dyn (Dynamo 3.3.0.6316)

categories = Categories("OST_Rooms")
all_elements_of_category = ElementsOfCategory(Category=categories)
code_block = CodeBlock { "Číslo"; }
getParameterValueByName = Element.GetParameterValueByName(element=all_elements_of_category, parameterName=code_block)
code_block_2 = CodeBlock { ""; }
eq = getParameterValueByName == code_block_2
filterByBoolMask = List.FilterByBoolMask(list=all_elements_of_category, mask=eq)
filterByBoolMask_2 = List.FilterByBoolMask(list=getParameterValueByName, mask=eq)
categories_2 = Categories("OST_Areas")
all_elements_of_category_2 = ElementsOfCategory(Category=categories_2)
code_block_3 = CodeBlock { "Číslo"; }
getParameterValueByName_2 = Element.GetParameterValueByName(element=all_elements_of_category_2, parameterName=code_block_3)
code_block_4 = CodeBlock { ""; }
eq_2 = getParameterValueByName_2 == code_block_4
filterByBoolMask_3 = List.FilterByBoolMask(list=getParameterValueByName_2, mask=eq_2)
contains = List.Contains(list=filterByBoolMask_2.out, item=filterByBoolMask_3.out, lacing=CrossProduct)
anyTrue = List.AnyTrue(list=contains@L2)
filterByBoolMask_4 = List.FilterByBoolMask(list=filterByBoolMask.out, mask=anyTrue)
code_block_5 = CodeBlock { "Číslo"; }
getParameterValueByName_3 = Element.GetParameterValueByName(parameterName=code_block_5)  # unwired: element
sortByFunction = List.SortByFunction(list=filterByBoolMask_4.in, sortFunction=getParameterValueByName_3)
code_block_6 = CodeBlock { "Plocha místnosti Crestyl"; }
filterByBoolMask_5 = List.FilterByBoolMask(list=all_elements_of_category_2, mask=eq_2)
code_block_7 = CodeBlock { "Číslo"; }
getParameterValueByName_4 = Element.GetParameterValueByName(parameterName=code_block_7)  # unwired: element
sortByFunction_2 = List.SortByFunction(list=filterByBoolMask_5.out, sortFunction=getParameterValueByName_4)
code_block_8 = CodeBlock { "Plocha"; }
getParameterValueByName_5 = Element.GetParameterValueByName(element=sortByFunction_2, parameterName=code_block_8)
setParameterByName = Element.SetParameterByName(element=sortByFunction, parameterName=code_block_6, value=getParameterValueByName_5)
code_block_9 = CodeBlock { "Číslo"; }
getParameterValueByName_6 = Element.GetParameterValueByName(element=filterByBoolMask_4.out, parameterName=code_block_9)
code_block_10 = CodeBlock { "Číslo"; }
getParameterValueByName_7 = Element.GetParameterValueByName(element=sortByFunction, parameterName=code_block_10)
code_block_11 = CodeBlock { "Číslo"; }
getParameterValueByName_8 = Element.GetParameterValueByName(element=sortByFunction_2, parameterName=code_block_11)
eq_3 = getParameterValueByName_7 == getParameterValueByName_8
type = Object.Type(object=getParameterValueByName_5)
