# Dynamo graph TRANSLATE POINTS TO COORDINATE SYSTEM.dyn (Dynamo 2.16.2.5624)

# group: Get rotated coordinate system
XY = Plane.XY()
toCoordinateSystem = Plane.ToCoordinateSystem(plane=XY)
origin = Point.Origin()
ZAxis = Vector.ZAxis()
projectRotation = Coordinates.ProjectRotation()
rotate = CoordinateSystem.Rotate(coordinateSystem=toCoordinateSystem, origin=origin, axis=ZAxis, degrees=projectRotation)

code_block = CodeBlock { 0; }
xyz_points_untranslated = CodeBlock(x=code_block, y=code_block, z=code_block) { x; y; z; }

# group: Get base point parameters
categories = Categories("OST_ProjectBasePoint")
all_elements_of_category = ElementsOfCategory(Category=categories)
lastItem = List.LastItem(list=all_elements_of_category)
code_block_2 = CodeBlock { ["V/Z","S/J","Výška"]; }
getParameterValueByName = Element.GetParameterValueByName(element=lastItem, parameterName=code_block_2, lacing=Longest)
code_block_3 = CodeBlock(X=getParameterValueByName) { X[0]; X[1]; X[2]; }

# group: Translate points
code_block_4 = CodeBlock(x=xyz_points_untranslated.x, vz=code_block_3.out0, y=xyz_points_untranslated.y, SJ=code_block_3.out1, z=xyz_points_untranslated.z, el=code_block_3.out2) { x-vz; y-SJ; z-el; }
byCartesianCoordinates = Point.ByCartesianCoordinates(coordinateSystem=rotate, x=code_block_4.out0, y=code_block_4.out1, z=code_block_4.out2)
