# Dynamo graph USEFULL AREA.dyn "GROSS AREA" (Dynamo 2.16.2.5624)
# packages: DynaMEP 2.0.1, WombatDynamo 2.3.4, Genius Loci 2023.2.21

# group: Output
select_model_element_by_category = DSModelElementByCategorySelection("OST_Rooms")  # 1 picked in the model; graph input
geometry = Element.Geometry(element=select_model_element_by_category)
code_block = CodeBlock { "Podlaží"; }
getParameterValueByName = Element.GetParameterValueByName(element=select_model_element_by_category, parameterName=code_block)

code_block_2 = CodeBlock { "Užitná plocha"; }

# group: Edit
allElementInActiveView = RevitModel.Element.AllElementInActiveView()
getCategory = Element.GetCategory(element=allElementInActiveView)
string_from_object = FromObject(object=getCategory)
code_block_3 = CodeBlock { "Stěny"; }
eq = string_from_object == code_block_3
filterByBoolMask = List.FilterByBoolMask(list=allElementInActiveView, mask=eq)
locationCurve = RevitModel.Element.LocationCurve(element=filterByBoolMask.in)

# group: Background
doesIntersect = Geometry.DoesIntersect(geometry=locationCurve, other=geometry, lacing=Longest)
filterByBoolMask_2 = List.FilterByBoolMask(list=filterByBoolMask.in, mask=doesIntersect)
geometry_2 = Element.Geometry(element=filterByBoolMask_2.in)
flatten = List.Flatten(list=geometry_2)

# group: Output
byName = WombatDynamo.Level.ByName(name=getParameterValueByName)
level_plane = Custom[Level Plane](level=byName)  # package Genius Loci; Constructs a Plane from a level.
code_block_4 = CodeBlock { 500; }
offset = Plane.Offset(plane=level_plane, dist=code_block_4)
intersect = Geometry.Intersect(geometry=geometry, other=offset)
intersect_2 = Geometry.Intersect(geometry=flatten, other=offset)
flatten_2 = List.Flatten(list=intersect_2)

difference = Surface.Difference(surface=intersect, others=flatten_2)
area = Surface.Area(surface=difference)
convert_by_units = DynamoUnitConvert(area, MeasurementType="autodesk.unit.quantity:area-1.0.2", FromConversion="autodesk.unit.unit:squareMillimeters-1.0.1", ToConversion="autodesk.unit.unit:squareMeters-1.0.1")
setParameterByName = Element.SetParameterByName(element=select_model_element_by_category, parameterName=code_block_2, value=convert_by_units)
