# Dynamo graph VORONOI FACADE.dyn (Dynamo 2.16.2.5624)
# packages: spring nodes 210.1.1, Crumple 2022.5.27

select_face = DSFaceSelection()  # 1 picked in the model; graph input
perimeterCurves = Surface.PerimeterCurves(surface=select_face)
startPoint = Curve.StartPoint(curve=perimeterCurves)
endPoint = Curve.EndPoint(curve=perimeterCurves)
list_create = List.Create(item0=startPoint, item1=endPoint)
flatten = List.Flatten(list=list_create)
pruneDuplicates = Point.PruneDuplicates(points=flatten)
Z = Point.Z()  # unwired: point
sortByFunction = List.SortByFunction(list=pruneDuplicates, sortFunction=Z)
code_block = CodeBlock { 2; }
takeItems = List.TakeItems(list=sortByFunction, amount=code_block)

# group: Create symterical sruface
ZAxis = Vector.ZAxis()
ꟿ_list_firstlast = Custom[ꟿ List.FirstLast](list=takeItems)  # package spring nodes; Simple utility node to get both the first and last items of a list as separate outputs. This avoids the unnecessary sublist when using the List.Deconstruct node.
distanceTo = Geometry.DistanceTo(geometry=ꟿ_list_firstlast.first, other=ꟿ_list_firstlast.last)
translate = Geometry.Translate(geometry=takeItems, direction=ZAxis, distance=distanceTo)
reverse = List.Reverse(list=translate)
list_create_2 = List.Create(item0=reverse, item1=takeItems)
flatten_2 = List.Flatten(list=list_create_2)
byCornerPoints = Rectangle.ByCornerPoints(points=flatten_2)
byPatch = Surface.ByPatch(closedCurve=byCornerPoints)

# group: Create random points
amount_of_points = DoubleInput(1300)
extend = DoubleInput(0.1)
code_block_2 = CodeBlock(i=extend) { 0-i; 1+i; }
python_script = Python(IN[0]=amount_of_points, IN[1]=code_block_2.out0, IN[2]=code_block_2.out1)  # CPython3
# ---------- python_script.python (15 lines) ----------
import random

# Inputs from Dynamo
count = IN[0]
min_val = IN[1]
max_val = IN[2]

# Generate list of random numbers within specified range


random_numbers = [random.uniform(min_val, max_val) for _ in range(count)]


# Output to Dynamo
OUT = random_numbers
# ----------------------------------------
python_script_2 = Python(IN[0]=amount_of_points, IN[1]=code_block_2.out0, IN[2]=code_block_2.out1)  # CPython3; same code as python_script
pointAtParameter = Surface.PointAtParameter(surface=byPatch, u=python_script, v=python_script_2, lacing=Longest)

# group: Remove dense points
min_distance_between_points = DoubleInput(500)
python_script_3 = Python(IN[0]=pointAtParameter, IN[1]=min_distance_between_points)  # CPython3
# ---------- python_script_3.python (25 lines) ----------
import clr
clr.AddReference('RevitServices')
from RevitServices.Persistence import DocumentManager
doc = DocumentManager.Instance.CurrentDBDocument

# Inputs: 
# IN[0] = list of XYZ points
# IN[1] = min distance (float)

points = IN[0]
min_dist = IN[1]

accepted = []

def is_too_close(pt, accepted_pts, min_d):
    for other in accepted_pts:
        if pt.DistanceTo(other) < min_d:
            return True
    return False

for pt in points:
    if not is_too_close(pt, accepted, min_dist):
        accepted.append(pt)

OUT = accepted
# ----------------------------------------

# group: Lineary remove higher points
shuffle = List.Shuffle(list=python_script_3)
Z_2 = Point.Z()  # unwired: point
sortByFunction_2 = List.SortByFunction(list=shuffle, sortFunction=Z_2)
index_for_linear_distribution = DoubleInput(2.5)
python_script_4 = Python(IN[0]=sortByFunction_2, IN[1]=index_for_linear_distribution)  # CPython3
# ---------- python_script_4.python (20 lines) ----------
import random

# Inputs
pts = IN[0]  # List of points
steep = IN[1]  # Steepness factor

n = len(pts)
out_pts = []

for i, pt in enumerate(pts):
    # Normalized linear probability
    prob = (i / float(n - 1)) * steep
    prob = min(prob, 1.0)  # Clamp to 1.0
    
    # Random decision
    if random.random() > prob:
        out_pts.append(pt)

# Output
OUT = out_pts
# ----------------------------------------

code_block_3 = CodeBlock { 0; 1; 0.2; }
range = Range(start=code_block_3.out0, end=code_block_3.out1, step=code_block_3.out2)
pointAtParameter_2 = Surface.PointAtParameter(surface=select_face, u=range, lacing=Longest)
code_block_4 = CodeBlock { 0; 1; 0.2; }
range_2 = Range(start=code_block_4.out0, end=code_block_4.out1, step=code_block_4.out2)
code_block_5 = CodeBlock { 1; }
pointAtParameter_3 = Surface.PointAtParameter(surface=select_face, u=range_2, v=code_block_5, lacing=Longest)
list_create_3 = List.Create(item0=pointAtParameter_2, item1=pointAtParameter_3, item2=python_script_4)
flatten_3 = List.Flatten(list=list_create_3)

# group: Create diagram
UVParameterAtPoint = Surface.UVParameterAtPoint(surface=byPatch, point=flatten_3, lacing=Longest)
byParametersOnSurface = Tessellation.Voronoi.ByParametersOnSurface(uvs=UVParameterAtPoint, face=byPatch)

# group: Filter out lines and points outside of surface
doesIntersect = Geometry.DoesIntersect(geometry=select_face, other=python_script_4, lacing=Longest)
filterByBoolMask = List.FilterByBoolMask(list=python_script_4, mask=doesIntersect)
flatten_4 = List.Flatten(list=filterByBoolMask.in)
doesIntersect_2 = Geometry.DoesIntersect(geometry=select_face, other=byParametersOnSurface, lacing=Longest)
filterByBoolMask_2 = List.FilterByBoolMask(list=byParametersOnSurface, mask=doesIntersect_2)
intersect = Geometry.Intersect(geometry=select_face, other=filterByBoolMask_2.in, lacing=Longest)
flatten_5 = List.Flatten(list=intersect)

byCurve = ModelCurve.ByCurve(curve=flatten_5)  # frozen
startPoint_2 = Curve.StartPoint(curve=flatten_5)
endPoint_2 = Curve.EndPoint(curve=flatten_5)
list_create_4 = List.Create(item0=startPoint_2, item1=endPoint_2)
transpose = List.Transpose(lists=list_create_4)
flow_waitfor = Custom[© Flow.WaitFor](data=transpose, waitFor=list_create_4)  # package Crumple; Tells the first input to wait for the second input to arrive, then passes on the first input. Really useful for scripts which have branching paths that rely on their outputs to carry each other forward. Quite a few custom packages have a 'passthrough' or 'waitfor' node. I use these all the time, so find it useful to have them contained in this package also.
family_types = FamilyTypes("#Lano:#Lano")
byPoints = AdaptiveComponent.ByPoints(points=flow_waitfor, familyType=family_types)
