# Dynamo graph Wall by room.dyn (Dynamo 3.3.0.6316)
# packages: Rhythm 2024.10.1, Genius Loci 2024.5.29, WombatDynamo 2.3.5

select_model_element_by_category = DSModelElementByCategorySelection("OST_Rooms")  # 1 picked in the model; graph input
finishBoundary = Room.FinishBoundary(room=select_model_element_by_category)
byJoinedCurves = PolyCurve.ByJoinedCurves(curves=finishBoundary)
wall_types = WallTypes("#Obklad, keramický, 15mm")  # graph input
code_block = CodeBlock { "Šířka"; }
getParameterValueByName = Element.GetParameterValueByName(element=wall_types, parameterName=code_block)
code_block_2 = CodeBlock(x=getParameterValueByName) { -x/2; }
code_block_3 = CodeBlock { 1; }
round = Math.Round(number=code_block_2, digits=code_block_3)
smartOffset = WombatDynamo.Curve.SmartOffset(curve=byJoinedCurves, offsetDist=round)
curves = PolyCurve.Curves(polyCurve=smartOffset)
flatten = List.Flatten(list=curves)
number = DoubleInput(2000)  # graph input
ʳʰʸᵗʰᵐ_rooms_level = Rhythm.Revit.Elements.Rooms.Level(room=select_model_element_by_category)
wall_location = WallLocation("FinishFaceInterior")
wall_bycurveandlevel = Custom[Wall ByCurveAndLevel](curve=flatten, Height=number, level=ʳʰʸᵗʰᵐ_rooms_level, wallType=wall_types, WallLocation=wall_location)  # package Genius Loci; Creates a wall using the specified guiding curve and level.
