# Dynamo graph EXPORT FAMILY TYPES DATA TO XLSX.dyn (Dynamo 2.16.2.5624)
# packages: archi-lab.net 2023.213.1722

file_path = Filename("C:\OneDrive\OneDrive - PFM-Group a.s\Testing\Lprofil.xlsx")
code_block = CodeBlock { "List1"; }
code_block_2 = CodeBlock { 0; 0; }
select_model_element = DSModelElementSelection()  # 1 picked in the model
type = archilab.Revit.Elements.Elements.Type(element=select_model_element)
family = FamilyType.Family(familyType=type)
types = Family.Types(family=family)
code_block_3 = CodeBlock { ["Plocha průřezu","Šířka","Výška","Tloušťka příruby","Tloušťka stojiny","Zaoblení příruby","Zaoblení stojiny","Horizontální těžiště","Vertikální těžiště"]; }
getParameterValueByName = Element.GetParameterValueByName(element=types@L2, parameterName=code_block_3, lacing=Longest)
code_block_4 = CodeBlock { "Název typu"; }
getParameterValueByName_2 = Element.GetParameterValueByName(element=types, parameterName=code_block_4, lacing=Longest)
code_block_5 = CodeBlock { 0; }
insert = List.Insert(list=getParameterValueByName, element=getParameterValueByName_2, index=code_block_5)
transpose = List.Transpose(lists=insert)
code_block_6 = CodeBlock { "Název typu"; }
insert_2 = List.Insert(list=code_block_3, element=code_block_6, index=code_block_5)
insert_3 = List.Insert(list=transpose, element=insert_2, index=code_block_5)
code_block_7 = CodeBlock { true; }
exportToExcel = Data.ExportToExcel(filePath=file_path, sheetName=code_block, startRow=code_block_2.out0, startColumn=code_block_2.out1, data=insert_3, overWrite=code_block_7)
