# Dynamo graph EXPORT GROUPS WITH EXCLUDED ELEMENTS.dyn (Dynamo 2.16.2.5624)

file_path = Filename("C:\Users\dvoracek\Downloads\Nový Textový dokument.txt")
code_block = CodeBlock { "; "; }
categories = Categories("OST_IOSModelGroups")
all_elements_of_category = ElementsOfCategory(Category=categories)
name = Family.Name(family=all_elements_of_category)
code_block_2 = CodeBlock { "vyloučené prvky"; }
contains = String.Contains(string=name, searchFor=code_block_2)
filterByBoolMask = List.FilterByBoolMask(list=all_elements_of_category, mask=contains)
id = Element.Id(element=filterByBoolMask.in)
string_from_object = FromObject(object=id)
join = String.Join(separator=code_block, string0=string_from_object)
exportCSV = Data.ExportCSV(filePath=file_path, data=join)
