# Dynamo graph EXPORT SCHEDULES.dyn (Dynamo 2.16.1.2727)
# packages: archi-lab.net 2023.213.1722, Data-Shapes 2022.2.106

code_block = CodeBlock { "Export do csv"; "Spustit"; "Zrušit"; }
code_block_2 = CodeBlock { "Cesta"; "Napiš cestu"; }
textbox_data = Custom[TextBox Data](InputName=code_block_2.out0, DefaultText=code_block_2.out1)  # package Data-Shapes; Create Data for TextBox input in UI.MultipleInputForm ++ . Check out www.data-shapes.net for more informations
code_block_3 = CodeBlock { "Výkazy k exportu"; }
view_type = ViewTypesUi("Schedule")
getByType = archilab.Revit.Views.Views.GetByType(viewType=view_type)
treeview_input = Custom[TreeView input](InputName=code_block_3, Data=getByType)  # package Data-Shapes; Create a TreeView input for UI.MultipleInputForm ++ . Check out www.data-shapes.net for more infos and tips!
list_create = List.Create(item0=textbox_data, item1=treeview_input)
boolean = BoolSelector(true)
code_block_4 = CodeBlock { 800; }
multipleinputform = Custom[MultipleInputForm ++](Description_optional=code_block.out0, ButtonText_optional=code_block.out1, Inputs=list_create, Toggle=boolean, CancelButtonText_optional=code_block.out2, Width_optional=code_block_4)  # package Data-Shapes; Create a form with multiple inputs. see www.data-shapes.net for tutorials and infos!
code_block_5 = CodeBlock { 0; 1; }
getItemAtIndex = List.GetItemAtIndex(list=multipleinputform.User_Inputs, index=code_block_5.out1)
getItemAtIndex_2 = List.GetItemAtIndex(list=multipleinputform.User_Inputs, index=code_block_5.out0)
string = StringInput("\")
add = getItemAtIndex_2 + string
string_from_object = FromObject(object=getItemAtIndex)
code_block_6 = CodeBlock { 0; 20; }
remove = String.Remove(string=string_from_object, startIndex=code_block_6.out0, count=code_block_6.out1)
add_2 = add + remove
code_block_7 = CodeBlock { ".csv"; }
add_3 = add_2 + code_block_7
string_2 = StringInput(";")
boolean_2 = BoolSelector(true)
byProperties = Revit.Schedules.ScheduleExportOptions.ByProperties(fieldDelimiter=string_2, headersFootersBlanks=boolean_2, title=boolean_2)
export = ScheduleView.Export(scheduleView=getItemAtIndex, path=add_3, exportOptions=byProperties)
