# Dynamo graph EXPORT VIEWS TO JPG.dyn (Dynamo 2.16.2.5624)
# packages: archi-lab.net 2023.213.1722, Rhythm 2023.2.2

categories = Categories("OST_Views")
all_elements_of_category = ElementsOfCategory(Category=categories)
clear_list = Custom[Clear List](input=all_elements_of_category)  # package archi-lab.net; This node will remove all Null and Empty Lists from any list.
elementType = Element.ElementType(element=clear_list)
name = Element.Name(element=elementType)
viewFamilyTypes = ViewFamilyTypes("Půdorys místnosti")
name_2 = Element.Name(element=viewFamilyTypes)
eq = name == name_2  # lacing=Longest
filterByBoolMask = List.FilterByBoolMask(list=clear_list, mask=eq)
directory_path = Directory("C:\OneDrive\OneDrive - PFM-Group a.s\Testing\Images")
string = StringInput("\")
name_3 = Element.Name(element=filterByBoolMask.in)
code_block = CodeBlock(path=directory_path, str=string, name=name_3) { out = path + str + name + ".jpg"; }
exportAsImage = View.ExportAsImage(view=filterByBoolMask.in, path=code_block)
