# Dynamo graph ROOMBOOK.dyn (Dynamo 2.16.2.5624)

# group: Filter rooms
categories = Categories("OST_Rooms")
all_elements_of_category = ElementsOfCategory(Category=categories)
code_block = CodeBlock { "Oddělení"; }
getParameterValueByName = Element.GetParameterValueByName(element=all_elements_of_category, parameterName=code_block)
code_block_2 = CodeBlock { "Blok C"; }
eq = getParameterValueByName == code_block_2
filterByBoolMask = List.FilterByBoolMask(list=all_elements_of_category, mask=eq)
code_block_3 = CodeBlock { "Podlaží"; }
getParameterValueByName_2 = Element.GetParameterValueByName(element=filterByBoolMask.in, parameterName=code_block_3)
code_block_4 = CodeBlock { "2.NP"; }
eq_2 = getParameterValueByName_2 == code_block_4
filterByBoolMask_2 = List.FilterByBoolMask(list=filterByBoolMask.in, mask=eq_2)
code_block_5 = CodeBlock { "Plocha"; }
getParameterValueByName_3 = Element.GetParameterValueByName(element=filterByBoolMask_2.in, parameterName=code_block_5)
code_block_6 = CodeBlock { 0; }
gt = getParameterValueByName_3 > code_block_6
isNull = Object.IsNull(object=gt)
filterByBoolMask_3 = List.FilterByBoolMask(list=filterByBoolMask_2.in, mask=isNull)

# group: Get parameter values
code_block_7 = CodeBlock { "Číslo"; "Název"; "Plocha"; "Oddělení"; }
getParameterValueByName_4 = Element.GetParameterValueByName(element=filterByBoolMask_3.out, parameterName=code_block_7.out0)
getParameterValueByName_5 = Element.GetParameterValueByName(element=filterByBoolMask_3.out, parameterName=code_block_7.out3)
getParameterValueByName_6 = Element.GetParameterValueByName(element=filterByBoolMask_3.out, parameterName=code_block_7.out2)
getParameterValueByName_7 = Element.GetParameterValueByName(element=filterByBoolMask_3.out, parameterName=code_block_7.out1)

# group: Edit room area string
code_block_8 = CodeBlock { 1; }
round = Math.Round(number=getParameterValueByName_6, digits=code_block_8)
string_from_object = FromObject(object=round)
code_block_9 = CodeBlock { "."; ","; }
replace = String.Replace(string=string_from_object, searchFor=code_block_9.out0, replaceWith=code_block_9.out1)
code_block_10 = CodeBlock { -1; -5; }
remove = String.Remove(string=replace, startIndex=code_block_10.out0, count=code_block_10.out1)

# group: Export to excel
file_path = Filename("..\..\..\..\..\Users\dvoracek\DC\ACCDocs\Atelier 99 s.r.o-\PřF-UPOL - Novostavba objektu F1\Project Files\006_DOKUMENTY\02_KNIHA MÍSTNOSTÍ\UPOL_F1_Kniha_mistnosti_SO01_2NP.xlsx")  # graph input
code_block_11 = CodeBlock { 4; 8; }
exportToExcel = Data.ExportToExcel(filePath=file_path, sheetName=getParameterValueByName_4@L1, startRow=code_block_11.out0, startColumn=code_block_11.out1, data=getParameterValueByName_5@L1, lacing=Longest)
code_block_12 = CodeBlock { 0; 6; }
exportToExcel_2 = Data.ExportToExcel(filePath=file_path, sheetName=getParameterValueByName_4@L1, startRow=code_block_12.out0, startColumn=code_block_12.out1, data=getParameterValueByName_4@L1, lacing=Longest)
code_block_13 = CodeBlock { 5; 8; }
exportToExcel_3 = Data.ExportToExcel(filePath=file_path, sheetName=getParameterValueByName_4@L1, startRow=code_block_13.out0, startColumn=code_block_13.out1, data=remove@L1, lacing=Longest)
code_block_14 = CodeBlock { 0; 7; }
exportToExcel_4 = Data.ExportToExcel(filePath=file_path, sheetName=getParameterValueByName_4@L1, startRow=code_block_14.out0, startColumn=code_block_14.out1, data=getParameterValueByName_7@L1, lacing=Longest)
