# Dynamo graph GET HIDDEN ELEMENTS ID.dyn (Dynamo 2.16.2.5624)
# packages: archi-lab.net 2023.213.1722, Genius Loci 2023.2.21, WombatDynamo 2.3.4

select_phase = RevitPhases("Nová konstrukce")  # graph input
all_elements_at_phase = Custom[All Elements at Phase](phase=select_phase)  # package Genius Loci; Collect all elements at a given phase.
code_block = CodeBlock { true; }
getActiveView = WombatDynamo.View.GetActiveView(update=code_block)
isHidden = archilab.Revit.Elements.Elements.IsHidden(element=all_elements_at_phase, view=getActiveView)
filterByBoolMask = List.FilterByBoolMask(list=all_elements_at_phase, mask=isHidden)
id = Element.Id(element=filterByBoolMask.in)  # graph output
