# Dynamo graph APPEND EQUAL NAMES.dyn (Dynamo 2.16.2.5624)
# packages: archi-lab.net 2023.213.1722

code_block = CodeBlock { ["N1.1 N2 - V.","CHUC B2 - III.","CHUC B1 - III."]; }
categories = Categories("OST_Mass")
byCategory = archilab.Revit.Selection.Select.ByCategory(category=categories)
getFamily = FamilyInstance.GetFamily(familyInstance=byCategory)
name = Family.Name(family=getFamily)
eq = code_block == name  # lacing=CrossProduct
anyTrue = List.AnyTrue(list=eq@L2)
code_block_2 = CodeBlock { "*"; }
add = code_block + code_block_2
if_ = RefactoredIf(test=anyTrue@L1, true=add@L1, false=code_block@L1)
