# Dynamo graph CREATE CIRCLES FROM CSV.dyn (Dynamo 3.2.2.5494)
# packages: Crumple 2024.4.3

code_block = CodeBlock { 0; 1000; }
byCoordinates = Point.ByCoordinates(x=code_block.out0, y=code_block.out0)
byCoordinates_2 = Point.ByCoordinates(x=code_block.out0, y=code_block.out1)
byCoordinates_3 = Point.ByCoordinates(x=code_block.out1, y=code_block.out1)
byCoordinates_4 = Point.ByCoordinates(x=code_block.out1, y=code_block.out0)
list_create = List.Create(item0=byCoordinates, item1=byCoordinates_2, item2=byCoordinates_3, item3=byCoordinates_4)
code_block_2 = CodeBlock { 1; }
shiftIndices = List.ShiftIndices(list=list_create, amount=code_block_2)
byStartPointEndPoint = Line.ByStartPointEndPoint(startPoint=shiftIndices, endPoint=list_create)
byJoinedCurves = PolyCurve.ByJoinedCurves(curves=byStartPointEndPoint)
byPatch = Surface.ByPatch(closedCurve=byJoinedCurves)
area = Surface.Area(surface=byPatch)
file_path = Filename("C:\Users\dvoracek\Downloads\souradnice_kruhu (4).csv")
csv_import = Custom[© CSV.Import](filePath=file_path)  # package Crumple; Attempts to read a CSV file path.
code_block_3 = CodeBlock { 0; }
removeItemAtIndex = List.RemoveItemAtIndex(list=csv_import.dataRows, indices=code_block_3)
code_block_4 = CodeBlock { 1; 2; }
getItemAtIndex = List.GetItemAtIndex(list=removeItemAtIndex@L2, index=code_block_4.out0)
toNumber = String.ToNumber(string=getItemAtIndex)
getItemAtIndex_2 = List.GetItemAtIndex(list=removeItemAtIndex@L2, index=code_block_4.out1)
toNumber_2 = String.ToNumber(string=getItemAtIndex_2)
byCoordinates_5 = Point.ByCoordinates(x=toNumber, y=toNumber_2)
code_block_5 = CodeBlock { 30; }
byCenterPointRadius = Circle.ByCenterPointRadius(centerPoint=byCoordinates_5, radius=code_block_5)
byPatch_2 = Surface.ByPatch(closedCurve=byCenterPointRadius)
byUnion = Surface.ByUnion(surfaces=byPatch_2)
area_2 = Surface.Area(surface=byUnion)
