# Dynamo graph CREATE FAMILY TYPES FROM EXCEL.dyn (Dynamo 2.16.1.2727)

code_block = CodeBlock { ["délka", "šířka"]; }
code_block_2 = CodeBlock { [100,200]; }
byKeysValues = DesignScript.Builtin.Dictionary.ByKeysValues(keys=code_block, values=code_block_2)
code_block_3 = CodeBlock { "šířka"; }
valueAtKey = DesignScript.Builtin.Dictionary.ValueAtKey(dictionary=byKeysValues, key=code_block_3)
family_types = FamilyTypes("#Překlad, pravoúhlý:Keramický, nosný, 3250x70x238")
file_path = Filename("C:\Users\dvoracek\Downloads\Tabulka překladů (1).xlsx")
file_from_path = FileObject(path=file_path)
code_block_4 = CodeBlock { "Nosné překlady"; }
boolean = BoolSelector(false)
importExcel = Data.ImportExcel(file=file_from_path, sheetName=code_block_4, readAsStrings=boolean, showExcel=boolean)
code_block_5 = CodeBlock { 1; }
dropItems = List.DropItems(list=importExcel, amount=code_block_5)
code_block_6 = CodeBlock(a=dropItems) { a==null ? false : true; }
filterByBoolMask = List.FilterByBoolMask(list=dropItems, mask=code_block_6)
transpose = List.Transpose(lists=filterByBoolMask.in)
code_block_7 = CodeBlock { 6; }
dropEveryNthItem = List.DropEveryNthItem(list=transpose, n=code_block_7)
code_block_8 = CodeBlock { 0; 1; 2; 3; 4; 5; }
getItemAtIndex = List.GetItemAtIndex(list=dropEveryNthItem, index=code_block_8.out0)
duplicate = ElementType.Duplicate(elementType=family_types, name=getItemAtIndex)  # frozen
code_block_9 = CodeBlock { "Délka překladu"; "Šířka překladu"; "Výška překladu"; "Minimální délka uložení"; "Popis"; }
getItemAtIndex_2 = List.GetItemAtIndex(list=dropEveryNthItem, index=code_block_8.out1)
setParameterByName = Element.SetParameterByName(element=duplicate, parameterName=code_block_9.out0, value=getItemAtIndex_2)
getItemAtIndex_3 = List.GetItemAtIndex(list=dropEveryNthItem, index=code_block_8.out2)
setParameterByName_2 = Element.SetParameterByName(element=setParameterByName, parameterName=code_block_9.out1, value=getItemAtIndex_3)
getItemAtIndex_4 = List.GetItemAtIndex(list=dropEveryNthItem, index=code_block_8.out3)
setParameterByName_3 = Element.SetParameterByName(element=setParameterByName_2, parameterName=code_block_9.out2, value=getItemAtIndex_4)
getItemAtIndex_5 = List.GetItemAtIndex(list=dropEveryNthItem, index=code_block_8.out4)
setParameterByName_4 = Element.SetParameterByName(element=setParameterByName_3, parameterName=code_block_9.out3, value=getItemAtIndex_5)
getItemAtIndex_6 = List.GetItemAtIndex(list=dropEveryNthItem, index=code_block_8.out5)
setParameterByName_5 = Element.SetParameterByName(element=setParameterByName_3, parameterName=code_block_9.out4, value=getItemAtIndex_6)
