# Dynamo graph EXPORT FAMILY NAMES AND CATEGORIES.dyn (Dynamo 2.6.2.15705)
# packages: Clockwork for Dynamo 2.x 2.4.0

file_path = Filename(".\názvy rodin a jejich kategorie.xlsx")
code_block = CodeBlock { "List1"; 0; 0; }
element_types = ElementTypes("Family")
all_elements_of_type = ElementsOfType(element_type=element_types)
category = Custom[Element.Category+](element=all_elements_of_type)  # package Clockwork for Dynamo 2.x; Returns the category of a given element. Unlike the OOTB node Element.GetCategory, it will work for subcategories, families, family documents, schedules, graphics styles and view filters as well.
string_from_object = FromObject(obj=all_elements_of_type)
code_block_2 = CodeBlock { "Family: "; ""; }
replace = String.Replace(str=string_from_object, searchFor=code_block_2.out0, replaceWith=code_block_2.out1)
list_create = List.Create(item0=category.category, item1=replace)
transpose = List.Transpose(lists=list_create)
code_block_3 = CodeBlock { "true"; }
exportExcel = Data.ExportExcel(filePath=file_path, sheetName=code_block.out0, startRow=code_block.out1, startCol=code_block.out2, data=transpose, overWrite=code_block_3)
