# Dynamo graph FAMILY TYPES FROM EXCEL.dyn (Dynamo 2.16.2.5624)
# packages: archi-lab.net 2023.213.1722

# group: Get types
select_model_element = DSModelElementSelection()  # 1 picked in the model
type = archilab.Revit.Elements.Elements.Type(element=select_model_element)
family = FamilyType.Family(familyType=type)
types = Family.Types(family=family)

code_block = CodeBlock { "Zaoblení stojiny"; }

# group: Excel
file_path = Filename("C:\OneDrive\OneDrive - PFM-Group a.s\Testing\Lprofil.xlsx")
file_from_path = FileObject(path=file_path)
code_block_2 = CodeBlock { "List1"; }
importExcel = Data.ImportExcel(file=file_from_path, sheetName=code_block_2)

# group: Filter parameters
transpose = List.Transpose(lists=importExcel)
code_block_3 = CodeBlock { 1; }
dropItems = List.DropItems(list=transpose@L2, amount=code_block_3)
dropItems_2 = List.DropItems(list=dropItems@L3, amount=code_block_3)
code_block_4 = CodeBlock { 1; }
flatten = List.Flatten(list=dropItems_2, amount=code_block_4)
code_block_5 = CodeBlock { 5; }
getItemAtIndex = List.GetItemAtIndex(list=flatten, index=code_block_5)

setParameterByName = Element.SetParameterByName(element=types, parameterName=code_block, value=getItemAtIndex)  # frozen
code_block_6 = CodeBlock { 0; }
getItemAtIndex_2 = List.GetItemAtIndex(list=importExcel, index=code_block_6)
code_block_7 = CodeBlock { 1; }
dropItems_3 = List.DropItems(list=getItemAtIndex_2, amount=code_block_7)
location = FamilyInstance.Location(familyInstance=select_model_element)
YAxis = Vector.YAxis()
reverse = Vector.Reverse(vector=YAxis)
code_block_8 = CodeBlock { 0; 500; }
count = List.Count(list=types)
sequence = Sequence(start=code_block_8.out0, amount=count, step=code_block_8.out1)
translate = Geometry.Translate(geometry=location, direction=reverse, distance=sequence)
byPoint = FamilyInstance.ByPoint(familyType=types, point=translate)
