# Dynamo graph IMPORT MATERIALS FROM EXCEL.dyn (Dynamo 2.16.1.2727)
# packages: Genius Loci 2023.2.21, archi-lab.net 2023.213.1722, Crumple 2022.5.27

# group: Import z excelu
file_path = Filename("..\..\PFM-Group a.s\BIM - General\01 - Container\Materiály a vzorové skladby\šabloná materiálů.xlsx")  # graph input
custom_selection = CustomSelection("Zdivo", items={Zdivo: "Zdivo", Betonové konstrukce: "Betonové konstrukce", Dlažby: "Dlažby", Zeminy, štěrky, písky: "Zeminy, štěrky, písky", Nezařazeno: "Nezařazeno", Nátěry: "Nátěry", Hydroizolace: "Hydroizolace", Izolace: "Izolace", Plasty: "Plasty", Kovy: "Kovy", Dřevo: "Dřevo", Omítky: "Omítky"})  # graph input

excel_import = Custom[© Excel.Import](filePath=file_path, sheetName=custom_selection)  # package Crumple; Imports a 2D matrix of data from an existing Excel file path from a given worksheet name. If a worksheet does not exist by that name it will take the data from the first worksheet instead. Credit to Cyril Poupin for most of the Python code (details in node body).
code_block = CodeBlock { 1; }
dropItems = List.DropItems(list=excel_import.dataRows, amount=code_block)
transpose = List.Transpose(lists=dropItems)
code_block_2 = CodeBlock { 0; 1; 2; 3; 4; 5; 6; }

# group: Název materiálu
code_block_3 = CodeBlock { "#"; }
název = List.GetItemAtIndex(list=transpose, index=code_block_2.out0)
add = code_block_3 + název

# group: Přepsání/Vytvoření
create = archilab.Revit.Elements.Materials.Create(name=add)
byName = Material.ByName()  # frozen; unwired: name

třída = List.GetItemAtIndex(list=transpose, index=code_block_2.out4)
material_set_class = Custom[Material Set Class](material=create, className=třída)  # package Genius Loci; Set the material class name (Visible in the Identity tab).

# group: RGB
barva = List.GetItemAtIndex(list=transpose, index=code_block_2.out3)
code_block_4 = CodeBlock { ","; }
split = String.Split(string=barva, separator0=code_block_4)
flatten = List.Flatten(list=split)
code_block_5 = CodeBlock { 3; 1; }
takeEveryNthItem = List.TakeEveryNthItem(list=flatten, n=code_block_5.out0, offset=code_block_5.out1)
toNumber = String.ToNumber(string=takeEveryNthItem)
code_block_6 = CodeBlock { 3; 2; }
takeEveryNthItem_2 = List.TakeEveryNthItem(list=flatten, n=code_block_6.out0, offset=code_block_6.out1)
toNumber_2 = String.ToNumber(string=takeEveryNthItem_2)
takeEveryNthItem_3 = List.TakeEveryNthItem(list=flatten, n=code_block_6.out0)
toNumber_3 = String.ToNumber(string=takeEveryNthItem_3)
byARGB = Color.ByARGB(red=toNumber, green=toNumber_2, blue=toNumber_3)

# group: Vytvoření šrafy povrchu v popředí
šrafa = List.GetItemAtIndex(list=transpose, index=code_block_2.out5)
code_block_7 = CodeBlock { null; }
fill_pattern_target = FillPatternTargetUi("Drafting")
fill_pattern = Custom[Fill Pattern](name=šrafa@L1, draftingOrModeling=fill_pattern_target)  # package archi-lab.net; Get Fill Pattern by Name
code_block_8 = CodeBlock(a=šrafa, b=code_block_7, c=fill_pattern) { a==null ? b : c; }

# group: Vytvoření barev
barva_2 = List.GetItemAtIndex(list=transpose, index=code_block_2.out6)
code_block_9 = CodeBlock { ","; }
split_2 = String.Split(string=barva_2, separator0=code_block_9)
flatten_2 = List.Flatten(list=split_2)
code_block_10 = CodeBlock { 3; 1; }
takeEveryNthItem_4 = List.TakeEveryNthItem(list=flatten_2, n=code_block_10.out0, offset=code_block_10.out1)
toNumber_4 = String.ToNumber(string=takeEveryNthItem_4)
code_block_11 = CodeBlock { 3; 2; }
takeEveryNthItem_5 = List.TakeEveryNthItem(list=flatten_2, n=code_block_11.out0, offset=code_block_11.out1)
toNumber_5 = String.ToNumber(string=takeEveryNthItem_5)
takeEveryNthItem_6 = List.TakeEveryNthItem(list=flatten_2, n=code_block_11.out0)
toNumber_6 = String.ToNumber(string=takeEveryNthItem_6)
byARGB_2 = Color.ByARGB(red=toNumber_4, green=toNumber_5, blue=toNumber_6)

# group: Šrafa v řezu
šrafa_2 = List.GetItemAtIndex(list=transpose, index=code_block_2.out1)
code_block_12 = CodeBlock { null; }
fill_pattern_target_2 = FillPatternTargetUi("Drafting")
fill_pattern_2 = Custom[Fill Pattern](name=šrafa_2@L1, draftingOrModeling=fill_pattern_target_2)
code_block_13 = CodeBlock(a=šrafa_2, b=code_block_12, c=fill_pattern_2) { a==null ? b : c; }

# group: Šrafa v řezu v pozadí
podbarvení = List.GetItemAtIndex(list=transpose, index=code_block_2.out2)
code_block_14 = CodeBlock { ","; }
split_3 = String.Split(string=podbarvení, separator0=code_block_14)
code_block_15 = CodeBlock { 0; 1; 2; }
getItemAtIndex = List.GetItemAtIndex(index=code_block_15.out0)  # unwired: list
map = List.Map(list=split_3, function=getItemAtIndex)
toNumber_7 = String.ToNumber(string=map)
getItemAtIndex_2 = List.GetItemAtIndex(index=code_block_15.out2)  # unwired: list
map_2 = List.Map(list=split_3, function=getItemAtIndex_2)
toNumber_8 = String.ToNumber(string=map_2)
getItemAtIndex_3 = List.GetItemAtIndex(index=code_block_15.out1)  # unwired: list
map_3 = List.Map(list=split_3, function=getItemAtIndex_3)
toNumber_9 = String.ToNumber(string=map_3)
byARGB_3 = Color.ByARGB(red=toNumber_7, green=toNumber_8, blue=toNumber_9)
code_block_16 = CodeBlock { null; }
code_block_17 = CodeBlock { "<Plná výplň>"; }
fill_pattern_target_3 = FillPatternTargetUi("Drafting")
fill_pattern_3 = Custom[Fill Pattern](name=code_block_17, draftingOrModeling=fill_pattern_target_3)
code_block_18 = CodeBlock(a=byARGB_3, b=code_block_16, c=fill_pattern_3) { a==null ? b : c; }

material_set_properties = Custom[Material Set Properties](material=create, color=byARGB, SurfaceForegroundPattern=code_block_8, SurfaceForegroundPatternColor=byARGB_2, CutForegroundPattern=code_block_13, CutBackgroundPattern=code_block_18, CutBackgroundPatternColor=byARGB_3)  # package Genius Loci; Set the color, transparency, SurfaceForeground, SurfaceBackground, CutForeground and CutBackground patterns from the given material. Note : Prior to Revit 2019, the materials have only one surface pattern and one cut pattern. (All inputs are optional)
