# Dynamo graph PBR FROM CAD.dyn (Dynamo 2.16.2.5624)
# packages: bimorphNodes 4.2.4, DynamoMEP 1.0.3, Genius Loci 2023.2.21, WombatDynamo 2.3.4, spring nodes 210.1.1, Clockwork for Dynamo 2.x 2.4.0, archi-lab.net 2023.213.1722, Data-Shapes 2022.2.106, Crumple 2022.5.27

# group: Inputs
code_block = CodeBlock { "Vytvoření požárních úseků podle dwg"; "Spustit"; "Zrušit"; 300; 200; }
code_block_2 = CodeBlock { "Název hladiny názvu PU"; "_PO_popis"; }
textbox_data = Custom[TextBox Data](InputName=code_block_2.out0, DefaultText=code_block_2.out1)  # package Data-Shapes; Create Data for TextBox input in UI.MultipleInputForm ++ . Check out www.data-shapes.net for more informations
code_block_3 = CodeBlock { "Část názvu hladiny"; "hranice"; }
textbox_data_2 = Custom[TextBox Data](InputName=code_block_3.out0, DefaultText=code_block_3.out1)
code_block_4 = CodeBlock { "Výběr spodního podlaží"; }
categories = Categories("OST_Levels")
all_elements_of_category = ElementsOfCategory(Category=categories)
name = Level.Name(level=all_elements_of_category)
treeview_input = Custom[TreeView input](InputName=code_block_4, Data=name)  # package Data-Shapes; Create a TreeView input for UI.MultipleInputForm ++ . Check out www.data-shapes.net for more infos and tips!
code_block_5 = CodeBlock { "Výběr horního podlaží"; }
code_block_6 = CodeBlock { "Materiál PU"; }
categories_2 = Categories("OST_Materials")
all_elements_of_category_2 = ElementsOfCategory(Category=categories_2)
name_2 = Material.Name(material=all_elements_of_category_2)
dropdown_data = Custom[DropDown Data](InputName=code_block_6, Keys=name_2, Values=name_2)  # package Data-Shapes; Create data for DropDown input in UI.MultiInputForm ++ . Check out www.data-shapes.net for more infos.
code_block_7 = CodeBlock { "Vyber dwg v půdorysu"; }
code_block_8 = CodeBlock { "Vybrat"; }
boolean = BoolSelector(true)
selectmodelelements_data = Custom[SelectModelElements Data](InputName=code_block_7, ButtonText=code_block_8, SelectSingleElement=boolean)  # package Data-Shapes; Creates a Revit element selection input for UI.MultipleInputForm++ . Check out www.data-shapes.net for more infos!
boolean_2 = BoolSelector(true)

categories_3 = Categories("OST_Levels")
all_elements_of_category_3 = ElementsOfCategory(Category=categories_3)
name_3 = Level.Name(level=all_elements_of_category_3)
treeview_input_2 = Custom[TreeView input](InputName=code_block_5, Data=name_3)

# group (continued): Inputs
list_create = List.Create(item0=textbox_data, item1=textbox_data_2, item2=treeview_input, item3=treeview_input_2, item4=dropdown_data, item5=selectmodelelements_data)
multipleinputform = Custom[MultipleInputForm ++](Description_optional=code_block.out0, ButtonText_optional=code_block.out1, Inputs=list_create, Toggle=boolean_2, CancelButtonText_optional=code_block.out2, Width_optional=code_block.out3, LabelWidth_optional=code_block.out4)  # package Data-Shapes; Create a form with multiple inputs. see www.data-shapes.net for tutorials and infos!

code_block_9 = CodeBlock { 0; 1; 2; 3; 4; 5; }
bottom_level = List.GetItemAtIndex(list=multipleinputform.User_Inputs, index=code_block_9.out2)

# group: Area view
level_byname = Custom[Level ByName](name=bottom_level)  # package Genius Loci; Collects Levels by name in the active or given document.
byLevel = WombatDynamo.AreaPlanView.ByLevel(level=level_byname)
id = Element.Id(element=byLevel)
element_by_id = ElementById(Id=id)

selected_dwg = List.GetItemAtIndex(list=multipleinputform.User_Inputs, index=code_block_9.out5)
text_layer = List.GetItemAtIndex(list=multipleinputform.User_Inputs, index=code_block_9.out0)

# group: CAD text
fromLayers = CADTextData.FromLayers(importInstance=selected_dwg, layerNames=text_layer)
height = CADTextData.Height(cADTextData=fromLayers.CADTextData)
code_block_10 = CodeBlock { 400; }
gt = height > code_block_10
filterByBoolMask = List.FilterByBoolMask(list=fromLayers.CADTextData, mask=gt)
originPoint = CADTextData.OriginPoint(cADTextData=filterByBoolMask.in)
textValue = CADTextData.TextValue(cADTextData=filterByBoolMask.in)
flatten = List.Flatten(list=textValue)
code_block_11 = CodeBlock { "/"; " "; }
replace = String.Replace(string=flatten, searchFor=code_block_11.out0, replaceWith=code_block_11.out1)
flatten_2 = List.Flatten(list=replace)
add = flatten_2 + bottom_level  # lacing=Longest

boundary_layer = List.GetItemAtIndex(list=multipleinputform.User_Inputs, index=code_block_9.out1)

# group: Boundaries
curvesFromCADLayers = CAD.CurvesFromCADLayers(importInstance=selected_dwg)
contains = String.Contains(string=curvesFromCADLayers.layerKeys, searchFor=boundary_layer)
filterByBoolMask_2 = List.FilterByBoolMask(list=curvesFromCADLayers.layerKeys, mask=contains)
curvesFromCADLayers_2 = CAD.CurvesFromCADLayers(importInstance=selected_dwg, layerNames=filterByBoolMask_2.in)
flatten_3 = List.Flatten(list=curvesFromCADLayers_2.Curve)
byCurveAndView = DynamoMEP.AreaBoundary.ByCurveAndView(curve=flatten_3, view=element_by_id, lacing=Longest)

passthrough = Custom[Passthrough](passThrough=originPoint, waitFor=byCurveAndView)  # package Clockwork for Dynamo 2.x; Forces a sequential order of execution. The node wired into the output of the Passthrough node will be executed *after* the node wired into the waitFor input (e.g. important for some Revit operations). The value of the passThrough input will be passed on to the node wired into the output port of the Passthrough node.
areas_create = Custom[© Areas.Create](view=element_by_id, points=passthrough)  # package Crumple; Given a view and a list of points, will create new areas at them. Note that you will need to provide a single view and list of points, or apply @levels to your inputs to have them work.
top_level = List.GetItemAtIndex(list=multipleinputform.User_Inputs, index=code_block_9.out3)
byName = WombatDynamo.Level.ByName(name=top_level)
elevation = Level.Elevation(level=byName)
byName_2 = WombatDynamo.Level.ByName(name=bottom_level)
elevation_2 = Level.Elevation(level=byName_2)
sub = elevation - elevation_2

# group: Area geometry
start = Revit.Transaction.Transaction.Start(input=areas_create)
end = Revit.Transaction.Transaction.End(input=start)
boundaries = Area.Boundaries(area=end)
byJoinedCurves = PolyCurve.ByJoinedCurves(curves=boundaries)
byPatch = Surface.ByPatch(closedCurve=byJoinedCurves)
boolean_3 = BoolSelector(false)
thicken = Surface.Thicken(surface=byPatch, thickness=sub, both_sides=boolean_3, lacing=Longest)
flatten_4 = List.Flatten(list=thicken)

material = List.GetItemAtIndex(list=multipleinputform.User_Inputs, index=code_block_9.out4)

# group: Create mass family
file_path = Filename("..\..\..\ProgramData\Autodesk\RVT 2023\Family Templates\Czech\Koncepční objemy\Objem.rft")
categories_4 = Categories("OST_Mass")
ꟿ_familyinstance_bygeometry = Custom[ꟿ FamilyInstance.ByGeometry](geometry=flatten_4, familyTemplatePath=file_path, familyName=add, category=categories_4, materialName=material, lacing=Longest)  # package spring nodes; You must provide a valid family template path that will be used for all input geometry objects. The project units(and not the templates) will be used to determine the size of the output geometry. The provided category will be used only if the family template supports it. If not, the default template category will be used instead. Likewise, the family material(provided as a string) will be set only if a material with that name exists in the template. If not, the default material will be used instead ("By Category"). For void cuts, the material settings will be ignored. The Subcategory name is an optional input. If you'd like to skip assigning a Subcategory to any new instance, simply use null. The node expects a unique family name for each geometry object. The rest of the input lists will be processed as if the node lacing is set to longest.

# group: Names check
categories_5 = Categories("OST_Mass")
byCategory = archilab.Revit.Selection.Select.ByCategory(category=categories_5)
getFamily = FamilyInstance.GetFamily(familyInstance=byCategory)
name_4 = Family.Name(family=getFamily)
eq = _ == name_4  # unwired: x; lacing=CrossProduct
anyTrue = List.AnyTrue(list=eq@L2)
if_ = RefactoredIf(test=anyTrue@L1)  # unwired: true, false
