# Dynamo graph TREES FROM CAD AND EXCEL.dyn (Dynamo 2.16.1.2727)
# packages: Clockwork for Dynamo 2.x 2.4.0, archi-lab.net 2023.213.1722

select_model_element = DSModelElementSelection()  # 1 picked in the model
allInstances = Custom[Element.AllInstances](element=select_model_element)  # package Clockwork for Dynamo 2.x; Retrieves all instances of a given element

# group: Excel data
file_path = Filename("..\Trutnov_SO 800_001-2_Tabulky_Kaceni.xlsx")
file_from_path = FileObject(path=file_path)
code_block = CodeBlock { "List1"; }
boolean = BoolSelector(true)
importExcel = Data.ImportExcel(file=file_from_path, sheetName=code_block, readAsStrings=boolean, showExcel=boolean)

transpose = List.Transpose(lists=importExcel)
code_block_2 = CodeBlock { 1; }
dropItems = List.DropItems(list=transpose@L2, amount=code_block_2)
code_block_3 = CodeBlock { 0; 2; 3; 4; }
getItemAtIndex = List.GetItemAtIndex(list=dropItems, index=code_block_3.out2)
getItemAtIndex_2 = List.GetItemAtIndex(list=dropItems, index=code_block_3.out0)
code_block_4 = CodeBlock { "Označení"; }
getParameterValueByName = Element.GetParameterValueByName(element=allInstances, parameterName=code_block_4)
indexOf = List.IndexOf(list=getItemAtIndex_2, element=getParameterValueByName)
getItemAtIndex_3 = List.GetItemAtIndex(list=getItemAtIndex, index=indexOf)
code_block_5 = CodeBlock { ","; "."; }
replace = String.Replace(string=getItemAtIndex_3, searchFor=code_block_5.out0, replaceWith=code_block_5.out1)
toNumber = String.ToNumber(string=replace)
code_block_6 = CodeBlock { 1000; }
mul = toNumber * code_block_6  # lacing=Longest
getItemAtIndex_4 = List.GetItemAtIndex(list=dropItems, index=code_block_3.out1)
getItemAtIndex_5 = List.GetItemAtIndex(list=getItemAtIndex_4, index=indexOf)
code_block_7 = CodeBlock { ","; "."; }
replace_2 = String.Replace(string=getItemAtIndex_5, searchFor=code_block_7.out0, replaceWith=code_block_7.out1)
toNumber_2 = String.ToNumber(string=replace_2)
code_block_8 = CodeBlock { 1000; }
mul_2 = toNumber_2 * code_block_8  # lacing=Longest
sub = mul - mul_2
getItemAtIndex_6 = List.GetItemAtIndex(list=dropItems, index=code_block_3.out3)
getItemAtIndex_7 = List.GetItemAtIndex(list=getItemAtIndex_6, index=indexOf)
code_block_9 = CodeBlock { ","; "."; }
replace_3 = String.Replace(string=getItemAtIndex_7, searchFor=code_block_9.out0, replaceWith=code_block_9.out1)
toNumber_3 = String.ToNumber(string=replace_3)
code_block_10 = CodeBlock { 1000; }
mul_3 = toNumber_3 * code_block_10  # lacing=Longest

# group: Set parameters
code_block_11 = CodeBlock { "Výška"; "Výška koruny"; "Průměr koruny"; }
setParameterByName = Element.SetParameterByName(element=allInstances, parameterName=code_block_11.out0, value=mul)
setParameterByName_2 = Element.SetParameterByName(element=setParameterByName, parameterName=code_block_11.out1, value=sub)
setParameterByName_3 = Element.SetParameterByName(element=setParameterByName_2, parameterName=code_block_11.out2, value=mul_3)

family_types = FamilyTypes("#Strom:1m")
getItemAtIndex_8 = List.GetItemAtIndex(list=dropItems, index=code_block_2)
uniqueItems = List.UniqueItems(list=getItemAtIndex_8)
duplicate = Custom[FamilyType.Duplicate](elementType=family_types, name=uniqueItems, lacing=Longest)  # package Clockwork for Dynamo 2.x; Duplicates a family type
id = Element.Id(element=duplicate)
indexOf_2 = List.IndexOf(list=uniqueItems, element=getItemAtIndex_8)
getItemAtIndex_9 = List.GetItemAtIndex(list=id, index=indexOf_2)
change_family_type = Custom[Change Family Type](element=allInstances, typeId=getItemAtIndex_9)  # package archi-lab.net; Changes family type of a family by passing in an Element and type id of the type we want to change it to.
