# Dynamo graph TREES FROM CAD.dyn (Dynamo 3.3.0.6316)
# packages: bimorphNodes 4.2.4, archi-lab.net 2025.300.1225

select_model_element = DSModelElementSelection()  # 1 picked in the model
curvesFromCADLayers = CAD.CurvesFromCADLayers(importInstance=select_model_element)
flatten = List.Flatten(list=curvesFromCADLayers.Curve)
clean = archilab.Lists.Lists.Clean(list=flatten)
centerPoint = Circle.CenterPoint(circle=clean)
clean_2 = archilab.Lists.Lists.Clean(list=centerPoint)
Z = Point.Z(point=clean_2)
X = Point.X(point=clean_2)
Y = Point.Y(point=clean_2)
code_block = CodeBlock { 0; }

# group: Family types
family_types = FamilyTypes("#Strom:#Strom")
byCoordinates = Point.ByCoordinates(x=X, y=Y, z=code_block)
pruneDuplicates = Point.PruneDuplicates(points=byCoordinates)
levels = Levels("teren")
byPointAndLevel = FamilyInstance.ByPointAndLevel(familyType=family_types, point=pruneDuplicates, level=levels)
