# Dynamo graph CHANGE WALL MATERIAL.dyn (Dynamo 2.6.2.15705)
# packages: Clockwork for Dynamo 2.x 2.4.0, spring nodes 210.1.1

categories = Categories("OST_Walls")
ꟿ_collect_alltypesof = Custom[ꟿ Collect.AllTypesOf](CategoryOrElemType=categories)  # package spring nodes; Works with either categories, element types or revit classes and uses multi-filters to get multiple groups with a single query. Can be applied as a function. No ties to the Document.Changed event.
name = Family.Name(family=ꟿ_collect_alltypesof)

# group: Vstupní hodnoty
string_to_search_for = CodeBlock { "Obecn"; }
material_name = CodeBlock { "Hliník"; }

contains = String.Contains(str=name, searchFor=string_to_search_for)
filterByBoolMask = List.FilterByBoolMask(list=ꟿ_collect_alltypesof, mask=contains)
code_block = CodeBlock { 0; }
byName = Material.ByName(name=material_name)
setCompoundLayerMaterial = Custom[FamilyType.SetCompoundLayerMaterial](familyType=filterByBoolMask.in, layerIndex=code_block, material=byName)  # package Clockwork for Dynamo 2.x; Sets the material of a specified compound layer of a given family type (only applies to family types that have a compound structure, e.g. walls, floors etc.).
