# Dynamo graph CREATE MATERIAL LAYOUT.dyn (Dynamo 2.16.1.2727)
# packages: Clockwork for Dynamo 2.x 2.4.0, Genius Loci 2023.2.21, WombatDynamo 2.3.4

element_classes = ElementTypes("Material")
all_elements_of_class = ElementsOfType(element_class=element_classes)
materialClass = Material.MaterialClass(material=all_elements_of_class)
groupByKey = List.GroupByKey(list=all_elements_of_class, keys=materialClass)
name = Material.Name(material=groupByKey.groups)
select_model_element = DSModelElementSelection()  # 1 picked in the model; graph input
location = Custom[Element.Location+](element=select_model_element)  # package Clockwork for Dynamo 2.x; Returns the location of an element as point, curve or curve loop, along with some booleans to help filtering the results. Unlike the OOTB Element.GetLocation node, it also retunrs sketch lines of sketch-based elements like floor slabs as well as the element's rotation property.
boolean = BoolSelector(true)
getActiveView = WombatDynamo.View.GetActiveView(update=boolean)
family_types = FamilyTypes("#Materiál:#Materiál")
familyinstance_origin_reference = Custom[FamilyInstance Origin Reference](element=select_model_element)  # package Genius Loci; Retrieves the origin point of the family instance.
XAxis = Vector.XAxis()
number = DoubleInput(2)  # graph input
getItemAtIndex = List.GetItemAtIndex(list=groupByKey.groups, index=number)
count = List.Count(list=getItemAtIndex)
code_block = CodeBlock(x=count) { 2000; x*2000; }
range = Range(start=code_block.out0, end=code_block.out1, step=code_block.out0)
translate = Geometry.Translate(geometry=familyinstance_origin_reference.Point, direction=XAxis, distance=range, lacing=Longest)
levels = Levels("Vše")
byPointAndLevel = FamilyInstance.ByPointAndLevel(familyType=family_types, point=translate, level=levels)
code_block_2 = CodeBlock { "Materiál"; }
setParameterByName = Element.SetParameterByName(element=byPointAndLevel, parameterName=code_block_2, value=getItemAtIndex)
family_types_2 = FamilyTypes("#Popiska materiálu:Název")
create_tag = Custom[Create Tag](view=getActiveView, element=setParameterByName, TagLocation=translate, TagType=family_types_2, horizontal=boolean, RunIt=boolean)  # package Genius Loci; Works only in Revit 2018 and later. Creates a tag at a given location, of given type and in a supplied view. The node also works with Linked Elements (except space and area), Multi Category tag and Material Tag. Based on an archilab node
