# Dynamo graph GET MATERIAL PLACEMENT.dyn (Dynamo 2.16.1.2727)
# packages: Data-Shapes 2022.2.106

all_elements_in_active_view = ElementsInView()  # frozen
getMaterials = Element.GetMaterials(element=all_elements_in_active_view)
name = Material.Name(material=getMaterials)
flatten = List.Flatten(list=name)
element_classes = ElementTypes("Material")
all_elements_of_class = ElementsOfType(element_class=element_classes)
name_2 = Material.Name(material=all_elements_of_class)
code_block = CodeBlock { "#"; }
file_path = Filename("..\..\PFM-Group a.s\BIM - General\01 - Container\Materiály a vzorové skladby\šabloná materiálů.xlsx")
file_from_path = FileObject(path=file_path)
worksheets = Custom[Excel.Worksheets](FilePath=file_from_path)  # package Data-Shapes; Gets worksheet names from specified Excel workbook.
importExcel = Data.ImportExcel(file=file_from_path, sheetName=worksheets)
code_block_2 = CodeBlock { "název"; }
indexOf = List.IndexOf(list=importExcel@L2, element=code_block_2)
code_block_3 = CodeBlock { 0; }
ge = indexOf >= code_block_3
filterByBoolMask = List.FilterByBoolMask(list=importExcel, mask=ge)
code_block_4 = CodeBlock { 0; }
getItemAtIndex = List.GetItemAtIndex(list=filterByBoolMask.out@L2, index=code_block_4)
add = code_block + getItemAtIndex
indexOf_2 = List.IndexOf(list=add, element=name_2)
code_block_5 = CodeBlock { 0; }
ge_2 = indexOf_2 >= code_block_5
filterByBoolMask_2 = List.FilterByBoolMask(list=name_2, mask=ge_2)
indexOf_3 = List.IndexOf(list=filterByBoolMask_2.out, element=flatten)
code_block_6 = CodeBlock { 0; }
ge_3 = indexOf_3 >= code_block_6
filterByBoolMask_3 = List.FilterByBoolMask(list=flatten, mask=ge_3)
uniqueItems = List.UniqueItems(list=filterByBoolMask_3.in)
byName = Material.ByName(name=uniqueItems)
indexOf_4 = List.IndexOf(list=byName, element=getMaterials)
code_block_7 = CodeBlock { 0; }
ge_4 = indexOf_4 >= code_block_7
boolean = BoolSelector(true)
contains = List.Contains(list=ge_4@L1, item=boolean, lacing=Longest)
filterByBoolMask_4 = List.FilterByBoolMask(list=all_elements_in_active_view, mask=contains)
delete = Element.Delete(element=byName)  # frozen
file_path_2 = Filename("..\Sešit1.xlsx")
code_block_8 = CodeBlock { "List1"; }
code_block_9 = CodeBlock { 1; }
watch = Watch(filterByBoolMask_2.out)
exportToExcel = Data.ExportToExcel(filePath=file_path_2, sheetName=code_block_8, startRow=code_block_9, startColumn=code_block_9, data=watch)  # frozen
