# Dynamo graph SET FAMILY TYPES MATERIAL.dyn (Dynamo 2.16.1.2727)
# packages: archi-lab.net 2023.213.1722, Clockwork for Dynamo 2.x 2.4.0, Data-Shapes 2022.2.106

code_block = CodeBlock { "Spustit"; "Zrušit"; "Přiřazení materiálu"; }
file_path = Filename("..\a99_black&white.jpg")
file_from_path = FileObject(path=file_path)
readFromFile = Image.ReadFromFile(file=file_from_path)
code_block_2 = CodeBlock { "Vybrat prvky"; }
selectmodelelements_data = Custom[SelectModelElements Data](ButtonText=code_block_2)  # package Data-Shapes; Creates a Revit element selection input for UI.MultipleInputForm++ . Check out www.data-shapes.net for more infos!
list_create = List.Create(item0=selectmodelelements_data)
boolean = BoolSelector(true)
multipleinputform = Custom[MultipleInputForm ++](Description_optional=code_block.out2, Logo_optional=readFromFile, ButtonText_optional=code_block.out0, Inputs=list_create, Toggle=boolean, CancelButtonText_optional=code_block.out1)  # package Data-Shapes; Create a form with multiple inputs. see www.data-shapes.net for tutorials and infos!
code_block_3 = CodeBlock { 0; }
getItemAtIndex = List.GetItemAtIndex(list=multipleinputform.User_Inputs, index=code_block_3)
familyType = Custom[FamilyInstance.FamilyType](familyInstance=getItemAtIndex)  # package archi-lab.net; This node will return a Family Type of a given Family Instance. If no Family Type can be assigned to a Family then it will return Null.
familyName = Custom[FamilyType.FamilyName](familyType=familyType)  # package Clockwork for Dynamo 2.x; Returns the *family* name of a given family *type*
byName = Family.ByName(name=familyName)
types = Family.Types(family=byName)
flatten = List.Flatten(list=types)
code_block_4 = CodeBlock { "Spustit"; "Zrušit"; "Přiřazení materiálu"; }
file_path_2 = Filename("..\a99_black&white.jpg")
file_from_path_2 = FileObject(path=file_path_2)
readFromFile_2 = Image.ReadFromFile(file=file_from_path_2)
code_block_5 = CodeBlock { "Materiál"; }
categories = Categories("OST_Materials")
all_elements_of_category = ElementsOfCategory(Category=categories)
name = Material.Name(material=all_elements_of_category)
flatten_2 = List.Flatten(list=name)
boolean_2 = BoolSelector(false)
listview_data = Custom[Listview Data](InputName=code_block_5, Keys=flatten_2, Values=flatten_2, SortItems_optionnal=boolean_2)  # package Data-Shapes; Create data for ListView input in UI.MultiInputForm ++ . Check out www.data-shapes.net for more infos.
code_block_6 = CodeBlock { "Výběr parametru"; }
parameters = Element.Parameters(element=getItemAtIndex)
parameters_2 = Element.Parameters(element=familyType)
join = List.Join(list0=parameters, list1=parameters_2)
flatten_3 = List.Flatten(list=join)
specType = Parameter.SpecType(parameter=flatten_3)
string_from_object = FromObject(object=specType)
spec_types = SpecTypes("autodesk.spec.aec:material")
string_from_object_2 = FromObject(object=spec_types)
eq = string_from_object == string_from_object_2
filterByBoolMask = List.FilterByBoolMask(list=flatten_3, mask=eq)
uniqueItems = List.UniqueItems(list=filterByBoolMask.in)
listview_data_2 = Custom[Listview Data](InputName=code_block_6, Keys=uniqueItems, Values=uniqueItems)
join_2 = List.Join(list0=listview_data, list1=listview_data_2)
boolean_3 = BoolSelector(true)
multipleinputform_2 = Custom[MultipleInputForm ++](Description_optional=code_block_4.out2, Logo_optional=readFromFile_2, ButtonText_optional=code_block_4.out0, Inputs=join_2, Toggle=boolean_3, CancelButtonText_optional=code_block_4.out1)
code_block_7 = CodeBlock { 0; 1; }
getItemAtIndex_2 = List.GetItemAtIndex(list=multipleinputform_2.User_Inputs, index=code_block_7.out1)
string_from_object_3 = FromObject(object=getItemAtIndex_2)
code_block_8 = CodeBlock { " :"; }
split = String.Split(string=string_from_object_3, separator0=code_block_8)
flatten_4 = List.Flatten(list=split)
code_block_9 = CodeBlock { 2; -1; }
takeEveryNthItem = List.TakeEveryNthItem(list=flatten_4, n=code_block_9.out0, offset=code_block_9.out1)
getItemAtIndex_3 = List.GetItemAtIndex(list=multipleinputform_2.User_Inputs, index=code_block_7.out0)
byName_2 = Material.ByName(name=getItemAtIndex_3)
setParameterByName = Element.SetParameterByName(element=flatten, parameterName=takeEveryNthItem, value=byName_2, lacing=CrossProduct)
