# Dynamo graph SET WALL MATERIAL.dyn (Dynamo 2.16.1.2727)
# packages: archi-lab.net 2023.213.1722, Data-Shapes 2022.2.106, Genius Loci 2023.2.21

code_block = CodeBlock { "Nastavení barev materiálu"; }
code_block_2 = CodeBlock { "Spustit"; }
code_block_3 = CodeBlock { "Barva pozadí"; "Vybrat barvu"; }
colorinput_data = Custom[ColorInput Data](InputName=code_block_3.out0, ButtonText=code_block_3.out1)  # package Data-Shapes; Create a color selection input for UI.MultiInputForm++ . Check out www.data-shapes.net for more infos! Warning : Only works with Revit 2017
code_block_4 = CodeBlock { "Barva šrafy v popředí"; "Vybrat barvu"; }
colorinput_data_2 = Custom[ColorInput Data](InputName=code_block_4.out0, ButtonText=code_block_4.out1)
code_block_5 = CodeBlock { "Vybrat stěnu"; }
categories = Categories("OST_Walls")
boolean = BoolSelector(true)
selectmodelelements_data = Custom[SelectModelElements Data](ButtonText=code_block_5, CategoryFilter=categories, SelectSingleElement=boolean)  # package Data-Shapes; Creates a Revit element selection input for UI.MultipleInputForm++ . Check out www.data-shapes.net for more infos!
join = List.Join(list0=colorinput_data, list1=colorinput_data_2, list2=selectmodelelements_data)
boolean_2 = BoolSelector(true)
code_block_6 = CodeBlock { "Zrušit"; }
multipleinputform = Custom[MultipleInputForm ++](Description_optional=code_block, ButtonText_optional=code_block_2, Inputs=join, Toggle=boolean_2, CancelButtonText_optional=code_block_6)  # package Data-Shapes; Create a form with multiple inputs. see www.data-shapes.net for tutorials and infos!
code_block_7 = CodeBlock { 0; 1; 2; }
getItemAtIndex = List.GetItemAtIndex(list=multipleinputform.User_Inputs, index=code_block_7.out2)
getMaterials = Element.GetMaterials(element=getItemAtIndex)
code_block_8 = CodeBlock { 0; }
getItemAtIndex_2 = List.GetItemAtIndex(list=getMaterials, index=code_block_8)
material_get_properties = Custom[Material Get Properties](material=getItemAtIndex_2)  # package Genius Loci; Get name, color, transparency, SurfaceForeground, SurfaceBackground, CutForeground and CutBackground patterns from the given material. Note : Prior to Revit 2019, the materials have only one surface pattern and one cut pattern.
getItemAtIndex_3 = List.GetItemAtIndex(list=material_get_properties.SurfaceForegroundPattern, index=code_block_8)
fill_patterns = FillPatterns("<Plná výplň>")
getItemAtIndex_4 = List.GetItemAtIndex(list=multipleinputform.User_Inputs, index=code_block_7.out1)
list_create = List.Create(item0=getItemAtIndex_4)
autodesk_revit_db_color_to_ds = Python(IN[0]=list_create)  # "Autodesk.Revit.DB.Color to DS.core color"; CPython3
# ---------- autodesk_revit_db_color_to_ds.python (22 lines) ----------
# Written outside Dynamo, so needs testing
import clr
clr.AddReference("RevitAPI")
import Autodesk 
from Autodesk.Revit.DB import *
def tolist(obj1):
	if hasattr(obj1,'__iter__') : return obj1
	else : return [obj1]
# Get your list of DB colours
colorList = tolist(IN[0])

# Make lists to add to
r,g,b = [],[],[]

# Get their RGB values
for c in colorList:
	r.append(int(c.Red))
	g.append(int(c.Green))
	b.append(int(c.Blue))

# Send the output as three lists
OUT = r,g,b
# ----------------------------------------
flatten = List.Flatten(list=autodesk_revit_db_color_to_ds)
code_block_9 = CodeBlock { 0; 1; 2; }
getItemAtIndex_5 = List.GetItemAtIndex(list=flatten, index=code_block_9.out0)
getItemAtIndex_6 = List.GetItemAtIndex(list=flatten, index=code_block_9.out1)
getItemAtIndex_7 = List.GetItemAtIndex(list=flatten, index=code_block_9.out2)
byARGB = Color.ByARGB(red=getItemAtIndex_5, green=getItemAtIndex_6, blue=getItemAtIndex_7)
getItemAtIndex_8 = List.GetItemAtIndex(list=multipleinputform.User_Inputs, index=code_block_7.out0)
list_create_2 = List.Create(item0=getItemAtIndex_8)
autodesk_revit_db_color_to_ds_2 = Python(IN[0]=list_create_2)  # "Autodesk.Revit.DB.Color to DS.core color"; CPython3; same code as autodesk_revit_db_color_to_ds
flatten_2 = List.Flatten(list=autodesk_revit_db_color_to_ds_2)
code_block_10 = CodeBlock { 0; 1; 2; }
getItemAtIndex_9 = List.GetItemAtIndex(list=flatten_2, index=code_block_10.out0)
getItemAtIndex_10 = List.GetItemAtIndex(list=flatten_2, index=code_block_10.out1)
getItemAtIndex_11 = List.GetItemAtIndex(list=flatten_2, index=code_block_10.out2)
byARGB_2 = Color.ByARGB(red=getItemAtIndex_9, green=getItemAtIndex_10, blue=getItemAtIndex_11)
setCutPattern = archilab.Revit.Elements.Materials.SetCutPattern(material=getItemAtIndex_2, foregroundPattern=getItemAtIndex_3, backgroundPattern=fill_patterns, foregroundPatternColor=byARGB, backgroundPatternColor=byARGB_2)
