# Dynamo graph FAMILY SUBCATEGORY.dyn (Dynamo 2.16.1.2727)
# packages: archi-lab.net 2023.213.1722, Macro4BIM 2023.1.1, Clockwork for Dynamo 2.x 2.4.0, Data-Shapes 2022.2.106

code_block = CodeBlock { "Konec"; "Zrušit"; }
code_block_2 = CodeBlock { "Rodiny"; }
code_block_3 = CodeBlock { "Spustit"; "Zrušit"; }
code_block_4 = CodeBlock { "Výběr kategorie"; }
getAll = archilab.Revit.Elements.Categories.GetAll()
dropdown_data = Custom[DropDown Data](InputName=code_block_4, Keys=getAll.Model, Values=getAll.Model)  # package Data-Shapes; Create data for DropDown input in UI.MultiInputForm ++ . Check out www.data-shapes.net for more infos.
boolean = BoolSelector(true)
multipleinputform = Custom[MultipleInputForm ++](ButtonText_optional=code_block_3.out0, Inputs=dropdown_data, Toggle=boolean, CancelButtonText_optional=code_block_3.out1)  # package Data-Shapes; Create a form with multiple inputs. see www.data-shapes.net for tutorials and infos!
string_from_object = FromObject(object=multipleinputform.User_Inputs)
byName = Category.ByName(name=string_from_object)
all_placed_family_types_of = Custom[All Placed Family Types of Category](category=byName)  # package Clockwork for Dynamo 2.x; Retrieves all family types of a given category that have *placed* instances
family = FamilyType.Family(familyType=all_placed_family_types_of)
𝑀⁴𝐵_family_subcategory = Custom[𝑀⁴𝐵 Family.Subcategory](family=family)  # package Macro4BIM; Collect the subcategories from the given family and compare with the project ones.
code_block_5 = CodeBlock { "Spustit"; "Zrušit"; }
code_block_6 = CodeBlock { "Výběr podkategorie"; }
flatten = List.Flatten(list=𝑀⁴𝐵_family_subcategory.subcategories)
uniqueItems = List.UniqueItems(list=flatten)
dropdown_data_2 = Custom[DropDown Data](InputName=code_block_6, Keys=uniqueItems, Values=uniqueItems)
boolean_2 = BoolSelector(true)
multipleinputform_2 = Custom[MultipleInputForm ++](ButtonText_optional=code_block_5.out0, Inputs=dropdown_data_2, Toggle=boolean_2, CancelButtonText_optional=code_block_5.out1)
contains = List.Contains(list=𝑀⁴𝐵_family_subcategory.subcategories, item=multipleinputform_2.User_Inputs, lacing=Longest)
filterByBoolMask = List.FilterByBoolMask(list=family, mask=contains)
clear_list = Custom[Clear List](input=filterByBoolMask.in)  # package archi-lab.net; This node will remove all Null and Empty Lists from any list.
listview_data = Custom[Listview Data](InputName=code_block_2, Keys=clear_list, Values=clear_list)  # package Data-Shapes; Create data for ListView input in UI.MultiInputForm ++ . Check out www.data-shapes.net for more infos.
list_create = List.Create(item0=listview_data)
boolean_3 = BoolSelector(true)
multipleinputform_3 = Custom[MultipleInputForm ++](ButtonText_optional=code_block.out0, Inputs=list_create, Toggle=boolean_3, CancelButtonText_optional=code_block.out1)
