# Dynamo graph GET FAMILY PARAMETER.dyn (Dynamo 2.16.1.2727)
# packages: WombatDynamo 2.3.4

select_model_element = DSModelElementSelection()  # 1 picked in the model
getFamily = FamilyInstance.GetFamily(familyInstance=select_model_element)
parameters = Element.Parameters(element=getFamily)
getType = WombatDynamo.Element.GetType(element=select_model_element)
parameters_2 = Element.Parameters(element=getType)
parameters_3 = Element.Parameters(element=select_model_element)
list_create = List.Create(item0=parameters, item1=parameters_2, item2=parameters_3)
flatten = List.Flatten(list=list_create)
isShared = Parameter.IsShared(parameter=flatten)
filterByBoolMask = List.FilterByBoolMask(list=flatten, mask=isShared)
watch = Watch(filterByBoolMask.in)
isReadOnly = Parameter.IsReadOnly(parameter=filterByBoolMask.out)
filterByBoolMask_2 = List.FilterByBoolMask(list=filterByBoolMask.out, mask=isReadOnly)
watch_2 = Watch(filterByBoolMask_2.out)
