# Dynamo graph GET SUBCATEGORY.dyn (Dynamo 2.16.1.2727)
# packages: Clockwork for Dynamo 2.x 2.4.0, Genius Loci 2023.2.21

code_block = CodeBlock { "Dveře"; }
byName = Category.ByName(name=code_block)
all_families_of_category = Custom[All Families Of Category](category=byName)  # package Clockwork for Dynamo 2.x; Gets all famiies of a given category in the model (does *not *work for system families)
family_subcategory = Custom[Family SubCategory](FamilyOrFamilyInstance=all_families_of_category@L1)  # package Genius Loci; Retrieves the category and subcategories of a given family or family instance.
subcategories = Custom[Category.Subcategories](category=byName)  # package Clockwork for Dynamo 2.x; Retrieves all the subcategories for a given category
code_block_2 = CodeBlock { 0; }
getItemAtIndex = List.GetItemAtIndex(list=subcategories, index=code_block_2)
string_from_object = FromObject(object=getItemAtIndex)
eq = family_subcategory.SubCategory == string_from_object
filterByBoolMask = List.FilterByBoolMask(list=family_subcategory.SubCategory, mask=eq)
