# Dynamo graph RANDOM VALUES FOR GRASS.dyn (Dynamo 2.16.2.5624)

# group: Input
code_block = CodeBlock { "Rodina1"; }
byName = Family.ByName(name=code_block)
types = Family.Types(family=byName)
byFamilyType = FamilyInstance.ByFamilyType(familyType=types)
flatten = List.Flatten(list=byFamilyType)

code_block_2 = CodeBlock { "a1"; "a2"; "b1"; "b2"; "b3"; }
count = List.Count(list=flatten)
code_block_3 = CodeBlock { 3; }

# group: Edit
code_block_4 = CodeBlock { 50; 200; }
randomList = Math.RandomList(amount=count, value1=code_block_4.out0, value2=code_block_4.out1, seed=code_block_3, lacing=Longest)

setParameterByName = Element.SetParameterByName(element=flatten, parameterName=code_block_2.out1, value=randomList)

# group: Edit
code_block_5 = CodeBlock { 50; 150; }
randomList_2 = Math.RandomList(amount=count, value1=code_block_5.out0, value2=code_block_5.out1, seed=code_block_3, lacing=Longest)

setParameterByName_2 = Element.SetParameterByName(element=flatten, parameterName=code_block_2.out2, value=randomList_2)

# group: Edit
code_block_6 = CodeBlock { 100; 400; }
randomList_3 = Math.RandomList(amount=count, value1=code_block_6.out0, value2=code_block_6.out1, seed=code_block_3, lacing=Longest)

setParameterByName_3 = Element.SetParameterByName(element=flatten, parameterName=code_block_2.out3, value=randomList_3)

# group: Edit
code_block_7 = CodeBlock { 200; 600; }
randomList_4 = Math.RandomList(amount=count, value1=code_block_7.out0, value2=code_block_7.out1, seed=code_block_3, lacing=Longest)

setParameterByName_4 = Element.SetParameterByName(element=flatten, parameterName=code_block_2.out4, value=randomList_4)

# group: Edit
code_block_8 = CodeBlock { 50; 100; }
randomList_5 = Math.RandomList(amount=count, value1=code_block_8.out0, value2=code_block_8.out1, seed=code_block_3, lacing=Longest)

setParameterByName_5 = Element.SetParameterByName(element=flatten, parameterName=code_block_2.out0, value=randomList_5, lacing=Longest)
code_block_9 = CodeBlock { 0; 360; 5; }
randomList_6 = Math.RandomList(amount=count, value1=code_block_9.out0, value2=code_block_9.out1, seed=code_block_9.out2)
setRotation = FamilyInstance.SetRotation(familyInstance=setParameterByName_5, degree=randomList_6)
