# Dynamo graph SEARCH FAMILY BY PARAMETER.dyn (Dynamo 2.16.1.2727)
# packages: Macro4BIM 2023.1.1, Rhythm 2023.2.2

model_categories = ModelCategories("Nábytek")
𝑀⁴𝐵_family = Custom[𝑀⁴𝐵 Family.AllFamiliesInActiveDoc](category=model_categories)  # package Macro4BIM
types = Family.Types(family=𝑀⁴𝐵_family)
byFamilyType = FamilyInstance.ByFamilyType(familyType=types)
code_block = CodeBlock { 0; }
getItemAtIndex = List.GetItemAtIndex(list=byFamilyType@L2, index=code_block)
parameters = Element.Parameters(element=getItemAtIndex)
name = Parameter.Name(parameter=parameters)
flatten = List.Flatten(list=name)
uniqueItems = List.UniqueItems(list=flatten)
parameters_2 = Element.Parameters(element=types)
name_2 = Parameter.Name(parameter=parameters_2)
code_block_2 = CodeBlock { "Délka"; }
contains = List.Contains(list=name_2@L2, item=code_block_2)
filterByBoolMask = List.FilterByBoolMask(list=types@L1, mask=contains)
flatten_2 = List.Flatten(list=filterByBoolMask.in)
contains_2 = List.Contains(list=name@L2, item=code_block_2)
filterByBoolMask_2 = List.FilterByBoolMask(list=byFamilyType, mask=contains_2)
flatten_3 = List.Flatten(list=filterByBoolMask_2.in)
flatten_4 = List.Flatten(list=name_2)
uniqueItems_2 = List.UniqueItems(list=flatten_4)
