# Dynamo graph PLACE BLIND BOX.dyn (Dynamo 3.3.0.6316)
# packages: Genius Loci 2024.5.29, archi-lab.net 2025.300.1225, Crumple 2024.4.3

select_model_element_by_category = DSModelElementByCategorySelection("OST_Windows")  # 1 picked in the model; graph input
code_block = CodeBlock { "Typ žaluziového boxu"; }
code_block_2 = CodeBlock { "#Bez boxu"; }
byName = FamilyType.ByName(name=code_block_2)
getParameterValueByName = Element.GetParameterValueByName(element=select_model_element_by_category, parameterName=code_block)
element_host = Custom[Element Host](element=select_model_element_by_category)  # package Genius Loci; Gets the host of the element. Unlike the OOTB node FamilyInstance.GetHost, it also works for elements hosted by a linked document, wall sweeps, foundations, railings and builing pads. Based on a Clockwork's node
faces = Element.Faces(element=element_host)
tangentAtUParameter = Surface.TangentAtUParameter(surface=faces)
ZAxis = Vector.ZAxis()
isParallel = Vector.IsParallel(vector=tangentAtUParameter, otherVector=ZAxis)
filterByBoolMask = List.FilterByBoolMask(list=faces, mask=isParallel)
getChildElements = Element.GetChildElements(element=select_model_element_by_category)
id = Element.Id(element=getParameterValueByName)
type = archilab.Revit.Elements.Elements.Type(element=getChildElements)
id_2 = Element.Id(element=type)
eq = id == id_2
filterByBoolMask_2 = List.FilterByBoolMask(list=getChildElements, mask=eq)
location = FamilyInstance.Location(familyInstance=filterByBoolMask_2.in)
distanceTo = Geometry.DistanceTo(geometry=filterByBoolMask.in, other=location, lacing=Longest)
sortListByAnother = archilab.Lists.Lists.SortListByAnother(list=filterByBoolMask.in, sortBy=distanceTo)
firstItem = List.FirstItem(list=sortListByAnother.list@L2)
normalAtParameter = Surface.NormalAtParameter(surface=firstItem)
reverse = Vector.Reverse(vector=ZAxis)
cross = Vector.Cross(vector=normalAtParameter, cross=reverse)
byFace = FamilyInstance.ByFace(familyType=getParameterValueByName, face=firstItem, location=location, referenceDirection=cross)  # graph output
flow_waitfor = Custom[© Flow.WaitFor](data=byName, waitFor=byFace)  # package Crumple; Tells the first input to wait for the second input to arrive, then passes on the first input. Really useful for scripts which have branching paths that rely on their outputs to carry each other forward. Quite a few custom packages have a 'passthrough' or 'waitfor' node. I use these all the time, so find it useful to have them contained in this package also.
setParameterByName = Element.SetParameterByName(element=select_model_element_by_category, parameterName=code_block, value=flow_waitfor)
code_block_3 = CodeBlock { "Délka žaluzií"; }
getParameterValueByName_2 = Element.GetParameterValueByName(element=filterByBoolMask_2.in, parameterName=code_block_3)
setParameterByName_2 = Element.SetParameterByName(element=byFace, parameterName=code_block_3, value=getParameterValueByName_2)
code_block_4 = CodeBlock { "Výška žaluzií"; }
getParameterValueByName_3 = Element.GetParameterValueByName(element=filterByBoolMask_2.in, parameterName=code_block_4)
setParameterByName_3 = Element.SetParameterByName(element=byFace, parameterName=code_block_4, value=getParameterValueByName_3)
