# Dynamo graph ROOMS TO MASS.dyn (Dynamo 2.16.2.5624)

select_model_element = DSModelElementSelection()  # 1 picked in the model
geometry = Element.Geometry(element=select_model_element)
select_model_element_2 = DSModelElementSelection()  # 1 picked in the model
geometry_2 = Element.Geometry(element=select_model_element_2)
union = Solid.Union(solid=geometry, solid_2=geometry_2)
categories = Categories("OST_Mass")
byGeometry = DirectShape.ByGeometry(geometry=union, category=categories)
