# Dynamo graph TRANSFER CAD OVERRIDE.dyn (Dynamo 3.3.0.6316)
# packages: Genius Loci 2024.5.29, bimorphNodes 5.1.3, Clockwork for Dynamo 2.x 2.4.0, archi-lab.net 2025.300.1225

select_model_element = DSModelElementSelection()  # 1 picked in the model
ownerView = Custom[Element.OwnerView](element=select_model_element)  # package Clockwork for Dynamo 2.x; Gets the owner view of a given Revit element (if possible)
cadlayer_visibility = Custom[CADLayer Visibility](importInstance=select_model_element, view=ownerView)  # package Genius Loci; Checks if the layers (Imported Categories) of the CAD link or import are set to be invisible (hidden) in the given view.
select_model_element_2 = DSModelElementSelection()  # 1 picked in the model
views = Views("1NP – Koordinace")
cadlayer_visibility_2 = Custom[CADLayer Visibility](importInstance=select_model_element_2, view=views)
contains = List.Contains(list=cadlayer_visibility.Visible_Layer_Name, item=cadlayer_visibility_2.Hidden_Layer_Name, lacing=CrossProduct)
anyTrue = List.AnyTrue(list=contains@L2)
filterByBoolMask = List.FilterByBoolMask(list=cadlayer_visibility.Visible_Layer_Name, mask=anyTrue)
sort = List.Sort(list=filterByBoolMask.in)
code_block = CodeBlock { false; }
setLayerVisibility = Revit.ImportInstance.SetLayerVisibility(importInstance=select_model_element, view=ownerView, layerName=sort, visible=code_block, lacing=Longest)
getCategory = Element.GetCategory(element=select_model_element)
subcategories = Custom[Category.Subcategories](category=getCategory)  # package Clockwork for Dynamo 2.x; Retrieves all the subcategories for a given category
name = Category.Name(category=subcategories)
name_2 = Category.Name(category=getCategory)
cadlayer_overrides = Custom[CADLayer Overrides](importInstance=select_model_element_2, view=views)  # package Genius Loci; Get the graphic overrides applied to the CAD link or import layers (Imported Categories) in the given view.
code_block_2 = CodeBlock(x=name_2, y=cadlayer_overrides.layerName) { x+" - " +y; }
contains_2 = List.Contains(list=name, item=code_block_2, lacing=CrossProduct)
anyTrue_2 = List.AnyTrue(list=contains_2@L2)
filterByBoolMask_2 = List.FilterByBoolMask(list=subcategories, mask=anyTrue_2)
create = archilab.Revit.Elements.OverrideGraphicsSettings.Create(projectionLineColor=cadlayer_overrides.ProjectionLineColor, projectionLineWeight=cadlayer_overrides.ProjectionLineWeight, projectionLinePattern=cadlayer_overrides.ProjectionLinePattern, halftone=cadlayer_overrides.Halftone, lacing=Longest)
isNull = Object.IsNull(object=create)
filterByBoolMask_3 = List.FilterByBoolMask(list=filterByBoolMask_2.in, mask=isNull)
count = List.Count(list=filterByBoolMask_3.out)
ofRepeatedItem = List.OfRepeatedItem(item=ownerView, amount=count)
filterByBoolMask_4 = List.FilterByBoolMask(list=create, mask=isNull)
setCategoryOverrides = archilab.Revit.Views.Views.SetCategoryOverrides(view=ofRepeatedItem, category=filterByBoolMask_3.out, overrides=filterByBoolMask_4.out)
