# Dynamo graph WALLS vs PIPES.dyn (Dynamo 3.2.1.5366)

categories = Categories("OST_Walls")
all_elements_of_category = ElementsOfCategory(Category=categories)
geometry = Element.Geometry(element=all_elements_of_category)
flatten = List.Flatten(list=geometry)
join = List.Join()  # unwired: list0, list1
categories_2 = Categories("OST_PipeCurves")
all_elements_of_category_2 = ElementsOfCategory(Category=categories_2)
code_block = CodeBlock { "Průměr"; }
getParameterValueByName = Element.GetParameterValueByName(element=all_elements_of_category_2, parameterName=code_block)
code_block_2 = CodeBlock { 100; }
gt = getParameterValueByName > code_block_2
filterByBoolMask = List.FilterByBoolMask(list=all_elements_of_category_2, mask=gt)
cartesianProduct = List.CartesianProduct(combineFunction=join, list0=all_elements_of_category, list1=filterByBoolMask.in)
code_block_3 = CodeBlock { 1; }
flatten_2 = List.Flatten(list=cartesianProduct, amount=code_block_3)
geometry_2 = Element.Geometry(element=filterByBoolMask.in)
flatten_3 = List.Flatten(list=geometry_2)
cartesianProduct_2 = List.CartesianProduct(combineFunction=join, list0=flatten, list1=flatten_3)
code_block_4 = CodeBlock { 0; 1; }
getItemAtIndex = List.GetItemAtIndex(list=cartesianProduct_2@L2, index=code_block_4.out0)
getItemAtIndex_2 = List.GetItemAtIndex(list=cartesianProduct_2@L2, index=code_block_4.out1)
doesIntersect = Geometry.DoesIntersect(geometry=getItemAtIndex, other=getItemAtIndex_2)
filterByBoolMask_2 = List.FilterByBoolMask(list=flatten_2, mask=doesIntersect)
indexOf = List.IndexOf(list=all_elements_of_category, element=filterByBoolMask_2.in)
code_block_5 = CodeBlock { -1; }
gt_2 = indexOf > code_block_5
filterByBoolMask_3 = List.FilterByBoolMask(list=indexOf, mask=gt_2)
flatten_4 = List.Flatten(list=filterByBoolMask_3.in)
getItemAtIndex_3 = List.GetItemAtIndex(list=flatten, index=flatten_4)
indexOf_2 = List.IndexOf(list=filterByBoolMask.in, element=filterByBoolMask_2.in)
code_block_6 = CodeBlock { -1; }
gt_3 = indexOf_2 > code_block_6
filterByBoolMask_4 = List.FilterByBoolMask(list=indexOf_2, mask=gt_3)
flatten_5 = List.Flatten(list=filterByBoolMask_4.in)
getItemAtIndex_4 = List.GetItemAtIndex(list=flatten_3, index=flatten_5)
intersect = Geometry.Intersect(geometry=getItemAtIndex_3, other=getItemAtIndex_4)
centroid = Solid.Centroid(solid=intersect)
