# Dynamo graph karol.dyn (Dynamo 3.3.0.6316)
# packages: archi-lab.net 2025.300.1225, WombatDynamo 2.3.5, Clockwork for Dynamo 2.x 2.4.0

categories = Categories("OST_Doors")
all_elements_of_category = ElementsOfCategory(Category=categories)
categories_2 = Categories("OST_Windows")
all_elements_of_category_2 = ElementsOfCategory(Category=categories_2)
type = archilab.Revit.Elements.Elements.Type(element=all_elements_of_category_2)
code_block = CodeBlock { "Štítek"; }
getParameterValueByName = Element.GetParameterValueByName(element=type, parameterName=code_block)
code_block_2 = CodeBlock { "#Okno"; }
eq = getParameterValueByName == code_block_2
filterByBoolMask = List.FilterByBoolMask(list=all_elements_of_category_2, mask=eq)
select_model_element = DSModelElementSelection()  # 1 picked in the model
id = Element.Id(element=select_model_element)
rooms = Custom[Window.Rooms](window=filterByBoolMask.in)  # package Clockwork for Dynamo 2.x; Gets the rooms that are connected by a given window
id_2 = Element.Id(element=rooms.fromRoom)
eq_2 = id == id_2
filterByBoolMask_2 = List.FilterByBoolMask(list=filterByBoolMask.in, mask=eq_2)
rooms_2 = Custom[Window.Rooms](window=filterByBoolMask_2.in)
code_block_3 = CodeBlock { 2; }
lt = rooms_2.roomCount < code_block_3
filterByBoolMask_3 = List.FilterByBoolMask(list=filterByBoolMask_2.in, mask=lt)
type_2 = archilab.Revit.Elements.Elements.Type(element=filterByBoolMask_3.in)
code_block_4 = CodeBlock { "Šířka"; }
getParameterValueByName_2 = Element.GetParameterValueByName(element=type_2, parameterName=code_block_4)
code_block_5 = CodeBlock { "Výška"; }
getParameterValueByName_3 = Element.GetParameterValueByName(element=type_2, parameterName=code_block_5)
mul = getParameterValueByName_2 * getParameterValueByName_3
geometry = Element.Geometry(element=select_model_element)
spatial_element_boundary = SpatialElementBoundaryLocationUI("Center")  # "Spatial Element Boundary Locations"
boundaries = archilab.Revit.Elements.Room.Boundaries(room=select_model_element, boundaryLocation=spatial_element_boundary)
flatten = List.Flatten(list=boundaries.Elements)
categories_3 = Categories("OST_Rooms")
all_elements_of_category_3 = ElementsOfCategory(Category=categories_3)
area = Room.Area(room=all_elements_of_category_3)
code_block_6 = CodeBlock { 0; }
gt = area > code_block_6
filterByBoolMask_4 = List.FilterByBoolMask(list=all_elements_of_category_3, mask=gt)
id_3 = Element.Id(element=filterByBoolMask_4.in)
eq_3 = id_3 == id
filterByBoolMask_5 = List.FilterByBoolMask(list=filterByBoolMask_4.in, mask=eq_3)
geometry_2 = Element.Geometry(element=filterByBoolMask_5.out)
flatten_2 = List.Flatten(list=geometry_2)
code_block_7 = CodeBlock { 500; }
smartOffset = WombatDynamo.Curve.SmartOffset(curve=boundaries.Curves, offsetDist=code_block_7)
flatten_3 = List.Flatten(list=smartOffset)
doesIntersect = Geometry.DoesIntersect(geometry=flatten_2, other=flatten_3, lacing=CrossProduct)
transpose = List.Transpose(lists=doesIntersect)
anyTrue = List.AnyTrue(list=transpose@L2)
filterByBoolMask_6 = List.FilterByBoolMask(list=flatten, mask=anyTrue)
geometry_3 = Element.Geometry(element=filterByBoolMask_6.out)
intersect = Geometry.Intersect(geometry=geometry, other=geometry_3, lacing=Longest)
explode = Geometry.Explode(geometry=geometry)
byJoinedSurfaces = PolySurface.ByJoinedSurfaces(surfaces=explode)
intersect_2 = Geometry.Intersect(geometry=byJoinedSurfaces, other=geometry_3, lacing=Longest)
